# Grasshopper definition CT_NEW_UI_Example.gh (Grasshopper 1.0.7)

number_slider = Slider(0.4, range=0..1)
geo = Geometry([<curve referenced from the Rhino model> x8])
geo_2 = Geometry([<curve referenced from the Rhino model> x8])
geo_3 = Geometry(<curve referenced from the Rhino model>)
Z = UnitZ(Factor=1)
geo_4 = Geometry([<curve referenced from the Rhino model> x3])
geo_5 = Geometry(<curve referenced from the Rhino model>)
beam = CTBeam(Centerline=geo_4, ZVector=Point(0, 0, 1), Width=0.2, Height=0.2)  # -> Beam, Blank; inputs Centerline: list of Guid, ZVector: list of Vector3d, Width: list, Height: list, Category: list, updateRefObj: Boolean
#   port Centerline: Referenced curve or line, Guid of curve or line in the active Rhino document.
#   port ZVector: Vector defining the orientation of the cross-section (corresponds to the height dimension). If None, a default will be taken.
#   port Width: Width of the cross-section (usually the smaller dimension).
#   port Height: Height of the cross-section (usually the larger dimension).
#   port Category: Category of a beam.
#   port updateRefObj: (optional) If True, the attributes in the referenced object will be updated/overwritten with the new values given here.
#   port Beam: Beam object(s).
#   port Blank: Shape of the beam's blank.
# ---------- beam: Python ----------
"""Creates a Beam from a LineCurve."""

from compas.geometry import Line
from compas.scene import Scene
from compas_rhino.conversions import curve_to_compas
from compas_rhino.conversions import vector_to_compas
from ghpythonlib.componentbase import executingcomponent as component
from Grasshopper.Kernel.GH_RuntimeMessageLevel import Error
from Grasshopper.Kernel.GH_RuntimeMessageLevel import Warning
from Rhino.RhinoDoc import ActiveDoc

from compas_timber.ghpython.rhino_object_name_attributes import update_rhobj_attributes_name
from compas_timber.parts import Beam as CTBeam


class Beam_fromCurve(component):
    def RunScript(self, Centerline, ZVector, Width, Height, Category, updateRefObj):
        # minimum inputs required
        if not Centerline:
            self.AddRuntimeMessage(Warning, "Input parameter 'Centerline' failed to collect data")
        if not Width:
            self.AddRuntimeMessage(Warning, "Input parameter 'Width' failed to collect data")
        if not Height:
            self.AddRuntimeMessage(Warning, "Input parameter 'Height' failed to collect data")

        # reformat unset parameters for consistency
        if not ZVector:
            ZVector = [None]
        if not Category:
            Category = [None]

        Beam = []
        Blank = []
        scene = Scene()

        if Centerline and Height and Width:
            # check list lengths for consistency
            N = len(Centerline)
            if len(ZVector) not in (0, 1, N):
                self.AddRuntimeMessage(
                    Error, " In 'ZVector' I need either none, one or the same number of inputs as the Crv parameter."
                )
            if len(Width) not in (1, N):
                self.AddRuntimeMessage(
                    Error, " In 'W' I need either one or the same number of inputs as the Crv parameter."
                )
            if len(Height) not in (1, N):
                self.AddRuntimeMessage(
                    Error, " In 'H' I need either one or the same number of inputs as the Crv parameter."
                )
            if len(Category) not in (0, 1, N):
                self.AddRuntimeMessage(
                    Error, " In 'Category' I need either none, one or the same number of inputs as the Crv parameter."
                )

            # duplicate data if None or single value
            if len(ZVector) != N:
                ZVector = [ZVector[0] for _ in range(N)]
            if len(Width) != N:
                Width = [Width[0] for _ in range(N)]
            if len(Height) != N:
                Height = [Height[0] for _ in range(N)]
            if len(Category) != N:
                Category = [Category[0] for _ in range(N)]

            for guid, z, w, h, c in zip(Centerline, ZVector, Width, Height, Category):
                curve = curve_to_compas(ActiveDoc.Objects.FindId(guid))
                line = Line(curve.start, curve.end)
                z = vector_to_compas(z) if z else None
                beam = CTBeam.from_centerline(centerline=line, width=w, height=h, z_vector=z)
                beam.attributes["rhino_guid"] = str(guid)
                beam.attributes["category"] = c

                if updateRefObj:
                    update_rhobj_attributes_name(guid, "width", str(w))
                    update_rhobj_attributes_name(guid, "height", str(h))
                    update_rhobj_attributes_name(guid, "zvector", str(list(beam.frame.zaxis)))
                    update_rhobj_attributes_name(guid, "category", c)

                Beam.append(beam)
                scene.add(beam.blank)

        Blank = scene.draw()

        return Beam, Blank
# ---------- end beam ----------
beam_2 = CTBeam(Centerline=geo_3, ZVector=Point(0, 0, 1), Width=0.2, Height=0.2, Category="top")  # -> Beam, Blank; inputs Centerline: list of Guid, ZVector: list of Vector3d, Width: list, Height: list, Category: list, updateRefObj: Boolean; same code as beam
beam_3 = CTBeam(Centerline=geo_2, ZVector=Point(0, 1, 0), Width=0.1, Height=0.1, Category="end")  # -> Beam, Blank; inputs Centerline: list of Guid, ZVector: list of Vector3d, Width: list, Height: list, Category: list, updateRefObj: Boolean; same code as beam
beam_4 = CTBeam(Centerline=geo_5, ZVector=Point(0, 1, 0), Width=0.1, Height=0.1, Category="end")  # -> Beam, Blank; inputs Centerline: list of Guid, ZVector: list of Vector3d, Width: list, Height: list, Category: list, updateRefObj: Boolean; same code as beam
id = Guid([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])
crv = Curve([<curve referenced from the Rhino model> x5])

# ----
# COMPAS Logo
crv_2 = Curve([<curve referenced from the Rhino model> x6])
beam_5 = CTBeam(Centerline=crv_2, Width=0.15, Height=0.1)  # -> Beam, Blank; inputs Centerline: list, ZVector: list of Vector3d, Width: list, Height: list, Category: list, updateRefObj: Boolean
#   port Centerline: Referenced curve or line, Guid of curve or line in the active Rhino document.
#   port ZVector: Vector defining the orientation of the cross-section (corresponds to the height dimension). If None, a default will be taken.
#   port Width: Width of the cross-section (usually the smaller dimension).
#   port Height: Height of the cross-section (usually the larger dimension).
#   port Category: Category of a beam.
#   port updateRefObj: (optional) If True, the attributes in the referenced object will be updated/overwritten with the new values given here.
#   port Beam: Beam object(s).
#   port Blank: Shape of the beam's blank.
# ---------- beam_5: Python ----------
"""Creates a Beam from a LineCurve."""

from ghpythonlib.componentbase import executingcomponent as component
from Grasshopper.Kernel.GH_RuntimeMessageLevel import Error
from Grasshopper.Kernel.GH_RuntimeMessageLevel import Warning
from Rhino.RhinoDoc import ActiveDoc
import rhinoscriptsyntax as rs

from compas.scene import Scene
from compas_rhino.conversions import line_to_compas
from compas_rhino.conversions import vector_to_compas

from compas_timber.ghpython.rhino_object_name_attributes import update_rhobj_attributes_name
from compas_timber.parts import Beam as CTBeam


class Beam_fromCurve(component):
    def RunScript(self, Centerline, ZVector, Width, Height, Category, updateRefObj):
        # minimum inputs required
        if not Centerline:
            self.AddRuntimeMessage(Warning, "Input parameter 'Centerline' failed to collect data")
        if not Width:
            self.AddRuntimeMessage(Warning, "Input parameter 'Width' failed to collect data")
        if not Height:
            self.AddRuntimeMessage(Warning, "Input parameter 'Height' failed to collect data")

        # reformat unset parameters for consistency
        if not ZVector:
            ZVector = [None]
        if not Category:
            Category = [None]

        Beam = []
        Blank = []
        scene = Scene()

        if Centerline and Height and Width:
            # check list lengths for consistency
            N = len(Centerline)
            if len(ZVector) not in (0, 1, N):
                self.AddRuntimeMessage(
                    Error, " In 'ZVector' I need either none, one or the same number of inputs as the Crv parameter."
                )
            if len(Width) not in (1, N):
                self.AddRuntimeMessage(
                    Error, " In 'W' I need either one or the same number of inputs as the Crv parameter."
                )
            if len(Height) not in (1, N):
                self.AddRuntimeMessage(
                    Error, " In 'H' I need either one or the same number of inputs as the Crv parameter."
                )
            if len(Category) not in (0, 1, N):
                self.AddRuntimeMessage(
                    Error, " In 'Category' I need either none, one or the same number of inputs as the Crv parameter."
                )

            # duplicate data if None or single value
            if len(ZVector) != N:
                ZVector = [ZVector[0] for _ in range(N)]
            if len(Width) != N:
                Width = [Width[0] for _ in range(N)]
            if len(Height) != N:
                Height = [Height[0] for _ in range(N)]
            if len(Category) != N:
                Category = [Category[0] for _ in range(N)]

            for line, z, w, h, c in zip(Centerline, ZVector, Width, Height, Category):
                guid, geometry = self._get_guid_and_geometry(line)
                rhino_line = rs.coerceline(geometry)
                line = line_to_compas(rhino_line)

                z = vector_to_compas(z) if z else None
                beam = CTBeam.from_centerline(centerline=line, width=w, height=h, z_vector=z)
                beam.attributes["rhino_guid"] = str(guid) if guid else None
                beam.attributes["category"] = c
                print(guid)
                if updateRefObj and guid:
                    update_rhobj_attributes_name(guid, "width", str(w))
                    update_rhobj_attributes_name(guid, "height", str(h))
                    update_rhobj_attributes_name(guid, "zvector", str(list(beam.frame.zaxis)))
                    update_rhobj_attributes_name(guid, "category", c)

                Beam.append(beam)
                scene.add(beam.blank)

        Blank = scene.draw()

        return Beam, Blank

    def _get_guid_and_geometry(self, line):
        # internalized curves and GH geometry will not have persistent GUIDs, referenced Rhino objects will
        # type hint on the input has to be 'ghdoc' for this to work
        guid = None
        geometry = line
        rhino_obj = ActiveDoc.Objects.FindId(line)
        if rhino_obj:
            guid = line
            geometry = rhino_obj.Geometry
        return guid, geometry
# ---------- end beam_5 ----------
jointsbytopo = CTTopologicalJointRules()  # -> Rules
#   port L: Joint type to be applied to L topology. Default type is L-Miter. Input is a joint options component.
# ---------- jointsbytopo: Python ----------
from ghpythonlib.componentbase import executingcomponent as component
from Grasshopper.Kernel.GH_RuntimeMessageLevel import Warning

from compas_timber.connections import JointTopology
from compas_timber.ghpython import TopologyRule

from compas_timber.connections import LMiterJoint
from compas_timber.connections import TButtJoint
from compas_timber.connections import XHalfLapJoint


class TopologyJointRule(component):
    def RunScript(self, L, T, X):
        topoRules = []

        if L:
            if L.type.SUPPORTED_TOPOLOGY != JointTopology.TOPO_L:
                self.AddRuntimeMessage(Warning, "Joint type does not match topology. Joint may not be generated.")
            topoRules.append(TopologyRule(JointTopology.TOPO_L, L.type, **L.kwargs))
        else:
            topoRules.append(TopologyRule(JointTopology.TOPO_L, LMiterJoint))
        if T:
            if T.type.SUPPORTED_TOPOLOGY != JointTopology.TOPO_T:
                self.AddRuntimeMessage(Warning, "Joint type does not match topology. Joint may not be generated.")
            topoRules.append(TopologyRule(JointTopology.TOPO_T, T.type, **T.kwargs))
        else:
            topoRules.append(TopologyRule(JointTopology.TOPO_T, TButtJoint))
        if X:
            if X.type.SUPPORTED_TOPOLOGY != JointTopology.TOPO_X:
                self.AddRuntimeMessage(Warning, "Joint type does not match topology. Joint may not be generated.")
            topoRules.append(TopologyRule(JointTopology.TOPO_X, X.type, **X.kwargs))
#        else:
#            topoRules.append(TopologyRule(JointTopology.TOPO_X, XHalfLapJoint))

        return topoRules
# ---------- end jointsbytopo ----------
assembly = CTAssembly(Beams=beam_5.Beam, JointRules=flatten(jointsbytopo), CreateGeometry=Toggle(True))  # -> Assembly, Geometry, DebugInfo; inputs Beams: list, JointRules: list, Features: list, CreateGeometry: Boolean
#   port Beams: Collection of Beams
# ---------- assembly: Python ----------
from compas.scene import Scene
from ghpythonlib.componentbase import executingcomponent as component
from Grasshopper.Kernel.GH_RuntimeMessageLevel import Warning

from compas_timber.assembly import TimberAssembly
from compas_timber.consumers import BrepGeometryConsumer
from compas_timber.connections import ConnectionSolver
from compas_timber.connections import JointTopology
from compas_timber.connections import BeamJoinningError
from compas_timber.ghpython import JointDefinition
from compas_timber.ghpython import CategoryRule
from compas_timber.ghpython import TopologyRule
from compas_timber.ghpython import DirectRule
from compas_timber.ghpython import DebugInfomation


class Assembly(component):
    def __init__(self):
        # maintains relationship of old_beam.id => new_beam_obj for referencing
        # lets us modify copies of the beams while referencing them using their old identities.
        self._beam_map = {}

    def _get_copied_beams(self, old_beams):
        """For the given old_beams returns their respective copies."""
        new_beams = []
        for beam in old_beams:
            new_beams.append(self._beam_map[id(beam)])
        return new_beams

    def get_joints_from_rules(self, beams, rules, topologies):
        if not isinstance(rules, list):
            rules = [rules]
        rules = [r for r in rules if r is not None]

        joints = []
        # rules have to be resolved into joint definitions
        topo_rules = {}
        cat_rules = []
        direct_rules = []

        for r in rules:  # separate category and topo and direct joint rules
            if isinstance(r, TopologyRule):
                topo_rules[r.topology_type] = r
            elif isinstance(r, CategoryRule):
                cat_rules.append(r)
            if isinstance(r, DirectRule):
                direct_rules.append(r)

        for topo in topologies:
            beam_a = topo["beam_a"]
            beam_b = topo["beam_b"]
            detected_topo = topo["detected_topo"]
            pair = beam_a, beam_b
            pair_joined = False

            if detected_topo == JointTopology.TOPO_UNKNOWN:
                continue

            for rule in direct_rules:  # apply direct rules first
                if rule.comply(pair):
                    joints.append(JointDefinition(rule.joint_type, [beam_a, beam_b], **rule.kwargs))
                    pair_joined = True
                    break

            if not pair_joined:  # if no direct rule applies, apply category rules next
                for rule in cat_rules:
                    if not rule.comply(pair):
                        continue
                    if rule.joint_type.SUPPORTED_TOPOLOGY != detected_topo:
                        msg = "Conflict detected! Beams: {}, {} meet with topology: {} but rule assigns: {}"
                        self.AddRuntimeMessage(
                            Warning,
                            msg.format(
                                beam_a.key, beam_b.key, JointTopology.get_name(detected_topo), rule.joint_type.__name__
                            ),
                        )
                        continue
                    # sort by category to allow beam role by order (main beam first, cross beam second)
                    beam_a, beam_b = rule.reorder([beam_a, beam_b])
                    joints.append(JointDefinition(rule.joint_type, [beam_a, beam_b], **rule.kwargs))
                    break  # first matching rule

                else:  # no category rule applies, apply topology rules
                    if detected_topo not in topo_rules:
                        continue
                    else:
                        joints.append(
                            JointDefinition(
                                topo_rules[detected_topo].joint_type,
                                [beam_a, beam_b],
                                **topo_rules[detected_topo].kwargs
                            )
                        )
        return joints

    def RunScript(self, Beams, JointRules, Features, MaxDistance, CreateGeometry):
        if not Beams:
            self.AddRuntimeMessage(Warning, "Input parameter Beams failed to collect data")
        if not JointRules:
            self.AddRuntimeMessage(Warning, "Input parameter JointRules failed to collect data")
        if not (Beams):  # shows beams even if no joints are found
            return

        Assembly = TimberAssembly()
        debug_info = DebugInfomation()

        topologies = []
        solver = ConnectionSolver()
        found_pairs = solver.find_intersecting_pairs(Beams, rtree=True, max_distance=MaxDistance)
        for pair in found_pairs:
            beam_a, beam_b = pair
            detected_topo, beam_a, beam_b = solver.find_topology(beam_a, beam_b, max_distance=MaxDistance)
            if not detected_topo == JointTopology.TOPO_UNKNOWN:
                topologies.append({"detected_topo": detected_topo, "beam_a": beam_a, "beam_b": beam_b})
        Assembly.set_topologies(topologies)

        self._beam_map = {}
        beams = [b for b in Beams if b is not None]
        for beam in beams:
            c_beam = beam.copy()
            Assembly.add_beam(c_beam)
            self._beam_map[id(beam)] = c_beam
        beams = Assembly.beams

        joints = self.get_joints_from_rules(beams, JointRules, topologies)

        if joints:
            handled_beams = []
            joints = [j for j in joints if j is not None]
            # apply reversed. later joints in orginal list override ealier ones
            for joint in joints[::-1]:
                beams_to_pair = self._get_copied_beams(joint.beams)
                beam_pair_ids = set([id(beam) for beam in beams_to_pair])
                if beam_pair_ids in handled_beams:
                    continue
                try:
                    joint.joint_type.create(Assembly, *beams_to_pair, **joint.kwargs)
                except BeamJoinningError as bje:
                    debug_info.add_joint_error(bje)
                else:
                    handled_beams.append(beam_pair_ids)

        if Features:
            features = [f for f in Features if f is not None]
            for f_def in features:
                beams_to_modify = self._get_copied_beams(f_def.beams)
                for beam in beams_to_modify:
                    beam.add_features(f_def.feature)

        Geometry = None
        scene = Scene()
        if CreateGeometry:
            vis_consumer = BrepGeometryConsumer(Assembly)
            for result in vis_consumer.result:
                scene.add(result.geometry)
                if result.debug_info:
                    debug_info.add_feature_error(result.debug_info)
        else:
            for beam in Assembly.beams:
                scene.add(beam.blank)

        if debug_info.has_errors:
            self.AddRuntimeMessage(Warning, "Error found during joint creation. See DebugInfo output for details.")

        Geometry = scene.draw()
        return Assembly, Geometry, debug_info
# ---------- end assembly ----------
bakewithboxmap = CTBakeWithBoxMap(Assembly=assembly.Assembly, Bake=Button())  # inputs MapSize: list, Bake: Boolean
#   port Assembly: Assembly object (optional).
# ---------- bakewithboxmap: Python ----------
# flake8: noqa
import math
import random

from Rhino import Render
from Rhino.Geometry import Plane
from Rhino.Geometry import Interval
from Rhino.RhinoDoc import ActiveDoc
from Grasshopper.Kernel.GH_RuntimeMessageLevel import Warning
from Grasshopper.Kernel.GH_RuntimeMessageLevel import Error
from ghpythonlib.componentbase import executingcomponent as component
import rhinoscriptsyntax as rs

from compas_rhino.conversions import frame_to_rhino
from compas_timber.consumers import BrepGeometryConsumer


class BakeBoxMap(component):
    def RunScript(self, Assembly, MapSize, Bake):
        if MapSize and len(MapSize) != 3:
            self.AddRuntimeMessage(
                Error, "Input parameter MapSize requires exactly three float values (scale factors in x,y,z directions)"
            )
            return

        if MapSize:
            dimx, dimy, dimz = MapSize
        else:
            # for the pine 251 material bitmap, rotated
            dimx = 0.2
            dimy = 0.2
            dimz = 1.0

        if not Assembly:
            self.AddRuntimeMessage(Warning, "Input parameters Assembly failed to collect any Beam objects.")
            return

        if not Bake:
            return

        try:
            geometries = BrepGeometryConsumer(Assembly).result

            frames = [frame_to_rhino(b.frame) for b in Assembly.beams]
            breps = [g.geometry.native_brep for g in geometries]

            if frames and breps:
                rs.EnableRedraw(False)

                for brep, frame in zip(breps, frames):
                    guid = ActiveDoc.Objects.Add(brep)
                    boxmap = self.create_box_map(frame, dimx, dimy, dimz)
                    ActiveDoc.Objects.ModifyTextureMapping(guid, 1, boxmap)
        finally:
            rs.EnableRedraw(True)

    @staticmethod
    def create_box_map(pln, sx, sy, sz):
        """
        pln: frame of beam box, where x=main axis, y=width, z=height
        sx,sy,sz: box map size in x,y,z direction
        """

        v = pln.YAxis
        w = pln.ZAxis
        pt = pln.Origin

        # random deviation
        a = math.pi * 0.5
        randangle = (random.random() - 0.5) * a
        v.Rotate(randangle, pln.XAxis)

        b = math.pi * 0.01
        randangle = (random.random() - 0.5) * b
        w.Rotate(randangle, pln.XAxis)

        randpos = sx * random.random()
        pt += pln.XAxis * randpos

        # create box mapping
        mappingPln = Plane(pt, w, v)
        dx = Interval(-sx * 0.5, sx * 0.5)
        dy = Interval(-sy * 0.5, sy * 0.5)
        dz = Interval(-sz * 0.5, sz * 0.5)

        BoxMap = Render.TextureMapping.CreateBoxMapping(mappingPln, dx, dy, dz, False)

        return BoxMap
# ---------- end bakewithboxmap ----------

id_2 = Guid([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])
id_3 = Guid(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)
beam_6 = CTBeam(Centerline=geo, ZVector=Z, Width=number_slider, Height=number_slider)  # -> Beam, Blank; inputs Centerline: list of Guid, ZVector: list of Vector3d, Width: list, Height: list, Category: list, updateRefObj: Boolean; same code as beam
beam_7 = CTBeam(Centerline=crv, Width=0.1, Height=0.2)  # -> Beam, Blank; inputs Centerline: list, ZVector: list of Vector3d, Width: list, Height: list, Category: list, updateRefObj: Boolean
#   port Centerline: Referenced curve or line, Guid of curve or line in the active Rhino document.
#   port ZVector: Vector defining the orientation of the cross-section (corresponds to the height dimension). If None, a default will be taken.
#   port Width: Width of the cross-section (usually the smaller dimension).
#   port Height: Height of the cross-section (usually the larger dimension).
#   port Category: Category of a beam.
#   port updateRefObj: (optional) If True, the attributes in the referenced object will be updated/overwritten with the new values given here.
#   port Beam: Beam object(s).
#   port Blank: Shape of the beam's blank.
# ---------- beam_7: Python ----------
"""Creates a Beam from a LineCurve."""
from ghpythonlib.componentbase import executingcomponent as component
from Grasshopper.Kernel.GH_RuntimeMessageLevel import Error
from Grasshopper.Kernel.GH_RuntimeMessageLevel import Warning
from Rhino.RhinoDoc import ActiveDoc
import rhinoscriptsyntax as rs

from compas.scene import Scene
from compas_rhino.conversions import line_to_compas
from compas_rhino.conversions import vector_to_compas

from compas_timber.ghpython.rhino_object_name_attributes import update_rhobj_attributes_name
from compas_timber.parts import Beam as CTBeam


class Beam_fromCurve(component):
    def RunScript(self, Centerline, ZVector, Width, Height, Category, updateRefObj):
        # minimum inputs required
        if not Centerline:
            self.AddRuntimeMessage(Warning, "Input parameter 'Centerline' failed to collect data")
        if not Width:
            self.AddRuntimeMessage(Warning, "Input parameter 'Width' failed to collect data")
        if not Height:
            self.AddRuntimeMessage(Warning, "Input parameter 'Height' failed to collect data")

        # reformat unset parameters for consistency
        if not ZVector:
            ZVector = [None]
        if not Category:
            Category = [None]

        Beam = []
        Blank = []
        scene = Scene()

        if Centerline and Height and Width:
            # check list lengths for consistency
            N = len(Centerline)
            if len(ZVector) not in (0, 1, N):
                self.AddRuntimeMessage(
                    Error, " In 'ZVector' I need either none, one or the same number of inputs as the Crv parameter."
                )
            if len(Width) not in (1, N):
                self.AddRuntimeMessage(
                    Error, " In 'W' I need either one or the same number of inputs as the Crv parameter."
                )
            if len(Height) not in (1, N):
                self.AddRuntimeMessage(
                    Error, " In 'H' I need either one or the same number of inputs as the Crv parameter."
                )
            if len(Category) not in (0, 1, N):
                self.AddRuntimeMessage(
                    Error, " In 'Category' I need either none, one or the same number of inputs as the Crv parameter."
                )

            # duplicate data if None or single value
            if len(ZVector) != N:
                ZVector = [ZVector[0] for _ in range(N)]
            if len(Width) != N:
                Width = [Width[0] for _ in range(N)]
            if len(Height) != N:
                Height = [Height[0] for _ in range(N)]
            if len(Category) != N:
                Category = [Category[0] for _ in range(N)]

            for line, z, w, h, c in zip(Centerline, ZVector, Width, Height, Category):
                guid, geometry = self._get_guid_and_geometry(line)
                rhino_line = rs.coerceline(geometry)
                line = line_to_compas(rhino_line)

                z = vector_to_compas(z) if z else None
                beam = CTBeam.from_centerline(centerline=line, width=w, height=h, z_vector=z)
                beam.attributes["rhino_guid"] = str(guid) if guid else None
                beam.attributes["category"] = c
                print(guid)
                if updateRefObj and guid:
                    update_rhobj_attributes_name(guid, "width", str(w))
                    update_rhobj_attributes_name(guid, "height", str(h))
                    update_rhobj_attributes_name(guid, "zvector", str(list(beam.frame.zaxis)))
                    update_rhobj_attributes_name(guid, "category", c)

                Beam.append(beam)
                scene.add(beam.blank)

        Blank = scene.draw()

        return Beam, Blank

    def _get_guid_and_geometry(self, line):
        # internalized curves and GH geometry will not have persistent GUIDs, referenced Rhino objects will
        # type hint on the input has to be 'ghdoc' for this to work
        guid = None
        geometry = line
        rhino_obj = ActiveDoc.Objects.FindId(line)
        if rhino_obj:
            guid = line
            geometry = rhino_obj.Geometry
        return guid, geometry
# ---------- end beam_7 ----------
beam_8 = CTBeam(Centerline=id, Width=0.2, Height=0.2)  # -> Beam, Blank; inputs Centerline: list, ZVector: list of Vector3d, Width: list, Height: list, Category: list, updateRefObj: Boolean; same code as beam_5
findbeambyrhinoguid = CTFindBeamByRhinoGuid(Beams=beam_8.Beam, Guid=id_3)  # -> FoundBeam; inputs Beams: list, Guid: list of Guid
#   port Beams: A list of Beams.
# ---------- findbeambyrhinoguid: Python ----------
from ghpythonlib.componentbase import executingcomponent as component
from Grasshopper.Kernel.GH_RuntimeMessageLevel import Warning


class FindBeamByRhinoGuid(component):
    def RunScript(self, Beams, Guid):
        if not (Beams and Guid):
            return

        if not isinstance(Guid, list):
            Guid = [Guid]
        Guid = [str(g) for g in Guid]
        FoundBeam = []
        for beam in Beams:
            if beam.attributes.get("rhino_guid", None) in Guid:
                FoundBeam.append(beam)

        if not FoundBeam:
            self.AddRuntimeMessage(Warning, "No beams found!")

        return FoundBeam
# ---------- end findbeambyrhinoguid ----------
number_slider_2 = Slider(0.6, range=0..1)
brep = Brep(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)
pln = Plane(Plane(origin=(-0.1279446753, 5.458560019, 1.105418726), x=(-0.1429584658, -0.5973673261, -0.7891230289), y=(0.8350065262, -0.5008404042, 0.2278661686)))
l_butt = CTLButtOptions()  # -> L_Butt; inputs SmallBeamButts: Boolean
#   port Gap: Gap for tolerance.
# ---------- l_butt: Python ----------
from ghpythonlib.componentbase import executingcomponent as component


from compas_timber.connections import LButtJoint
from compas_timber.ghpython import JointOptions


class LButtJointOptions(component):
    def RunScript(self, gap, small_beam_butts):
        args = {}
        if gap:
            args["gap"] = gap
        if small_beam_butts:
            args["small_beam_butts"] = small_beam_butts
        options = JointOptions(LButtJoint, **args)

        return options
# ---------- end l_butt ----------
id_4 = Guid([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])
relay = Relay([beam_2.Beam, beam.Beam, beam_3.Beam, beam_4.Beam])
brep_subtraction_feature = CTBrepSubtractionFeature(Beam=findbeambyrhinoguid, Geometry=brep)  # -> Feature; inputs Beam: list, Geometry: Brep
#   port Beam: Beam(s) to subtract Geometry from.
# ---------- brep_subtraction_feature: Python ----------
from compas.geometry import Brep
from ghpythonlib.componentbase import executingcomponent as component
from Grasshopper.Kernel.GH_RuntimeMessageLevel import Warning

from compas_timber.ghpython import FeatureDefinition
from compas_timber.parts import BrepSubtraction


class BrepSubtractionFeature(component):
    def RunScript(self, beam, geometry):
        if not beam:
            self.AddRuntimeMessage(Warning, "Input parameter Beams failed to collect data")
        if not geometry:
            self.AddRuntimeMessage(Warning, "Input parameter Geometry failed to collect data")
        if not (beam and geometry):
            return

        if not isinstance(beam, list):
            beam = [beam]

        feature = BrepSubtraction(Brep.from_native(geometry))
        return FeatureDefinition(feature, beam)
# ---------- end brep_subtraction_feature ----------
trim_feature = CTTrimFeature(Beam=beam_8.Beam, Plane=pln)  # -> Feature; inputs Beam: list, Plane: Plane
#   port Beam: Beam(s) to trim.
# ---------- trim_feature: Python ----------
from compas_rhino.conversions import plane_to_compas_frame
from ghpythonlib.componentbase import executingcomponent as component
from Grasshopper.Kernel.GH_RuntimeMessageLevel import Warning

from compas_timber.ghpython import FeatureDefinition
from compas_timber.parts import CutFeature


class TrimmingFeature(component):
    def RunScript(self, beam, plane):
        if not beam:
            self.AddRuntimeMessage(Warning, "Input parameter Beam failed to collect data")
        if not plane:
            self.AddRuntimeMessage(Warning, "Input parameter Plane failed to collect data")
        if not (beam and plane):
            return

        if not isinstance(beam, list):
            beam = [beam]

        feature = CutFeature(plane_to_compas_frame(plane))
        return FeatureDefinition(feature, beam)
# ---------- end trim_feature ----------
jointsbytopo_2 = CTTopologicalJointRules()  # -> Rules
#   port L: Joint type to be applied to L topology. Default type is L-Miter. Input is a joint options component.
# ---------- jointsbytopo_2: Python ----------
from ghpythonlib.componentbase import executingcomponent as component
from Grasshopper.Kernel.GH_RuntimeMessageLevel import Warning

from compas_timber.connections import JointTopology
from compas_timber.ghpython import TopologyRule

from compas_timber.connections import LMiterJoint
from compas_timber.connections import TButtJoint
from compas_timber.connections import XHalfLapJoint


class TopologyJointRule(component):
    def RunScript(self, L, T, X):
        topoRules = []

        if L:
            if L.type.SUPPORTED_TOPOLOGY != JointTopology.TOPO_L:
                self.AddRuntimeMessage(Warning, "Joint type does not match topology. Joint may not be generated.")
            topoRules.append(TopologyRule(JointTopology.TOPO_L, L.type, **L.kwargs))
        else:
            topoRules.append(TopologyRule(JointTopology.TOPO_L, LMiterJoint))
        if T:
            if T.type.SUPPORTED_TOPOLOGY != JointTopology.TOPO_T:
                self.AddRuntimeMessage(Warning, "Joint type does not match topology. Joint may not be generated.")
            topoRules.append(TopologyRule(JointTopology.TOPO_T, T.type, **T.kwargs))
        else:
            topoRules.append(TopologyRule(JointTopology.TOPO_T, TButtJoint))
        if X:
            if X.type.SUPPORTED_TOPOLOGY != JointTopology.TOPO_X:
                self.AddRuntimeMessage(Warning, "Joint type does not match topology. Joint may not be generated.")
            topoRules.append(TopologyRule(JointTopology.TOPO_X, X.type, **X.kwargs))
        else:
            topoRules.append(TopologyRule(JointTopology.TOPO_X, XHalfLapJoint))

        return topoRules
# ---------- end jointsbytopo_2 ----------
t_half_lap = CTTHalfLapJointOptions()  # -> T_Half_Lap; inputs FlipLapSide: Boolean
#   port FlipLapSide: flip the side of the lap joint
# ---------- t_half_lap: Python ----------
from ghpythonlib.componentbase import executingcomponent as component

from compas_timber.connections import THalfLapJoint
from compas_timber.ghpython import JointOptions


class MyComponent(component):
    def RunScript(self, flip_lap_side, cut_plane_bias):
        args = {}
        if flip_lap_side:
            args["flip_lap_side"] = flip_lap_side
        if cut_plane_bias:
            args["cut_plane_bias"] = cut_plane_bias
        options = JointOptions(THalfLapJoint, **args)

        return options
# ---------- end t_half_lap ----------
l_half_lap = CTLHalfLapJointOptions()  # -> L_Half_Lap; inputs FlipLapSide: Boolean
#   port FlipLapSide: flip the side of the lap joint
# ---------- l_half_lap: Python ----------
from ghpythonlib.componentbase import executingcomponent as component


from compas_timber.connections import LHalfLapJoint
from compas_timber.ghpython import JointOptions


class MyComponent(component):
    def RunScript(self, flip_lap_side, cut_plane_bias):
        args = {}
        if flip_lap_side:
            args["flip_lap_side"] = flip_lap_side
        if cut_plane_bias:
            args["cut_plane_bias"] = cut_plane_bias

        options = JointOptions(LHalfLapJoint, **args)

        return options
# ---------- end l_half_lap ----------
jointsbytopo_3 = CTTopologicalJointRules(L=l_butt)  # -> Rules; same code as jointsbytopo_2
assembly_2 = CTAssembly(
    Beams=beam_8.Beam,
    JointRules=flatten(jointsbytopo_2),
    Features=[trim_feature, brep_subtraction_feature],
    CreateGeometry=Toggle(True))  # -> Assembly, Geometry, DebugInfo; inputs Beams: list, JointRules: list, Features: list, CreateGeometry: Boolean; same code as assembly
l_butt_2 = CTLButtOptions()  # -> L_Butt; inputs SmallBeamButts: Boolean; same code as l_butt

# ----
# Joint Application By Category
toggle = BooleanToggle(True)
jointsbycategory = CT_CategoryJointsRules(JointOptions=l_butt_2, CatA="top", CatB="end")  # -> Rule
#   port JointOptions: Joint Options component.
# ---------- jointsbycategory: Python ----------
from ghpythonlib.componentbase import executingcomponent as component

from compas_timber.connections import LButtJoint
from compas_timber.connections import LMiterJoint
from compas_timber.connections import TButtJoint
from compas_timber.connections import XHalfLapJoint
from compas_timber.connections import FrenchRidgeLapJoint
from compas_timber.ghpython import CategoryRule


class CategoryJointRule(component):

    def RunScript(self, JointOptions, CatA, CatB):
        if JointOptions and CatA and CatB:
            return CategoryRule(JointOptions.type, CatA, CatB, **JointOptions.kwargs)
# ---------- end jointsbycategory ----------

assembly_3 = CTAssembly(
    Beams=beam_7.Beam,
    JointRules=flatten(jointsbytopo_3),
    MaxDistance=Slider(0.2, range=0.01..0.5),
    CreateGeometry=Toggle(True))  # -> Assembly, Geometry, DebugInfo; inputs Beams: list, JointRules: list, Features: list, CreateGeometry: Boolean; same code as assembly
# Direct Joint Application
l_miter = CTLMiterJointOptions()  # -> L_Miter
#   port Cutoff: For very acute angles, limit the extension of the tip/beak of the joint.
# ---------- l_miter: Python ----------
from ghpythonlib.componentbase import executingcomponent as component


from compas_timber.connections import LMiterJoint
from compas_timber.ghpython import JointOptions


class LMiterJointOptions(component):
    def RunScript(self, Cutoff):
        args = {}
        if Cutoff:
            args["cutoff"] = Cutoff
        options = JointOptions(LMiterJoint, **args)

        return options
# ---------- end l_miter ----------
jointsbytopo_4 = CTTopologicalJointRules(L=l_half_lap, T=t_half_lap)  # -> Rules; same code as jointsbytopo_2
series = Series(Start=0, Step=Slider(5, range=0..10), Count=Slider(5, range=0..10))
assembly_4 = CTAssembly(Beams=beam_6.Beam, JointRules=flatten(jointsbytopo_4), CreateGeometry=Toggle(True))  # -> Assembly, Geometry, DebugInfo; inputs Beams: list, JointRules: list, Features: list, CreateGeometry: Boolean
#   port Beams: Collection of Beams
# ---------- assembly_4: Python ----------
from compas.scene import Scene
from ghpythonlib.componentbase import executingcomponent as component
from Grasshopper.Kernel.GH_RuntimeMessageLevel import Warning

from compas_timber.assembly import TimberAssembly
from compas_timber.consumers import BrepGeometryConsumer
from compas_timber.connections import ConnectionSolver
from compas_timber.connections import JointTopology
from compas_timber.connections import BeamJoinningError
from compas_timber.ghpython import JointDefinition
from compas_timber.ghpython import CategoryRule
from compas_timber.ghpython import TopologyRule
from compas_timber.ghpython import DirectRule
from compas_timber.ghpython import DebugInfomation


class Assembly(component):
    def __init__(self):
        # maintains relationship of old_beam.id => new_beam_obj for referencing
        # lets us modify copies of the beams while referencing them using their old identities.
        self._beam_map = {}

    def _get_copied_beams(self, old_beams):
        """For the given old_beams returns their respective copies."""
        new_beams = []
        for beam in old_beams:
            new_beams.append(self._beam_map[id(beam)])
        return new_beams

    def get_joints_from_rules(self, beams, rules, topologies):
        if not isinstance(rules, list):
            rules = [rules]
        rules = [r for r in rules if r is not None]

        joints = []
        # rules have to be resolved into joint definitions
        topo_rules = {}
        cat_rules = []
        direct_rules = []

        for r in rules:  # separate category and topo and direct joint rules
            if isinstance(r, TopologyRule):
                topo_rules[r.topology_type] = r
            elif isinstance(r, CategoryRule):
                cat_rules.append(r)
            if isinstance(r, DirectRule):
                direct_rules.append(r)

        for topo in topologies:
            beam_a = topo["beam_a"]
            beam_b = topo["beam_b"]
            detected_topo = topo["detected_topo"]
            pair = beam_a, beam_b
            pair_joined = False

            if detected_topo == JointTopology.TOPO_UNKNOWN:
                continue

            for rule in direct_rules:  # apply direct rules first
                if rule.comply(pair):
                    joints.append(JointDefinition(rule.joint_type, [beam_a, beam_b], **rule.kwargs))
                    pair_joined = True
                    break

            if not pair_joined:  # if no direct rule applies, apply category rules next
                for rule in cat_rules:
                    if not rule.comply(pair):
                        continue
                    if rule.joint_type.SUPPORTED_TOPOLOGY != detected_topo:
                        msg = "Conflict detected! Beams: {}, {} meet with topology: {} but rule assigns: {}"
                        self.AddRuntimeMessage(
                            Warning,
                            msg.format(
                                beam_a.key, beam_b.key, JointTopology.get_name(detected_topo), rule.joint_type.__name__
                            ),
                        )
                        continue
                    # sort by category to allow beam role by order (main beam first, cross beam second)
                    beam_a, beam_b = rule.reorder([beam_a, beam_b])
                    joints.append(JointDefinition(rule.joint_type, [beam_a, beam_b], **rule.kwargs))
                    break  # first matching rule

                else:  # no category rule applies, apply topology rules
                    if detected_topo not in topo_rules:
                        continue
                    else:
                        joints.append(
                            JointDefinition(
                                topo_rules[detected_topo].joint_type,
                                [beam_a, beam_b],
                                **topo_rules[detected_topo].kwargs
                            )
                        )
        return joints

    def RunScript(self, Beams, JointRules, Features, MaxDistance, CreateGeometry):
        if not Beams:
            self.AddRuntimeMessage(Warning, "Input parameter Beams failed to collect data")
        if not JointRules:
            self.AddRuntimeMessage(Warning, "Input parameter JointRules failed to collect data")
        if not (Beams):  # shows beams even if no joints are found
            return

        Assembly = TimberAssembly()
        debug_info = DebugInfomation()

        topologies = []
        solver = ConnectionSolver()
        found_pairs = solver.find_intersecting_pairs(Beams, rtree=True, max_distance=MaxDistance)
        for pair in found_pairs:
            beam_a, beam_b = pair
            detected_topo, beam_a, beam_b = solver.find_topology(beam_a, beam_b, max_distance=MaxDistance)
            if not detected_topo == JointTopology.TOPO_UNKNOWN:
                topologies.append({"detected_topo": detected_topo, "beam_a": beam_a, "beam_b": beam_b})
        Assembly.set_topologies(topologies)

        self._beam_map = {}
        beams = [b for b in Beams if b is not None]
        for beam in beams:
            c_beam = beam.copy()
            Assembly.add_beam(c_beam)
            self._beam_map[id(beam)] = c_beam
        beams = Assembly.beams

        joints = self.get_joints_from_rules(beams, JointRules, topologies)

        if joints:
            handled_beams = []
            joints = [j for j in joints if j is not None]
            # apply reversed. later joints in orginal list override ealier ones
            for joint in joints[::-1]:
                beams_to_pair = self._get_copied_beams(joint.beams)
                beam_pair_ids = set([id(beam) for beam in beams_to_pair])
                if beam_pair_ids in handled_beams:
                    continue
                try:
                    joint.joint_type.create(Assembly, *beams_to_pair, **joint.kwargs)
                except BeamJoinningError as bje:
                    debug_info.add_joint_error(bje)
                else:
                    handled_beams.append(beam_pair_ids)

        if Features:
            features = [f for f in Features if f is not None]
            for f_def in features:
                beams_to_modify = self._get_copied_beams(f_def.beams)
                for beam in beams_to_modify:
                    beam.add_features(f_def.feature)

        Geometry = None
        scene = Scene()
        if CreateGeometry:
            vis_consumer = BrepGeometryConsumer(Assembly)
            for result in vis_consumer.result:
                scene.add(result.geometry)
                if result.debug_info:
                    debug_info.add_feature_error(result.debug_info)

        if debug_info.has_errors:
            self.AddRuntimeMessage(Warning, "Error found during joint creation. See DebugInfo output for details.")

        Geometry = scene.draw()
        return Assembly, Geometry, debug_info
# ---------- end assembly_4 ----------
bakewithboxmap_2 = CTBakeWithBoxMap(Assembly=assembly_2.Assembly, Bake=Button())  # inputs MapSize: list, Bake: Boolean; same code as bakewithboxmap
directjoints = CTDirectJointRules(JointOptions=l_miter, MainBeam=beam_2.Beam, SecondaryBeam=beam_4.Beam)  # -> Rule; inputs MainBeam: list, SecondaryBeam: list
#   port JointOptions: Joint Options Component
# ---------- directjoints: Python ----------
from ghpythonlib.componentbase import executingcomponent as component
from Grasshopper.Kernel.GH_RuntimeMessageLevel import Error
from Grasshopper.Kernel.GH_RuntimeMessageLevel import Warning

from compas_timber.connections import ConnectionSolver
from compas_timber.connections import JointTopology
from compas_timber.ghpython import DirectRule


class DirectJointRule(component):
    def RunScript(self, JointOptions, MainBeam, SecondaryBeam):
        if not MainBeam:
            self.AddRuntimeMessage(Warning, "Input parameter MainBeams failed to collect data.")
        if not SecondaryBeam:
            self.AddRuntimeMessage(Warning, "Input parameter CrossBeams failed to collect data.")
        if not (MainBeam and SecondaryBeam):
            return
        if not isinstance(MainBeam, list):
            MainBeam = [MainBeam]
        if not isinstance(SecondaryBeam, list):
            SecondaryBeam = [SecondaryBeam]
        if len(MainBeam) != len(SecondaryBeam):
            self.AddRuntimeMessage(Error, "Number of items in MainBeams and CrossBeams must match!")
            return
        Rules = []
        for main, secondary in zip(MainBeam, SecondaryBeam):
            topology, _, _ = ConnectionSolver().find_topology(main, secondary)
            if topology != JointOptions.type.SUPPORTED_TOPOLOGY:
                self.AddRuntimeMessage(
                    Warning,
                    "Beams meet with topology: {} which does not agree with joint of type: {}".format(
                        JointTopology.get_name(topology), JointOptions.type.__name__
                    ),
                )
                continue
            Rules.append(DirectRule(JointOptions.type, [secondary, main], **JointOptions.kwargs))
        return Rules
# ---------- end directjoints ----------
showjointtypes = CTShowJointTypes(Assembly=assembly_3.Assembly)
#   port Assembly: Assembly object.
# ---------- showjointtypes: Python ----------
# flake8: noqa
import System
from compas_rhino.conversions import point_to_rhino
from ghpythonlib.componentbase import executingcomponent as component

from compas_timber.utils.compas_extra import intersection_line_line_3D


class ShowJointTypes(component):
    def RunScript(self, Assembly):
        self.pt = []
        self.txt = []

        if not Assembly:
            return

        for joint in Assembly.joints:
            line_a, line_b = joint.beams[0].centerline, joint.beams[1].centerline
            [p1, t1], [p2, t2] = intersection_line_line_3D(line_a, line_b, float("inf"), False, 1e-3)
            p1 = point_to_rhino(p1)
            p2 = point_to_rhino(p2)

            self.pt.append((p2 + p1) / 2)
            self.txt.append(joint.joint_type)

    def DrawViewportWires(self, arg):
        if self.Locked:
            return
        col = System.Drawing.Color.FromArgb(255, 0, 0, 0)
        # https://developer.rhino3d.com/api/RhinoCommon/html/M_Rhino_Display_DisplayPipeline_Draw2dText_5.htm
        for p, t in zip(self.pt, self.txt):
            arg.Display.Draw2dText(t, col, p, True, 12, "Verdana")
# ---------- end showjointtypes ----------
geo_6 = Geometry([<brep referenced from the Rhino model> x8])
Z_2 = UnitZ(Factor=series)
bakewithboxmap_3 = CTBakeWithBoxMap(Assembly=assembly_4.Assembly, Bake=Button())  # inputs MapSize: list, Bake: Boolean; same code as bakewithboxmap
showjointtypes_2 = CTShowJointTypes(Assembly=assembly_4.Assembly)  # same code as showjointtypes
showtopo = CTShowTopologyTypes(Assembly=assembly_4.Assembly)
#   port Assembly: Assembly object.
# ---------- showtopo: Python ----------
# flake8: noqa
import System
from compas_rhino.conversions import point_to_rhino
from ghpythonlib.componentbase import executingcomponent as component
from compas_timber.connections import JointTopology
from compas_timber.utils.compas_extra import intersection_line_line_3D


class ShowTopologyTypes(component):
    def RunScript(self, Assembly):
        self.pt = []
        self.txt = []

        if not Assembly:
            return
        for topo in Assembly.topologies:
            beam_a = topo["beam_a"]
            beam_b = topo["beam_b"]
            topology = topo.get("detected_topo")

            [p1, _], [p2, _] = intersection_line_line_3D(
                beam_a.centerline, beam_b.centerline, float("inf"), False, 1e-3
            )
            p1 = point_to_rhino(p1)
            p2 = point_to_rhino(p2)
            self.pt.append((p2 + p1) / 2)
            self.txt.append(JointTopology.get_name(topology))

    def DrawViewportWires(self, arg):
        if self.Locked:
            return
        col = System.Drawing.Color.FromArgb(0, 0, 255, 0)
        # https://developer.rhino3d.com/api/RhinoCommon/html/M_Rhino_Display_DisplayPipeline_Draw2dText_5.htm
        for p, t in zip(self.pt, self.txt):
            arg.Display.Draw2dText(t, col, p, True, 12, "Verdana")
# ---------- end showtopo ----------
move = Move(Geometry=graft(geo_6), Motion=Z_2)  # -> Geometry, Transform

# ----
# referenced curves
# referenced curve objects
panel = Panel("top/bottom")
crv_3 = Curve([<curve referenced from the Rhino model> x4])
# internalized curves
crv_4 = Curve([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])
id_5 = Guid([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])
crv_5 = Curve([<curve referenced from the Rhino model> x4])
jointsbytopo_5 = CTTopologicalJointRules()  # -> Rules; same code as jointsbytopo_2

beam_9 = CTBeam(Centerline=crv_4, Width=0.1, Height=0.1, Category=panel)  # -> Beam, Blank; inputs Centerline: list, ZVector: list of Vector3d, Width: list, Height: list, Category: list, updateRefObj: Boolean; same code as beam_7
beam_10 = CTBeam(Centerline=id_2, Width=0.1, Height=0.1, Category="middle")  # -> Beam, Blank; inputs Centerline: list, ZVector: list of Vector3d, Width: list, Height: list, Category: list, updateRefObj: Boolean; same code as beam_7
beam_11 = CTBeam(Centerline=crv_3, Width=0.1, Height=0.1, Category=panel)  # -> Beam, Blank; inputs Centerline: list, ZVector: list of Vector3d, Width: list, Height: list, Category: list, updateRefObj: Boolean; same code as beam_7

relay_2 = Relay([beam_11.Beam, beam_10.Beam, beam_9.Beam])
findbeambyrhinoguid_2 = CTFindBeamByRhinoGuid(Beams=relay_2, Guid=id_5)  # -> FoundBeam; inputs Beams: list, Guid: list of Guid; same code as findbeambyrhinoguid
# Drill holes
drill_hole = CTDrillHoleFeature(Beam=findbeambyrhinoguid_2, Line=crv_5, Diameter="0.01", Length="1")  # -> Feature; inputs Beam: list, Line: Line
#   port Beam: Beam(s) to subtract Geometry from.
# ---------- drill_hole: Python ----------
from ghpythonlib.componentbase import executingcomponent as component
from Grasshopper.Kernel.GH_RuntimeMessageLevel import Warning

from compas_rhino.conversions import line_to_compas

from compas_timber.ghpython import FeatureDefinition
from compas_timber.parts import DrillFeature


class DrillHoleFeature(component):
    def RunScript(self, beam, line, diameter, length):
        if not beam:
            self.AddRuntimeMessage(Warning, "Input parameter Beams failed to collect data")
        if not line:
            self.AddRuntimeMessage(Warning, "Input parameter Line failed to collect data")
        if not diameter:
            self.AddRuntimeMessage(Warning, "Input parameter Diameter failed to collect data")
        if not length:
            self.AddRuntimeMessage(Warning, "Input parameter Length failed to collect data")

        if not (beam and line and diameter and length):
            return

        if not isinstance(beam, list):
            beam = [beam]

        f = DrillFeature(line_to_compas(line), diameter, length)
        return FeatureDefinition(f, beam)
# ---------- end drill_hole ----------
assembly_5 = CTAssembly(Beams=relay_2, JointRules=flatten(jointsbytopo_5), Features=drill_hole, MaxDistance="0.15", CreateGeometry=Toggle(True))  # -> Assembly, Geometry, DebugInfo; inputs Beams: list, JointRules: list, Features: list, CreateGeometry: Boolean; same code as assembly
showjointtypes_3 = CTShowJointTypes(Assembly=assembly_5.Assembly)  # same code as showjointtypes
featureerrors = CTShowFeatureErrors(DebugInfo=assembly_5.DebugInfo, i=Slider(3, range=0..10))  # -> Info, Geometry
#   port DebugInfo: DebugInformation object containing feature errors.
# ---------- featureerrors: Python ----------
# flake8: noqa
from compas.scene import SceneObject

from Grasshopper.Kernel.GH_RuntimeMessageLevel import Warning
from ghpythonlib.componentbase import executingcomponent as component


class ShowFeatureErrors(component):
    def RunScript(self, debug_info, index):
        if index is None:
            self.AddRuntimeMessage(Warning, "Input parameter 'i' failed to collect data")
            return
        if not debug_info:
            self.AddRuntimeMessage(Warning, "Input parameter 'DebugInfo' failed to collect data")
            return
        if not debug_info.feature_errors:
            self.AddRuntimeMessage(Warning, "No feature errors found in input parameter 'DebugInfo'")
            return
        feature_errors = debug_info.feature_errors
        index = int(index) % len(feature_errors)
        error = feature_errors[index]

        geometries = [error.feature_geometry, error.beam_geometry]
        geo_objs = [SceneObject(geo) for geo in geometries]
        output = []
        for obj in geo_objs:
            output.extend(obj.draw())

        return error.message, output
# ---------- end featureerrors ----------

findbeambyrhinoguid_3 = CTFindBeamByRhinoGuid(Beams=relay_2, Guid=id_4)  # -> FoundBeam; inputs Beams: list, Guid: list of Guid; same code as findbeambyrhinoguid
trim_feature_2 = CTTrimFeature(Beam=findbeambyrhinoguid_3)  # -> Feature; inputs Beam: list, Plane: Plane; same code as trim_feature

# ----
# Joint Application By Topology
number_slider_3 = Slider(0.5, range=0..1)

l_half_lap_2 = CTLHalfLapJointOptions(FlipLapSide=Toggle(True))  # -> L_Half_Lap; inputs FlipLapSide: Boolean; same code as l_half_lap

jointsbytopo_6 = CTTopologicalJointRules(L=l_half_lap_2)  # -> Joints
#   port L: Joint type to be applied to L topology. Default type is L-Miter. If L-Butt, the beam with a larger cross section area will be used as crossing beam.
# ---------- jointsbytopo_6: Python ----------
from ghpythonlib.componentbase import executingcomponent as component
from Grasshopper.Kernel.GH_RuntimeMessageLevel import Warning

from compas_timber.connections import JointTopology
from compas_timber.ghpython import TopologyRule

from compas_timber.connections import LMiterJoint
from compas_timber.connections import TButtJoint
from compas_timber.connections import XHalfLapJoint


class MyComponent(component):
    def RunScript(self, L, T, X):
        topoRules = []




        if L:
            if not L.type.SUPPORTED_TOPOLOGY == JointTopology.TOPO_L:
                self.AddRuntimeMessage(Warning, "Joint type does not match topology. Joint may not be generated.")
            topoRules.append(TopologyRule(JointTopology.TOPO_L, L.type, **L.kwargs))
        else:
            topoRules.append(TopologyRule(JointTopology.TOPO_L, LMiterJoint))
        if T:
            if not T.type.SUPPORTED_TOPOLOGY == JointTopology.TOPO_T:
                self.AddRuntimeMessage(Warning, "Joint type does not match topology. Joint may not be generated.")
            topoRules.append(TopologyRule(JointTopology.TOPO_T, T.type, **T.kwargs))
        else:
            topoRules.append(TopologyRule(JointTopology.TOPO_T, TButtJoint))
        if X:
            if not X.type.SUPPORTED_TOPOLOGY == JointTopology.TOPO_X:
                self.AddRuntimeMessage(Warning, "Joint type does not match topology. Joint may not be generated.")
            topoRules.append(TopologyRule(JointTopology.TOPO_X, X.type, **X.kwargs))
        else:
            topoRules.append(TopologyRule(JointTopology.TOPO_X, XHalfLapJoint))

        return topoRules
# ---------- end jointsbytopo_6 ----------

relay_3 = Relay([jointsbytopo_6, jointsbycategory, directjoints])
assembly_6 = CTAssembly(Beams=relay, JointRules=flatten(relay_3), MaxDistance=Slider(0.5, range=0..1), CreateGeometry=Toggle(True))  # -> Assembly, Geometry, DebugInfo; inputs Beams: list, JointRules: list, Features: list, CreateGeometry: Boolean
#   port Beams: Collection of Beams
# ---------- assembly_6: Python ----------
from compas.scene import Scene
from ghpythonlib.componentbase import executingcomponent as component
from Grasshopper.Kernel.GH_RuntimeMessageLevel import Warning

from compas_timber.assembly import TimberAssembly
from compas_timber.consumers import BrepGeometryConsumer
from compas_timber.connections import ConnectionSolver
from compas_timber.connections import JointTopology
from compas_timber.connections import BeamJoinningError
from compas_timber.ghpython import JointDefinition
from compas_timber.ghpython import CategoryRule
from compas_timber.ghpython import TopologyRule
from compas_timber.ghpython import DirectRule
from compas_timber.ghpython import DebugInfomation


class Assembly(component):
    def __init__(self):
        # maintains relationship of old_beam.id => new_beam_obj for referencing
        # lets us modify copies of the beams while referencing them using their old identities.
        self._beam_map = {}

    def _get_copied_beams(self, old_beams):
        """For the given old_beams returns their respective copies."""
        new_beams = []
        for beam in old_beams:
            new_beams.append(self._beam_map[id(beam)])
        return new_beams

    def get_joints_from_rules(self, beams, rules, topologies):
        if not isinstance(rules, list):
            rules = [rules]
        rules = [r for r in rules if r is not None]

        joints = []
        # rules have to be resolved into joint definitions
        topo_rules = {}
        cat_rules = []
        direct_rules = []

        for r in rules:  # separate category and topo and direct joint rules
            if isinstance(r, TopologyRule):
                topo_rules[r.topology_type] = r
            elif isinstance(r, CategoryRule):
                cat_rules.append(r)
            if isinstance(r, DirectRule):
                direct_rules.append(r)

        for topo in topologies:
            beam_a = topo["beam_a"]
            beam_b = topo["beam_b"]
            detected_topo = topo["detected_topo"]
            pair = beam_a, beam_b
            pair_joined = False

            if detected_topo == JointTopology.TOPO_UNKNOWN:
                continue

            for rule in direct_rules:  # apply direct rules first
                if rule.comply(pair):
                    joints.append(JointDefinition(rule.joint_type, [beam_a, beam_b], **rule.kwargs))
                    pair_joined = True
                    break

            if not pair_joined:  # if no direct rule applies, apply category rules next
                for rule in cat_rules:
                    if not rule.comply(pair):
                        continue
                    if rule.joint_type.SUPPORTED_TOPOLOGY != detected_topo:
                        msg = "Conflict detected! Beams: {}, {} meet with topology: {} but rule assigns: {}"
                        self.AddRuntimeMessage(
                            Warning,
                            msg.format(
                                beam_a.key, beam_b.key, JointTopology.get_name(detected_topo), rule.joint_type.__name__
                            ),
                        )
                        continue
                    # sort by category to allow beam role by order (main beam first, cross beam second)
                    beam_a, beam_b = rule.reorder([beam_a, beam_b])
                    joints.append(JointDefinition(rule.joint_type, [beam_a, beam_b], **rule.kwargs))
                    break  # first matching rule

                else:  # no category rule applies, apply topology rules
                    if detected_topo not in topo_rules:
                        continue
                    else:
                        joints.append(
                            JointDefinition(
                                topo_rules[detected_topo].joint_type,
                                [beam_a, beam_b],
                                **topo_rules[detected_topo].kwargs
                            )
                        )
        return joints

    def RunScript(self, Beams, JointRules, Features, MaxDistance, CreateGeometry):
        if not Beams:
            self.AddRuntimeMessage(Warning, "Input parameter Beams failed to collect data")
        if not JointRules:
            self.AddRuntimeMessage(Warning, "Input parameter JointRules failed to collect data")
        if not (Beams):  # shows beams even if no joints are found
            return

        Assembly = TimberAssembly()
        debug_info = DebugInfomation()

        topologies = []
        solver = ConnectionSolver()
        found_pairs = solver.find_intersecting_pairs(Beams, rtree=True, max_distance=MaxDistance)
        for pair in found_pairs:
            beam_a, beam_b = pair
            detected_topo, beam_a, beam_b = solver.find_topology(beam_a, beam_b, max_distance=MaxDistance)
            if not detected_topo == JointTopology.TOPO_UNKNOWN:
                topologies.append({"detected_topo": detected_topo, "beam_a": beam_a, "beam_b": beam_b})
        Assembly.set_topologies(topologies)

        self._beam_map = {}
        beams = [b for b in Beams if b is not None]
        for beam in beams:
            c_beam = beam.copy()
            Assembly.add_beam(c_beam)
            self._beam_map[id(beam)] = c_beam
        beams = Assembly.beams

        joints = self.get_joints_from_rules(beams, JointRules, topologies)

        if joints:
            handled_beams = []
            joints = [j for j in joints if j is not None]
            # apply reversed. later joints in orginal list override ealier ones
            for joint in joints[::-1]:
                beams_to_pair = self._get_copied_beams(joint.beams)
                beam_pair_ids = set([id(beam) for beam in beams_to_pair])
                if beam_pair_ids in handled_beams:
                    continue
                try:
                    joint.joint_type.create(Assembly, *beams_to_pair, **joint.kwargs)
                except BeamJoinningError as bje:
                    debug_info.add_joint_error(bje)
                else:
                    handled_beams.append(beam_pair_ids)

        if Features:
            features = [f for f in Features if f is not None]
            for f_def in features:
                beams_to_modify = self._get_copied_beams(f_def.beams)
                for beam in beams_to_modify:
                    beam.add_features(f_def.feature)

        Geometry = None
        scene = Scene()
        
        vis_consumer = BrepGeometryConsumer(Assembly)
        
        if CreateGeometry:
            for result in vis_consumer.result:
                scene.add(result.geometry)
                if result.debug_info:
                    debug_info.add_feature_error(result.debug_info)
        else:
            for beam in Assembly.beams:
                scene.add(beam.blank)

        if debug_info.has_errors:
            self.AddRuntimeMessage(Warning, "Error found during joint creation. See DebugInfo output for details.")

        Geometry = scene.draw()
        return Assembly, Geometry, debug_info
# ---------- end assembly_6 ----------
showtopo_2 = CTShowTopologyTypes(Assembly=assembly_6.Assembly)  # same code as showtopo
showjointtypes_4 = CTShowJointTypes(Assembly=assembly_6.Assembly)  # same code as showjointtypes
