# Grasshopper definition dynamic_gh_demo.gh (Grasshopper 1.0.7)

# ----
# Category Joint
panel = Panel("outside")
geo = Geometry([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])
geo_2 = Geometry([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])
beam = CTBeam(Centerline=geo, Width=1, Height=1, Category=panel)  # -> Beam, Blank; inputs Centerline: list, ZVector: list of Vector3d, Width: list, Height: list, Category: list, updateRefObj: Boolean
#   port Centerline: Referenced curve or line, Guid of curve or line in the active Rhino document.
#   port ZVector: Vector defining the orientation of the cross-section (corresponds to the height dimension). If None, a default will be taken.
#   port Width: Width of the cross-section (usually the smaller dimension).
#   port Height: Height of the cross-section (usually the larger dimension).
#   port Category: Category of a beam.
#   port updateRefObj: (optional) If True, the attributes in the referenced object will be updated/overwritten with the new values given here.
#   port Beam: Beam object(s).
#   port Blank: Shape of the beam's blank.
# ---------- beam: Python ----------
"""Creates a Beam from a LineCurve."""

from ghpythonlib.componentbase import executingcomponent as component
from Grasshopper.Kernel.GH_RuntimeMessageLevel import Error
from Grasshopper.Kernel.GH_RuntimeMessageLevel import Warning
from Rhino.RhinoDoc import ActiveDoc
import rhinoscriptsyntax as rs

from compas.scene import Scene
from compas_rhino.conversions import line_to_compas
from compas_rhino.conversions import vector_to_compas

from compas_timber.ghpython.rhino_object_name_attributes import update_rhobj_attributes_name
from compas_timber.parts import Beam as CTBeam


class Beam_fromCurve(component):
    def RunScript(self, Centerline, ZVector, Width, Height, Category, updateRefObj):
        # minimum inputs required
        if not Centerline:
            self.AddRuntimeMessage(Warning, "Input parameter 'Centerline' failed to collect data")
        if not Width:
            self.AddRuntimeMessage(Warning, "Input parameter 'Width' failed to collect data")
        if not Height:
            self.AddRuntimeMessage(Warning, "Input parameter 'Height' failed to collect data")

        # reformat unset parameters for consistency
        if not ZVector:
            ZVector = [None]
        if not Category:
            Category = [None]

        Beam = []
        Blank = []
        scene = Scene()

        if Centerline and Height and Width:
            # check list lengths for consistency
            N = len(Centerline)
            if len(ZVector) not in (0, 1, N):
                self.AddRuntimeMessage(
                    Error, " In 'ZVector' I need either none, one or the same number of inputs as the Crv parameter."
                )
            if len(Width) not in (1, N):
                self.AddRuntimeMessage(
                    Error, " In 'W' I need either one or the same number of inputs as the Crv parameter."
                )
            if len(Height) not in (1, N):
                self.AddRuntimeMessage(
                    Error, " In 'H' I need either one or the same number of inputs as the Crv parameter."
                )
            if len(Category) not in (0, 1, N):
                self.AddRuntimeMessage(
                    Error, " In 'Category' I need either none, one or the same number of inputs as the Crv parameter."
                )

            # duplicate data if None or single value
            if len(ZVector) != N:
                ZVector = [ZVector[0] for _ in range(N)]
            if len(Width) != N:
                Width = [Width[0] for _ in range(N)]
            if len(Height) != N:
                Height = [Height[0] for _ in range(N)]
            if len(Category) != N:
                Category = [Category[0] for _ in range(N)]

            for line, z, w, h, c in zip(Centerline, ZVector, Width, Height, Category):
                guid, geometry = self._get_guid_and_geometry(line)
                rhino_line = rs.coerceline(geometry)
                line = line_to_compas(rhino_line)

                z = vector_to_compas(z) if z else None
                beam = CTBeam.from_centerline(centerline=line, width=w, height=h, z_vector=z)
                beam.attributes["rhino_guid"] = str(guid) if guid else None
                beam.attributes["category"] = c
                print(guid)
                if updateRefObj and guid:
                    update_rhobj_attributes_name(guid, "width", str(w))
                    update_rhobj_attributes_name(guid, "height", str(h))
                    update_rhobj_attributes_name(guid, "zvector", str(list(beam.frame.zaxis)))
                    update_rhobj_attributes_name(guid, "category", c)

                Beam.append(beam)
                scene.add(beam.blank)

        Blank = scene.draw()

        return Beam, Blank

    def _get_guid_and_geometry(self, line):
        # internalized curves and GH geometry will not have persistent GUIDs, referenced Rhino objects will
        # type hint on the input has to be 'ghdoc' for this to work
        guid = None
        geometry = line
        rhino_obj = ActiveDoc.Objects.FindId(line)
        if rhino_obj:
            guid = line
            geometry = rhino_obj.Geometry
        return guid, geometry
# ---------- end beam ----------
beam_2 = CTBeam(Centerline=geo_2, Width=1, Height=1, Category="inside")  # -> Beam, Blank; inputs Centerline: list, ZVector: list of Vector3d, Width: list, Height: list, Category: list, updateRefObj: Boolean; same code as beam
relay = Relay([beam_2.Beam, beam.Beam])
jointsbycategory = CTCategoryJointsRules(main_beam_category="inside", cross_beam_category=panel)  # -> TButtJoint
#   port main_beam_category: main_beam category
#   port cross_beam_category: cross_beam category
# ---------- jointsbycategory: Python ----------
from ghpythonlib.componentbase import executingcomponent as component
from Grasshopper.Kernel.GH_RuntimeMessageLevel import Warning
import clr
import System
import inspect
from System.Windows.Forms import ToolStripSeparator
from System.Windows.Forms import ToolStripMenuItem
from collections import OrderedDict

from compas_timber.connections import Joint
from compas_timber.ghpython.ghcomponent_helpers import manage_dynamic_params
from compas_timber.ghpython.ghcomponent_helpers import get_leaf_subclasses
from compas_timber.ghpython.ghcomponent_helpers import rename_GH_output
from compas_timber.ghpython import CategoryRule



class CategoryJointRule(component):
    def __init__(self):
        super(CategoryJointRule, self).__init__()
        self.topo_bools = OrderedDict([
        ("Unknown", False),
        ("I", False),
        ("L" , False),
        ("T" , False),
        ("X" , False)
        ])

        self.classes =  {}
        for cls in get_leaf_subclasses(Joint):
            self.classes[cls.__name__] = cls

        if ghenv.Component.Params.Output[0].NickName == 'Rule':
            self.joint_type = None
        else:
            parsed_output = ghenv.Component.Params.Output[0].NickName.split("_")
            self.joint_type = self.classes.get(parsed_output[0])
            for key in parsed_output[1:]:
                self.topo_bools[key] = True


    def RunScript(self, *args):
        if not self.joint_type:
            ghenv.Component.Message = "Select joint type from context menu (right click)"
            self.AddRuntimeMessage(Warning, "Select joint type from context menu (right click)")
            return None
        else:
            ghenv.Component.Message = self.joint_type.__name__
            cat_a = args[0]
            cat_b = args[1]

            kwargs = {}
            for i, val in enumerate(args[2:]):
                if val:
                    kwargs[self.arg_names()[i+2]] = val
            print(kwargs)
            if not cat_a:
                self.AddRuntimeMessage(Warning, "Input parameter {} failed to collect data.".format(self.arg_names()[0]))
            if not cat_b:
                self.AddRuntimeMessage(Warning, "Input parameter {} failed to collect data.".format(self.arg_names()[1]))
            if not (cat_a and cat_b):
                return

            topos = []
            for i, bool in enumerate(self.topo_bools.values()):
                if bool:
                    topos.append(i)

            return CategoryRule(self.joint_type, cat_a, cat_b, topos, **kwargs)


    def arg_names(self):
        names = inspect.getargspec(self.joint_type.__init__)[0][1:]
        for i in range(2):
            names[i] += " category"
        return [name for name in names if (name != 'key') and (name != 'frame')]


    def AppendAdditionalMenuItems(self, menu):
        for name in self.classes.keys():
            item = menu.Items.Add(name, None, self.on_item_click)
            if self.joint_type and name == self.joint_type.__name__:
                    item.Checked = True

        menu.Items.Add(ToolStripSeparator())
        topo_menu = ToolStripMenuItem("Apply to Topology")
        menu.Items.Add(topo_menu)
        for name, bool in self.topo_bools.items():
            item = ToolStripMenuItem(name, None, self.on_topo_click)
            item.Checked = bool
            topo_menu.DropDownItems.Add(item)

    def output_name(self):
        name = self.joint_type.__name__
        for key, bool in self.topo_bools.items():
            if bool:
                name += "_{}".format(key)
        return name

    def on_topo_click(self, sender, event_info):
        self.topo_bools[str(sender)] = not self.topo_bools[str(sender)]
        rename_GH_output(self.output_name(), 0, ghenv)
        ghenv.Component.ExpireSolution(True)


    def on_item_click(self, sender, event_info):
        self.joint_type = self.classes[str(sender)]
        rename_GH_output(self.output_name(), 0, ghenv)
        manage_dynamic_params(self.arg_names(), ghenv, rename_count = 2, permanent_param_count = 0)
        ghenv.Component.ExpireSolution(True)
# ---------- end jointsbycategory ----------
jointsbycategory_2 = CTCategoryJointsRules(beam_a_category="inside", beam_b_category="inside", flip_lap_side=Toggle(True), cut_plane_bias=Slider(0.26, range=0..1))  # -> XHalfLapJoint; same code as jointsbycategory
jointsbycategory_3 = CTCategoryJointsRules(beam_a_category=panel, beam_b_category=panel)  # -> LHalfLapJoint; same code as jointsbycategory
relay_2 = Relay([jointsbycategory_3, jointsbycategory, jointsbycategory_2])
assembly = CTAssembly(Beams=relay, JointRules=flatten(relay_2), MaxDistance="1", CreateGeometry="True")  # -> Assembly, Geometry, DebugInfo; inputs Beams: list, JointRules: list, Features: list, CreateGeometry: Boolean
#   port Beams: Collection of Beams
# ---------- assembly: Python ----------
from compas.scene import Scene
from ghpythonlib.componentbase import executingcomponent as component
from Grasshopper.Kernel.GH_RuntimeMessageLevel import Warning

from compas_timber.assembly import TimberAssembly
from compas_timber.consumers import BrepGeometryConsumer
from compas_timber.connections import ConnectionSolver
from compas_timber.connections import JointTopology
from compas_timber.connections import BeamJoinningError
from compas_timber.ghpython import JointDefinition
from compas_timber.ghpython import CategoryRule
from compas_timber.ghpython import TopologyRule
from compas_timber.ghpython import DirectRule
from compas_timber.ghpython import DefaultRule
from compas_timber.ghpython import DebugInfomation


class Assembly(component):
    def __init__(self):
        # maintains relationship of old_beam.id => new_beam_obj for referencing
        # lets us modify copies of the beams while referencing them using their old identities.
        self._beam_map = {}

    def _get_copied_beams(self, old_beams):
        """For the given old_beams returns their respective copies."""
        new_beams = []
        for beam in old_beams:
            new_beams.append(self._beam_map[id(beam)])
        return new_beams

    def get_joints_from_rules(self, beams, rules, topologies):
        if not isinstance(rules, list):
            rules = [rules]
        rules = [r for r in rules if r is not None]

        joints = []
        # rules have to be resolved into joint definitions
        topo_rules = {}
        cat_rules = []
        direct_rules = []

        for r in rules:  # separate category and topo and direct joint rules
            if isinstance(r, TopologyRule):
                if topo_rules.get(r.topology_type, None):                                   #if rule for this Topo exists
                    if (r.joint_type != DefaultRule.DEFAULTS[r.topology_type]) or (len(r.kwargs) != 0):     #if this rule is NOT default
                        topo_rules[r.topology_type] = r
                else:
                    topo_rules[r.topology_type] = r
            elif isinstance(r, CategoryRule):
                cat_rules.append(r)
            if isinstance(r, DirectRule):
                direct_rules.append(r)

        for topo in topologies:
            beam_a = topo["beam_a"]
            beam_b = topo["beam_b"]
            detected_topo = topo["detected_topo"]
            pair = beam_a, beam_b
            pair_joined = False

            if detected_topo == JointTopology.TOPO_UNKNOWN:
                continue

            for rule in direct_rules:  # apply direct rules first
                if rule.comply(pair):
                    joints.append(JointDefinition(rule.joint_type, rule.beams, **rule.kwargs))
                    pair_joined = True
                    break

            if not pair_joined:  # if no direct rule applies, apply category rules next
                for rule in cat_rules:
                    if not rule.comply(pair):
                        continue
                    if rule.joint_type.SUPPORTED_TOPOLOGY != detected_topo:
                        msg = "Conflict detected! Beams: {}, {} meet with topology: {} but rule assigns: {}"
                        self.AddRuntimeMessage(
                            Warning,
                            msg.format(
                                beam_a.key, beam_b.key, JointTopology.get_name(detected_topo), rule.joint_type.__name__
                            ),
                        )
                        continue
                    if rule.topos and detected_topo not in rule.topos:
                        msg = "Conflict detected! Beams: {}, {} meet with topology: {} but rule allows: {}"
                        self.AddRuntimeMessage(
                            Warning,
                            msg.format(
                                beam_a.key, beam_b.key, JointTopology.get_name(detected_topo), [JointTopology.get_name(topo) for topo in rule.topos]
                            ),
                        )
                        continue
                    # sort by category to allow beam role by order (main beam first, cross beam second)
                    beam_a, beam_b = rule.reorder([beam_a, beam_b])
                    joints.append(JointDefinition(rule.joint_type, [beam_a, beam_b], **rule.kwargs))
                    break  # first matching rule

                else:  # no category rule applies, apply topology rules
                    if detected_topo not in topo_rules:
                        continue
                    else:
                        joints.append(
                            JointDefinition(
                                topo_rules[detected_topo].joint_type,
                                [beam_a, beam_b],
                                **topo_rules[detected_topo].kwargs
                            )
                        )
        return joints

    def RunScript(self, Beams, JointRules, Features, MaxDistance, CreateGeometry):
        if not Beams:
            self.AddRuntimeMessage(Warning, "Input parameter Beams failed to collect data")
        if not JointRules:
            self.AddRuntimeMessage(Warning, "Input parameter JointRules failed to collect data")
        if not (Beams):  # shows beams even if no joints are found
            return

        Assembly = TimberAssembly()
        debug_info = DebugInfomation()

        topologies = []
        solver = ConnectionSolver()
        found_pairs = solver.find_intersecting_pairs(Beams, rtree=True, max_distance=MaxDistance)
        for pair in found_pairs:
            beam_a, beam_b = pair
            detected_topo, beam_a, beam_b = solver.find_topology(beam_a, beam_b, max_distance=MaxDistance)
            if not detected_topo == JointTopology.TOPO_UNKNOWN:
                topologies.append({"detected_topo": detected_topo, "beam_a": beam_a, "beam_b": beam_b})
        Assembly.set_topologies(topologies)

        self._beam_map = {}
        beams = [b for b in Beams if b is not None]
        for beam in beams:
            c_beam = beam.copy()
            Assembly.add_beam(c_beam)
            self._beam_map[id(beam)] = c_beam
        beams = Assembly.beams

        joints = self.get_joints_from_rules(beams, JointRules, topologies)

        if joints:
            handled_beams = []
            joints = [j for j in joints if j is not None]
            # apply reversed. later joints in orginal list override ealier ones
            for joint in joints[::-1]:
                beams_to_pair = self._get_copied_beams(joint.beams)
                beam_pair_ids = set([id(beam) for beam in beams_to_pair])
                if beam_pair_ids in handled_beams:
                    continue
                try:
                    joint.joint_type.create(Assembly, *beams_to_pair, **joint.kwargs)
                except BeamJoinningError as bje:
                    debug_info.add_joint_error(bje)
                else:
                    handled_beams.append(beam_pair_ids)

        if Features:
            features = [f for f in Features if f is not None]
            for f_def in features:
                beams_to_modify = self._get_copied_beams(f_def.beams)
                for beam in beams_to_modify:
                    beam.add_features(f_def.feature)

        Geometry = None
        scene = Scene()
        if CreateGeometry:
            vis_consumer = BrepGeometryConsumer(Assembly)
            for result in vis_consumer.result:
                scene.add(result.geometry)
                if result.debug_info:
                    debug_info.add_feature_error(result.debug_info)
        else:
            for beam in Assembly.beams:
                scene.add(beam.blank)

        if debug_info.has_errors:
            self.AddRuntimeMessage(Warning, "Error found during joint creation. See DebugInfo output for details.")

        Geometry = scene.draw()
        return Assembly, Geometry, debug_info
# ---------- end assembly ----------

# ----
# Topo Joint
crv = Curve([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])
beam_3 = CTBeam(Centerline=crv, Width=1, Height=1)  # -> Beam, Blank; inputs Centerline: list, ZVector: list of Vector3d, Width: list, Height: list, Category: list, updateRefObj: Boolean; same code as beam
defaultjoints = CTDefaultJointRules()  # -> Rules
# ---------- defaultjoints: Python ----------
from ghpythonlib.componentbase import executingcomponent as component
from Grasshopper.Kernel.GH_RuntimeMessageLevel import Warning

from compas_timber.connections import JointTopology
from compas_timber.ghpython import TopologyRule

from compas_timber.connections import LMiterJoint
from compas_timber.connections import TButtJoint
from compas_timber.connections import XHalfLapJoint


class TopologyJointRule(component):
    def RunScript(self):
        topoRules = []
        topoRules.append(TopologyRule(JointTopology.TOPO_L, LMiterJoint))
        topoRules.append(TopologyRule(JointTopology.TOPO_T, TButtJoint))
        topoRules.append(TopologyRule(JointTopology.TOPO_X, XHalfLapJoint))

        return topoRules
# ---------- end defaultjoints ----------
l_topo_joint = CTLTopologicalJointRules()  # -> Rule
# ---------- l_topo_joint: Python ----------
from ghpythonlib.componentbase import executingcomponent as component
from Grasshopper.Kernel.GH_RuntimeMessageLevel import Warning
import inspect

from compas_timber.ghpython.ghcomponent_helpers import manage_dynamic_params
from compas_timber.ghpython.ghcomponent_helpers import get_leaf_subclasses
from compas_timber.ghpython.ghcomponent_helpers import rename_GH_output

from compas_timber.connections import Joint
from compas_timber.connections import JointTopology
from compas_timber.connections import LMiterJoint
from compas_timber.ghpython import TopologyRule


class L_TopologyJointRule(component):
    def __init__(self):
        super(L_TopologyJointRule, self).__init__()
        self.classes = {}
        for cls in get_leaf_subclasses(Joint):
            if cls.SUPPORTED_TOPOLOGY == JointTopology.TOPO_L:
                self.classes[cls.__name__] = cls
        if ghenv.Component.Params.Output[0].NickName == 'Rule':
            self.joint_type = LMiterJoint
            self.clicked = False
        else:
            self.joint_type = self.classes.get(ghenv.Component.Params.Output[0].NickName, None)
            self.clicked = True

    def RunScript(self, *args):
        if not self.clicked:
            ghenv.Component.Message = "Default: LMiterJoint"
            self.AddRuntimeMessage(Warning, "LMiterJoint is default, change in context menu (right click)")
            return TopologyRule(JointTopology.TOPO_L, LMiterJoint)
        else:
            ghenv.Component.Message = self.joint_type.__name__
            kwargs = {}
            for i, val in enumerate(args):
                if val:
                    kwargs[self.arg_names()[i]] = val
            if self.joint_type.SUPPORTED_TOPOLOGY != JointTopology.TOPO_L:
                self.AddRuntimeMessage(Warning, "Joint type does not match topology. Joint may not be generated.")
            return TopologyRule(JointTopology.TOPO_L, self.joint_type, **kwargs)

    def arg_names(self):
        names = inspect.getargspec(self.joint_type.__init__)[0][3:]
        return [name for name in names if (name != "key") and (name != "frame")]

    def AppendAdditionalMenuItems(self, menu):
        for name in self.classes.keys():
            item = menu.Items.Add(name, None, self.on_item_click)
            if self.joint_type and name == self.joint_type.__name__:
                item.Checked = True

    def on_item_click(self, sender, event_info):
        self.clicked = True
        self.joint_type = self.classes[str(sender)]
        rename_GH_output(self.joint_type.__name__, 0, ghenv)
        manage_dynamic_params(self.arg_names(), ghenv, rename_count=0, permanent_param_count=0)
        ghenv.Component.ExpireSolution(True)
# ---------- end l_topo_joint ----------
x_topo_joint = CTXTopologicalJointRules()  # -> Rule
# ---------- x_topo_joint: Python ----------
from ghpythonlib.componentbase import executingcomponent as component
from Grasshopper.Kernel.GH_RuntimeMessageLevel import Warning
import inspect

from compas_timber.ghpython.ghcomponent_helpers import manage_dynamic_params
from compas_timber.ghpython.ghcomponent_helpers import get_leaf_subclasses
from compas_timber.ghpython.ghcomponent_helpers import rename_GH_output

from compas_timber.connections import Joint
from compas_timber.connections import JointTopology
from compas_timber.connections import XHalfLapJoint
from compas_timber.ghpython import TopologyRule


class X_TopologyJointRule(component):
    def __init__(self):
        super(X_TopologyJointRule, self).__init__()
        self.classes = {}
        for cls in get_leaf_subclasses(Joint):
            if cls.SUPPORTED_TOPOLOGY == JointTopology.TOPO_X:
                self.classes[cls.__name__] = cls
        if ghenv.Component.Params.Output[0].NickName == 'Rule':
            self.joint_type = XHalfLapJoint
            self.clicked = False
        else:
            self.joint_type = self.classes.get(ghenv.Component.Params.Output[0].NickName, None)
            self.clicked = True

    def RunScript(self, *args):
        if not self.clicked:
            ghenv.Component.Message = "Default: XHalfLapJoint"
            self.AddRuntimeMessage(Warning, "XHalfLapJoint is default, change in context menu (right click)")
            return TopologyRule(JointTopology.TOPO_X, XHalfLapJoint)
        else:
            ghenv.Component.Message = self.joint_type.__name__
            kwargs = {}
            for i, val in enumerate(args):
                if val:
                    kwargs[self.arg_names()[i]] = val
            if self.joint_type.SUPPORTED_TOPOLOGY != JointTopology.TOPO_X:
                self.AddRuntimeMessage(Warning, "Joint type does not match topology. Joint may not be generated.")
            return TopologyRule(JointTopology.TOPO_X, self.joint_type, **kwargs)

    def arg_names(self):
        names = inspect.getargspec(self.joint_type.__init__)[0][3:]
        return [name for name in names if (name != "key") and (name != "frame")]

    def AppendAdditionalMenuItems(self, menu):
        for name in self.classes.keys():
            item = menu.Items.Add(name, None, self.on_item_click)
            if self.joint_type and name == self.joint_type.__name__:
                item.Checked = True

    def on_item_click(self, sender, event_info):
        self.clicked = True
        self.joint_type = self.classes[str(sender)]
        rename_GH_output(self.joint_type.__name__, 0, ghenv)
        manage_dynamic_params(self.arg_names(), ghenv, rename_count=0, permanent_param_count=0)
        ghenv.Component.ExpireSolution(True)
# ---------- end x_topo_joint ----------
t_topo_joint = CTTTopologicalJointRules()  # -> Rule
# ---------- t_topo_joint: Python ----------
from ghpythonlib.componentbase import executingcomponent as component
from Grasshopper.Kernel.GH_RuntimeMessageLevel import Warning
import inspect

from compas_timber.ghpython.ghcomponent_helpers import manage_dynamic_params
from compas_timber.ghpython.ghcomponent_helpers import get_leaf_subclasses
from compas_timber.ghpython.ghcomponent_helpers import rename_GH_output

from compas_timber.connections import Joint
from compas_timber.connections import JointTopology
from compas_timber.connections import TButtJoint
from compas_timber.ghpython import TopologyRule


class T_TopologyJointRule(component):
    def __init__(self):
        super(T_TopologyJointRule, self).__init__()
        self.classes = {}
        for cls in get_leaf_subclasses(Joint):
            if cls.SUPPORTED_TOPOLOGY == JointTopology.TOPO_T:
                self.classes[cls.__name__] = cls
        self.joint_type = TButtJoint
        self.clicked = False

    def RunScript(self, *args):
        if not self.clicked:
            ghenv.Component.Message = "Default: TButtJoint"
            self.AddRuntimeMessage(Warning, "TButtJoint is default, change in context menu (right click)")
            return TopologyRule(JointTopology.TOPO_T, TButtJoint)
        else:
            ghenv.Component.Message = self.joint_type.__name__
            kwargs = {}
            for i, val in enumerate(args):
                if val:
                    kwargs[self.arg_names()[i]] = val
            if self.joint_type.SUPPORTED_TOPOLOGY != JointTopology.TOPO_T:
                self.AddRuntimeMessage(Warning, "Joint type does not match topology. Joint may not be generated.")
            return TopologyRule(JointTopology.TOPO_T, self.joint_type, **kwargs)

    def arg_names(self):
        names = inspect.getargspec(self.joint_type.__init__)[0][3:]
        return [name for name in names if (name != "key") and (name != "frame")]

    def AppendAdditionalMenuItems(self, menu):
        for name in self.classes.keys():
            item = menu.Items.Add(name, None, self.on_item_click)
            if self.joint_type and name == self.joint_type.__name__:
                item.Checked = True

    def on_item_click(self, sender, event_info):
        self.clicked = True
        self.joint_type = self.classes[str(sender)]
        rename_GH_output(self.joint_type.__name__, 0, ghenv)
        manage_dynamic_params(self.arg_names(), ghenv, rename_count=0, permanent_param_count=0)
        ghenv.Component.ExpireSolution(True)
# ---------- end t_topo_joint ----------
assembly_2 = CTAssembly(Beams=beam_3.Beam, JointRules=flatten(defaultjoints), MaxDistance="1", CreateGeometry="True")  # -> Assembly, Geometry, DebugInfo; inputs Beams: list, JointRules: list, Features: list, CreateGeometry: Boolean; same code as assembly

# ----
# Direct Joint
geo_3 = Geometry(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)
geo_4 = Geometry(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)
number_slider = Slider(0.17, range=0..1)
beam_4 = CTBeam(Centerline=geo_3, Width=1, Height=1)  # -> Beam, Blank; inputs Centerline: list, ZVector: list of Vector3d, Width: list, Height: list, Category: list, updateRefObj: Boolean; same code as beam
beam_5 = CTBeam(Centerline=geo_4, Width=1, Height=1)  # -> Beam, Blank; inputs Centerline: list, ZVector: list of Vector3d, Width: list, Height: list, Category: list, updateRefObj: Boolean; same code as beam
toggle = BooleanToggle(True)
relay_3 = Relay([beam_4.Beam, beam_5.Beam])
directjoints = CTDirectJointRules(main_beam=beam_4.Beam, cross_beam=beam_5.Beam)  # -> LButtJoint; inputs main_beam: list, cross_beam: list
# ---------- directjoints: Python ----------
from ghpythonlib.componentbase import executingcomponent as component
from Grasshopper.Kernel.GH_RuntimeMessageLevel import Error
from Grasshopper.Kernel.GH_RuntimeMessageLevel import Warning
import clr
import System
import inspect
import itertools

from compas_timber.connections import Joint
from compas_timber.connections import ConnectionSolver
from compas_timber.connections import JointTopology

from compas_timber.ghpython.ghcomponent_helpers import manage_dynamic_params
from compas_timber.ghpython.ghcomponent_helpers import get_leaf_subclasses
from compas_timber.ghpython.ghcomponent_helpers import rename_GH_output
from compas_timber.ghpython import DirectRule


class DirectJointRule(component):
    def __init__(self):
        super(DirectJointRule, self).__init__()
        self.classes =  {}
        for cls in get_leaf_subclasses(Joint):
            self.classes[cls.__name__] = cls

        if ghenv.Component.Params.Output[0].NickName == 'Rule':
            self.joint_type = None
        else:
            self.joint_type = self.classes.get(ghenv.Component.Params.Output[0].NickName, None)


    def RunScript(self, *args):
        if not self.joint_type:
            ghenv.Component.Message = "Select joint type from context menu (right click)"
            self.AddRuntimeMessage(Warning, "Select joint type from context menu (right click)")
            return None
        else:
            ghenv.Component.Message = self.joint_type.__name__
            beam_a = args[0]
            beam_b = args[1]
            kwargs = {}
            for i, val in enumerate(args[2:]):
                if val:
                    kwargs[self.arg_names()[i+2]] = val

            if not beam_a:
                self.AddRuntimeMessage(Warning, "Input parameter {} failed to collect data.".format(self.arg_names()[0]))
            if not beam_b:
                self.AddRuntimeMessage(Warning, "Input parameter {} failed to collect data.".format(self.arg_names()[1]))
            if not (args[0] and args[1]):
                return
            if not isinstance(beam_a, list):
                beam_a = [beam_a]
            if not isinstance(beam_b, list):
                beam_b = [beam_b]
            if len(beam_a) != len(beam_b):
                self.AddRuntimeMessage(Error, "Number of items in {} and {} must match!".format(self.arg_names()[0], self.arg_names()[1]))
                return
            Rules = []
            for main, secondary in zip(beam_a, beam_b):
                topology, _, _ = ConnectionSolver().find_topology(main, secondary)
                if topology != self.joint_type.SUPPORTED_TOPOLOGY:
                    self.AddRuntimeMessage(
                        Warning,
                        "Beams meet with topology: {} which does not agree with joint of type: {}".format(
                            JointTopology.get_name(topology), self.joint_type.__name__
                        ),
                    )
                Rules.append(DirectRule(self.joint_type, [secondary, main], **kwargs))
            return Rules


    def arg_names(self):
        return inspect.getargspec(self.joint_type.__init__)[0][1:]


    def AppendAdditionalMenuItems(self, menu):
            for name in self.classes.keys():
                item = menu.Items.Add(name, None, self.on_item_click)
                if self.joint_type and name == self.joint_type.__name__:
                    item.Checked = True


    def on_item_click(self, sender, event_info):
        self.joint_type = self.classes[str(sender)]
        rename_GH_output(self.joint_type.__name__, 0, ghenv)
        manage_dynamic_params(self.arg_names(), ghenv, rename_count = 2, permanent_param_count = 0)
        ghenv.Component.ExpireSolution(True)
# ---------- end directjoints ----------
assembly_3 = CTAssembly(Beams=relay_3, JointRules=flatten(directjoints), MaxDistance="1", CreateGeometry="True")  # -> Assembly, Geometry, DebugInfo; inputs Beams: list, JointRules: list, Features: list, CreateGeometry: Boolean; same code as assembly

# ----
# Direct Joint
geo_5 = Geometry(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)
geo_6 = Geometry(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)
beam_6 = CTBeam(Centerline=geo_5, Width=1, Height=1)  # -> Beam, Blank; inputs Centerline: list, ZVector: list of Vector3d, Width: list, Height: list, Category: list, updateRefObj: Boolean; same code as beam
beam_7 = CTBeam(Centerline=geo_6, Width=1, Height=1)  # -> Beam, Blank; inputs Centerline: list, ZVector: list of Vector3d, Width: list, Height: list, Category: list, updateRefObj: Boolean; same code as beam
relay_4 = Relay([beam_6.Beam, beam_7.Beam])
directjoints_2 = CTDirectJointRules(beam_a=beam_7.Beam, beam_b=beam_6.Beam, flip_lap_side=Toggle(True), cut_plane_bias=Slider(0.31, range=0..1))  # -> XHalfLapJoint; inputs beam_a: list, beam_b: list; same code as directjoints
assembly_4 = CTAssembly(Beams=relay_4, JointRules=flatten(directjoints_2), MaxDistance="0.5", CreateGeometry="True")  # -> Assembly, Geometry, DebugInfo; inputs Beams: list, JointRules: list, Features: list, CreateGeometry: Boolean; same code as assembly

# ----
# Base Component
# right click me to select joint type,
# or leave on default
l_topo_joint_2 = CTLTopologicalJointRules()  # -> Rule; same code as l_topo_joint
t_topo_joint_2 = CTTTopologicalJointRules()  # -> Rule; same code as t_topo_joint
x_topo_joint_2 = CTXTopologicalJointRules()  # -> Rule; same code as x_topo_joint

# ----
# Base Component
# right click me to select joint type
directjoints_3 = CTDirectJointRules()  # -> Rule; inputs Beam_A: list, Beam_B: list; same code as directjoints

# ----
# Base Component
# right click me to select joint type
directjoints_4 = CTDirectJointRules()  # -> Rule; inputs Beam_A: list, Beam_B: list; same code as directjoints

# ----
# Base Component
# right click me to select joint
# type or topology filter
jointsbycategory_4 = CTCategoryJointsRules()  # -> Rule; same code as jointsbycategory
