# Grasshopper definition test_frl.gh (Grasshopper 1.0.7)

crv = Curve(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)
crv_2 = Curve(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)

crv_3 = Curve(<curve referenced from the Rhino model>)
crv_4 = Curve(<curve referenced from the Rhino model>)

X = UnitX(Factor=expr("-x", Slider(1000, range=0..4000)))

# ---- group: FLIP
toggle = BooleanToggle(True)

# ----
crv_5 = Curve(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)

end = EndPoints(Curve=crv_5)  # -> Start, End
move = Move(Geometry=end.End, Motion=X)  # -> Geometry, Transform
ln = Line(StartPoint=end.Start, EndPoint=move.Geometry)

# ---- group: FLIP
toggle_2 = BooleanToggle(False)

# ----
crv_6 = Curve(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)
flip = FlipCurve(Curve=ln)  # -> Curve, Flag

flip_2 = FlipCurve(Curve=crv_6)  # -> Curve, Flag
filter = StreamFilter(Gate=toggle_2, Stream0=crv_6, Stream1=flip_2.Curve)

filter_2 = StreamFilter(Gate=toggle, Stream0=ln, Stream1=flip.Curve)
line = Line(filter)
line_2 = Line(filter_2)
crvprox = CurveProximity(CurveA=line, CurveB=line_2)  # -> PointA, PointB, Distance
end_2 = EndPoints(Curve=line_2)  # -> Start, End
python = GhPythonScript(x=Button())  # -> out, a
# ---------- python: Python ----------
from compas_rhino import unload_modules

if x == True:
    print("unloaded")
    unload_modules('compas_timber')
# ---------- end python ----------
panel = Panel(python.out)
dist = Distance(PointA=crvprox.PointA, PointB=end_2.Start)
dist_2 = Distance(PointA=crvprox.PointA, PointB=end_2.End)
number_slider = Slider(90, range=0..100)
number_slider_2 = Slider(90, range=0..100)
crvprox_2 = CurveProximity(CurveA=line, CurveB=line_2)  # -> PointA, PointB, Distance
xprod = CrossProduct(VectorA=line, VectorB=line_2, Unitize=False)  # -> Vector, Length
larger = LargerThan(FirstNumber=dist, SecondNumber=dist_2)  # -> LargerThan, OrEqualTo
flip_3 = FlipCurve(Curve=line_2)  # -> Curve, Flag
vdis = VectorDisplay(Anchor=crvprox_2.PointA, Vector=xprod.Vector)
filter_3 = StreamFilter(Gate=larger.LargerThan, Stream0=line_2, Stream1=flip_3.Curve)
beam = CTBeam(Centerline=line, Width=number_slider_2, Height=number_slider)  # -> Beam, Blank; inputs Centerline: list, ZVector: list of Vector3d, Width: list, Height: list, Category: list, updateRefObj: Boolean
#   port Centerline: Referenced curve or line, Guid of curve or line in the active Rhino document.
#   port ZVector: Vector defining the orientation of the cross-section (corresponds to the height dimension). If None, a default will be taken.
#   port Width: Width of the cross-section (usually the smaller dimension).
#   port Height: Height of the cross-section (usually the larger dimension).
#   port Category: Category of a beam.
#   port updateRefObj: (optional) If True, the attributes in the referenced object will be updated/overwritten with the new values given here.
#   port Beam: Beam object(s).
#   port Blank: Shape of the beam's blank.
# ---------- beam: Python ----------
"""Creates a Beam from a LineCurve."""

import rhinoscriptsyntax as rs
from compas.scene import Scene
from compas_rhino.conversions import line_to_compas
from compas_rhino.conversions import vector_to_compas
from ghpythonlib.componentbase import executingcomponent as component
from Grasshopper.Kernel.GH_RuntimeMessageLevel import Error
from Grasshopper.Kernel.GH_RuntimeMessageLevel import Warning
from Rhino.RhinoDoc import ActiveDoc

from compas_timber.elements import Beam as CTBeam
from compas_timber.ghpython.rhino_object_name_attributes import update_rhobj_attributes_name


class Beam_fromCurve(component):
    def RunScript(self, centerline, z_vector, width, height, category, updateRefObj):
        # minimum inputs required
        if not centerline:
            self.AddRuntimeMessage(Warning, "Input parameter 'Centerline' failed to collect data")
        if not width:
            length = self._get_centerline_length(centerline)
            width = [length / 20]
        if not height:
            length = self._get_centerline_length(centerline)
            height = [length / 10]

        # reformat unset parameters for consistency
        if not z_vector:
            z_vector = [None]
        if not category:
            category = [None]

        beams = []
        blanks = []
        scene = Scene()

        if centerline and height and width:
            # check list lengths for consistency
            N = len(centerline)
            if len(z_vector) not in (0, 1, N):
                self.AddRuntimeMessage(
                    Error, " In 'ZVector' I need either none, one or the same number of inputs as the Crv parameter."
                )
            if len(width) not in (1, N):
                self.AddRuntimeMessage(
                    Error, " In 'W' I need either one or the same number of inputs as the Crv parameter."
                )
            if len(height) not in (1, N):
                self.AddRuntimeMessage(
                    Error, " In 'H' I need either one or the same number of inputs as the Crv parameter."
                )
            if len(category) not in (0, 1, N):
                self.AddRuntimeMessage(
                    Error, " In 'Category' I need either none, one or the same number of inputs as the Crv parameter."
                )

            # duplicate data if None or single value
            if len(z_vector) != N:
                z_vector = [z_vector[0] for _ in range(N)]
            if len(width) != N:
                width = [width[0] for _ in range(N)]
            if len(height) != N:
                height = [height[0] for _ in range(N)]
            if len(category) != N:
                category = [category[0] for _ in range(N)]

            for line, z, w, h, c in zip(centerline, z_vector, width, height, category):
                guid, geometry = self._get_guid_and_geometry(line)
                rhino_line = rs.coerceline(geometry)
                line = line_to_compas(rhino_line)

                z = vector_to_compas(z) if z else None
                beam = CTBeam.from_centerline(centerline=line, width=w, height=h, z_vector=z)
                beam.attributes["rhino_guid"] = str(guid) if guid else None
                beam.attributes["category"] = c
                print(guid)
                if updateRefObj and guid:
                    update_rhobj_attributes_name(guid, "width", str(w))
                    update_rhobj_attributes_name(guid, "height", str(h))
                    update_rhobj_attributes_name(guid, "zvector", str(list(beam.frame.zaxis)))
                    update_rhobj_attributes_name(guid, "category", c)

                beams.append(beam)
                scene.add(beam.blank)

        blanks = scene.draw()

        return beams, blanks

    def _get_guid_and_geometry(self, line):
        # internalized curves and GH geometry will not have persistent GUIDs, referenced Rhino objects will
        # type hint on the input has to be 'ghdoc' for this to work
        guid = None
        geometry = line
        rhino_obj = ActiveDoc.Objects.FindId(line)
        if rhino_obj:
            guid = line
            geometry = rhino_obj.Geometry
        return guid, geometry

    def _get_centerline_length(self, centerline):
        centerline_length = []
        for i in centerline:
            centerline_length.append(rs.CurveLength(i))
        if centerline_length:
            length_average = sum(centerline_length) / len(centerline_length)
        else:
            length_average = 1
        return length_average
# ---------- end beam ----------
beam_2 = CTBeam(Centerline=line_2, Width=number_slider_2, Height=number_slider)  # -> Beam, Blank; inputs Centerline: list, ZVector: list of Vector3d, Width: list, Height: list, Category: list, updateRefObj: Boolean; same code as beam
python_2 = GhPythonScript(main_beam=beam.Beam, cross_beam=beam_2.Beam)  # -> out, main_cutting_plane, cross_cutting_plane, main_ref_side, cross_ref_side, volume_main, volume_cross, main_beam_geo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; disabled
# ---------- python_2: Python ----------
from compas_timber._fabrication import FrenchRidgeLap
from compas_timber._fabrication.btlx_process import EdgePositionType 
from compas.geometry import Line, Brep
from compas_timber.connections.utilities import beam_ref_side_incidence_with_vector, beam_ref_side_incidence
from compas_rhino.conversions import frame_to_rhino, line_to_rhino, mesh_to_rhino, brep_to_rhino, plane_to_rhino, box_to_rhino, polyhedron_to_rhino, point_to_rhino, plane_to_rhino
from compas_rhino import unload_modules

#unload_modules('compas_timber')


def add_extensions(beam_a, beam_b, plane_a, plane_b):
    """Calculates and adds the necessary extensions to the beams.

    This method is automatically called when joint is created by the call to `Joint.create()`.

    """
    start_a, start_b = None, None

    start_a, end_a = beam_a.extension_to_plane(plane_a)
    start_b, end_b = beam_b.extension_to_plane(plane_b)

    beam_a.add_blank_extension(start_a, end_a, beam_a.guid)
    beam_b.add_blank_extension(start_b, end_b, beam_b.guid)

def cutting_plane(beam_a, beam_b):
    # the plane that cuts beam_b
    ref_side_dict = beam_ref_side_incidence(beam_b, beam_a, ignore_ends=True)
    ref_side_index = max(ref_side_dict, key=ref_side_dict.get)
    return beam_a.ref_sides[ref_side_index]

##cutting planes
cutting_plane_cross =  cutting_plane(cross_beam, main_beam) # cuts the main_beam
cutting_plane_main = cutting_plane(main_beam, cross_beam) # cuts the cross_beam

cross_vector = main_beam.centerline.direction.cross(cross_beam.centerline.direction)
#cross
cross_ref_side_dict = beam_ref_side_incidence_with_vector(cross_beam, cross_vector, ignore_ends=True)
cross_ref_side_index = max(cross_ref_side_dict, key=cross_ref_side_dict.get)
# main 
main_ref_side_dict = beam_ref_side_incidence_with_vector(main_beam, cross_vector, ignore_ends=True)
main_ref_side_index = min(main_ref_side_dict, key=main_ref_side_dict.get)

add_extensions(main_beam, cross_beam, cutting_plane_cross, cutting_plane_main)

frl = FrenchRidgeLap.from_beam_and_beam(main_beam, cross_beam, drillhole_diam = 0.0,  ref_side_index = main_ref_side_index)
eqv = frl.equilateral_quadrilateral_vertices_from_params_and_beam(main_beam)
ph = frl.volume_from_params_and_beam(main_beam)
pl = frl.plane_from_params_and_beam(main_beam)

#frl_2 = FrenchRidgeLap.from_beam_and_beam(cross_beam, main_beam, drillhole_diam = 0.0,  ref_side_index =cross_ref_side_index)
#eqv_2 = frl_2.equilateral_quadrilateral_vertices_from_params_and_beam(cross_beam)
#ph_2 = frl_2.volume_from_params_and_beam(cross_beam)
#pl_2 = frl_2.plane_from_params_and_beam(cross_beam)


#ph2_r = polyhedron_to_rhino(ph_2)
vert_main = [point_to_rhino(p) for p in eqv]
#vert_cross = [point_to_rhino(p) for p in eqv_2]


### viz ref frames
main_ref_side = frame_to_rhino(main_beam.ref_sides[main_ref_side_index])
#cross_ref_side = frame_to_rhino(cross_beam.ref_sides[cross_ref_side_index])

### viz cutting frames
main_cutting_plane = frame_to_rhino(pl)
#cross_cutting_plane = frame_to_rhino(cutting_plane_cross)

### viz cutting volumes
volume_main = mesh_to_rhino(ph)
#volume_cross = mesh_to_rhino(ph_2)



geo_main = main_beam.compute_geometry()
#geo_cross = cross_beam.compute_geometry()
### viz geo
geo_main = frl.apply(geo_main, main_beam)
#geo_cross = frl_2.apply(geo_cross, cross_beam)
main_beam_geo =brep_to_rhino(geo_main)
#cross_beam_geo =brep_to_rhino(geo_cross)
# ---------- end python_2 ----------
l_topo_joint = CTLTopologicalJointRules()  # -> LFrenchRidgeLapJoint
#   port drill_hole_diameter: drill_hole_diameter
# ---------- l_topo_joint: Python ----------
import inspect

from ghpythonlib.componentbase import executingcomponent as component
from Grasshopper.Kernel.GH_RuntimeMessageLevel import Warning

from compas_timber.connections import Joint
from compas_timber.connections import JointTopology
from compas_timber.connections import LMiterJoint
from compas_timber.design import TopologyRule
from compas_timber.ghpython.ghcomponent_helpers import get_leaf_subclasses
from compas_timber.ghpython.ghcomponent_helpers import manage_dynamic_params
from compas_timber.ghpython.ghcomponent_helpers import rename_gh_output


class L_TopologyJointRule(component):
    def __init__(self):
        super(L_TopologyJointRule, self).__init__()
        self.classes = {}
        for cls in get_leaf_subclasses(Joint):
            if cls.SUPPORTED_TOPOLOGY == JointTopology.TOPO_L:
                self.classes[cls.__name__] = cls
        if ghenv.Component.Params.Output[0].NickName == "Rule":
            self.joint_type = LMiterJoint
            self.clicked = False
        else:
            self.joint_type = self.classes.get(ghenv.Component.Params.Output[0].NickName, None)
            self.clicked = True

    def RunScript(self, *args):
        if not self.clicked:
            ghenv.Component.Message = "Default: LMiterJoint"
            self.AddRuntimeMessage(Warning, "LMiterJoint is default, change in context menu (right click)")
            return TopologyRule(JointTopology.TOPO_L, LMiterJoint)
        else:
            ghenv.Component.Message = self.joint_type.__name__
            kwargs = {}
            for i, val in enumerate(args):
                if val is not None:
                    kwargs[self.arg_names()[i]] = val
            if self.joint_type.SUPPORTED_TOPOLOGY != JointTopology.TOPO_L:
                self.AddRuntimeMessage(Warning, "Joint type does not match topology. Joint may not be generated.")
            return TopologyRule(JointTopology.TOPO_L, self.joint_type, **kwargs)

    def arg_names(self):
        names = inspect.getargspec(self.joint_type.__init__)[0][3:]
        return [name for name in names if (name != "key") and (name != "frame")]

    def AppendAdditionalMenuItems(self, menu):
        for name in self.classes.keys():
            item = menu.Items.Add(name, None, self.on_item_click)
            if self.joint_type and name == self.joint_type.__name__:
                item.Checked = True

    def on_item_click(self, sender, event_info):
        self.clicked = True
        self.joint_type = self.classes[str(sender)]
        rename_gh_output(self.joint_type.__name__, 0, ghenv)
        manage_dynamic_params(self.arg_names(), ghenv, rename_count=0, permanent_param_count=0)
        ghenv.Component.ExpireSolution(True)
# ---------- end l_topo_joint ----------
python_3 = GhPythonScript()  # -> out, a
# ---------- python_3: Python ----------
import math

print(90/math.tan(math.radians(180-68.12)))
# ---------- end python_3 ----------

mesh = Mesh(python_2.volume_main)
mesh_2 = Mesh(python_2.volume_cross)

brep = Brep(python_2.main_beam_geo)
brep_2 = Brep(python_2.cross_beam_geo)

pt = Point(python_2.vert_cross)
pt_2 = Point(python_2.vert_main)

pln = Plane(python_2.main_ref_side)
pln_2 = Plane(python_2.cross_ref_side)

pln_3 = Plane(python_2.main_cutting_plane)
pln_4 = Plane(python_2.cross_cutting_plane)

model = CTModel(Elements=flatten([beam.Beam, beam_2.Beam]), JointRules=flatten(l_topo_joint), CreateGeometry=Toggle(True))  # -> Model, Geometry, DebugInfo; inputs Elements: list, JointRules: list, Features: list, CreateGeometry: Boolean
#   port Elements: Collection of Beams
# ---------- model: Python ----------
from compas.scene import Scene
from compas.tolerance import TOL
from ghpythonlib.componentbase import executingcomponent as component
from Grasshopper.Kernel.GH_RuntimeMessageLevel import Warning

from compas_timber.connections import BeamJoinningError
from compas_timber.connections import ConnectionSolver
from compas_timber.connections import JointTopology
from compas_timber.connections import LMiterJoint
from compas_timber.connections import TButtJoint
from compas_timber.connections import XHalfLapJoint
from compas_timber.design import CategoryRule
from compas_timber.design import DebugInfomation
from compas_timber.design import DirectRule
from compas_timber.design import JointDefinition
from compas_timber.design import TopologyRule
from compas_timber.model import TimberModel

JOINT_DEFAULTS = {
    JointTopology.TOPO_X: XHalfLapJoint,
    JointTopology.TOPO_T: TButtJoint,
    JointTopology.TOPO_L: LMiterJoint,
}


# workaround for https://github.com/gramaziokohler/compas_timber/issues/280
TOL.absolute = 1e-6


class ModelComponent(component):
    def get_joints_from_rules(self, beams, rules, topologies):
        if not isinstance(rules, list):
            rules = [rules]
        rules = [r for r in rules if r is not None]

        joints = []
        # rules have to be resolved into joint definitions
        topo_rules = {}
        cat_rules = []
        direct_rules = []

        # TODO: refactor this into some kind of a rule reloving class/function
        for r in rules:  # separate category and topo and direct joint rules
            if isinstance(r, TopologyRule):
                if topo_rules.get(r.topology_type, None):  # if rule for this Topo exists
                    if (r.joint_type != JOINT_DEFAULTS[r.topology_type]) or (
                        len(r.kwargs) != 0
                    ):  # if this rule is NOT default
                        topo_rules[r.topology_type] = r
                else:
                    topo_rules[r.topology_type] = r
            elif isinstance(r, CategoryRule):
                cat_rules.append(r)
            if isinstance(r, DirectRule):
                direct_rules.append(r)

        for topo in topologies:
            beam_a = topo["beam_a"]
            beam_b = topo["beam_b"]
            detected_topo = topo["detected_topo"]
            pair = beam_a, beam_b
            pair_joined = False

            if detected_topo == JointTopology.TOPO_UNKNOWN:
                continue

            for rule in direct_rules:  # apply direct rules first
                if rule.comply(pair):
                    joints.append(JointDefinition(rule.joint_type, rule.beams, **rule.kwargs))
                    pair_joined = True
                    break

            if not pair_joined:  # if no direct rule applies, apply category rules next
                for rule in cat_rules:
                    if not rule.comply(pair):
                        continue
                    if rule.joint_type.SUPPORTED_TOPOLOGY != detected_topo:
                        msg = "Conflict detected! Beams: {}, {} meet with topology: {} but rule assigns: {}"
                        self.AddRuntimeMessage(
                            Warning,
                            msg.format(
                                beam_a.guid,
                                beam_b.guid,
                                JointTopology.get_name(detected_topo),
                                rule.joint_type.__name__,
                            ),
                        )
                        continue
                    if rule.topos and detected_topo not in rule.topos:
                        msg = "Conflict detected! Beams: {}, {} meet with topology: {} but rule allows: {}"
                        self.AddRuntimeMessage(
                            Warning,
                            msg.format(
                                beam_a.guid,
                                beam_b.guid,
                                JointTopology.get_name(detected_topo),
                                [JointTopology.get_name(topo) for topo in rule.topos],
                            ),
                        )
                        continue
                    # sort by category to allow beam role by order (main beam first, cross beam second)
                    beam_a, beam_b = rule.reorder([beam_a, beam_b])
                    joints.append(JointDefinition(rule.joint_type, [beam_a, beam_b], **rule.kwargs))
                    break  # first matching rule

                else:  # no category rule applies, apply topology rules
                    if detected_topo not in topo_rules:
                        continue
                    else:
                        joints.append(
                            JointDefinition(
                                topo_rules[detected_topo].joint_type,
                                [beam_a, beam_b],
                                **topo_rules[detected_topo].kwargs
                            )
                        )
        return joints

    def RunScript(self, Elements, JointRules, Features, MaxDistance, CreateGeometry):
        if not Elements:
            self.AddRuntimeMessage(Warning, "Input parameter Beams failed to collect data")
        if not JointRules:
            self.AddRuntimeMessage(Warning, "Input parameter JointRules failed to collect data")
        if not (Elements):  # shows beams even if no joints are found
            return
        if MaxDistance is None:
            MaxDistance = TOL.ABSOLUTE  # compared to calculted distance, so shouldn't be just 0.0

        Model = TimberModel()
        debug_info = DebugInfomation()
        for element in Elements:
            # prepare elements for downstream processing
            if element is None:
                continue
            element.remove_features()
            if hasattr(element, "remove_blank_extension"):
                element.remove_blank_extension()
            element.debug_info = []
            Model.add_element(element)

        topologies = []
        solver = ConnectionSolver()
        found_pairs = solver.find_intersecting_pairs(list(Model.beams), rtree=True, max_distance=MaxDistance)
        for pair in found_pairs:
            beam_a, beam_b = pair
            detected_topo, beam_a, beam_b = solver.find_topology(beam_a, beam_b, max_distance=MaxDistance)
            if not detected_topo == JointTopology.TOPO_UNKNOWN:
                topologies.append({"detected_topo": detected_topo, "beam_a": beam_a, "beam_b": beam_b})
        Model.set_topologies(topologies)

        joints = self.get_joints_from_rules(Model.beams, JointRules, topologies)

        if joints:
            handled_beams = []
            joints = [j for j in joints if j is not None]
            # apply reversed. later joints in orginal list override ealier ones
            for joint in joints[::-1]:
                beams_to_pair = joint.beams
                beam_pair_ids = set([id(beam) for beam in beams_to_pair])
                if beam_pair_ids in handled_beams:
                    continue
                try:
                    joint.joint_type.create(Model, *beams_to_pair, **joint.kwargs)
                except BeamJoinningError as bje:
                    debug_info.add_joint_error(bje)
                else:
                    handled_beams.append(beam_pair_ids)

        # applies extensions and features resulting from joints
        Model.process_joinery()

        if Features:
            features = [f for f in Features if f is not None]
            for f_def in features:
                for element in f_def.elements:
                    element.add_features(f_def.feature)

        Geometry = None
        scene = Scene()
        for element in Model.elements():
            if CreateGeometry:
                scene.add(element.geometry)
                if element.debug_info:
                    debug_info.add_feature_error(element.debug_info)
            else:
                scene.add(element.blank)

        if debug_info.has_errors:
            self.AddRuntimeMessage(Warning, "Error found during joint creation. See DebugInfo output for details.")

        Geometry = scene.draw()
        return Model, Geometry, debug_info
# ---------- end model ----------
item = ListItem(List=pt_2, Index=0, Wrap=True)  # -> Item, Item1, Item2
edges = BrepEdges(Brep=brep_2)  # -> Naked, Interior, NonManifold
panel_2 = Panel("C:\Users\kapso\OneDrive\Desktop\BTLx\LFrenchRidgeLapJoint.btlx")
pln_5 = Plane(python_2.main_ref_side)
pln_6 = Plane(python_2.cross_cutting_plane)
cloud = CloudDisplay(Points=[item.Item, item.Item1], Colours=RGB(255, 20, 147), Size=Slider(10, range=0..10), SpriteType=0)
pl_origin = PlaneOrigin(Base=pln_6, Origin=crvprox_2.PointA)
deplane = DeconstructPlane(Plane=pln_5)  # -> Origin, XAxis, YAxis, ZAxis
deplane_2 = DeconstructPlane(Plane=pln_6)  # -> Origin, XAxis, YAxis, ZAxis
dprod = DotProduct(VectorA=deplane.XAxis, VectorB=deplane_2.ZAxis, Unitize=False)
panel_3 = Panel(dprod)
python_4 = GhPythonScript(x=model.DebugInfo)  # -> out, a; disabled
# ---------- python_4: Python ----------
a = (x.feature_errors)
# ---------- end python_4 ----------
xprod_2 = CrossProduct(VectorA=deplane.ZAxis, VectorB=deplane_2.ZAxis, Unitize=False)  # -> Vector, Length
dprod_2 = DotProduct(VectorA=deplane.XAxis, VectorB=xprod_2.Vector, Unitize=False)
panel_4 = Panel(dprod_2)
panel_5 = Panel(python_4.a)  # disabled
angle = Angle(VectorA=deplane.XAxis, VectorB=xprod_2.Vector)  # -> Angle, Reflex
vdis_2 = VectorDisplay(Anchor=crvprox_2.PointA, Vector=expr("x*100", [deplane.XAxis, xprod_2.Vector]))
writebtlx = CTWriteBTLx(Model=model.Model, Path=panel_2, Write=Button())  # -> BTLx; inputs Write: Boolean
#   port Model: Model object.
# ---------- writebtlx: Python ----------
import Rhino
from ghpythonlib.componentbase import executingcomponent as component
from Grasshopper.Kernel.GH_RuntimeMessageLevel import Warning

from compas_timber.fabrication import BTLx


class WriteBTLx(component):
    def RunScript(self, model, path, write):
        if not model:
            self.AddRuntimeMessage(Warning, "Input parameter Model failed to collect data")
            return

        btlx = BTLx(model)
        btlx.history["FileName"] = Rhino.RhinoDoc.ActiveDoc.Name

        if write:
            if not path:
                self.AddRuntimeMessage(Warning, "Input parameter Path failed to collect data")
                return
            if path[-5:] != ".btlx":
                path += ".btlx"
            with open(path, "w") as f:
                f.write(btlx.btlx_string())
        return btlx.btlx_string()
# ---------- end writebtlx ----------
pflip = FlipPlane(Plane=pln_5, ReverseX=invert(False), ReverseY=False, SwapAxes=invert(True))
deg = Degrees(Radians=angle.Angle)
panel_6 = Panel(deg)
smaller = SmallerThan(FirstNumber=dprod_2, SecondNumber="0")  # -> SmallerThan, OrEqualTo
python_5 = GhPythonScript(x=deplane.XAxis, y=xprod_2.Vector, z=deplane.ZAxis)  # -> out, a
# ---------- python_5: Python ----------
from compas_rhino.conversions import vector_to_compas
from compas.geometry import angle_vectors_signed

x = vector_to_compas(x)
y = vector_to_compas(y)
z = vector_to_compas(z)
print(angle_vectors_signed(x,y,z, deg=True))
# ---------- end python_5 ----------
panel_7 = Panel(python_5.out)
filter_4 = StreamFilter(Gate=smaller.SmallerThan, Stream0=pln_5, Stream1=pflip)
panel_8 = Panel(writebtlx)
deplane_3 = DeconstructPlane(Plane=filter_4)  # -> Origin, XAxis, YAxis, ZAxis
deplane_4 = DeconstructPlane(Plane=pl_origin)  # -> Origin, XAxis, YAxis, ZAxis
vdis_3 = VectorDisplay(Anchor=crvprox_2.PointA, Vector=expr("x*100", [xprod_2.Vector, deplane_3.XAxis]))
