# Grasshopper definition test_halflap.ghx (Grasshopper 1.0.7)
# plug-ins: Pufferfish, Human

X = UnitX(Factor=expr("-x", Slider(1000, range=0..4000)))
Z = UnitZ(Factor=expr("-x", Slider(0, range=0..2000)))
Y = UnitY(Factor=expr("-x", Slider(0, range=0..4000)))

# ---- group: FLIP
toggle = BooleanToggle(False)

# ----
crv = Curve(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)
end = EndPoints(Curve=crv)  # -> Start, End
addition = Addition(A=X, B=Z, C=Y)
move = Move(Geometry=end.End, Motion=expr("-x", addition))  # -> Geometry, Transform
ln = Line(StartPoint=end.Start, EndPoint=move.Geometry)

# ---- group: FLIP
toggle_2 = BooleanToggle(True)

# ---- group: CrossBeam
crv_2 = Curve(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)

# ---- group: JackRafterCut Unittest
python = GhPythonScript()  # -> out, beam, beam_geo, plane_geo, effective_plane, centerline
# ---------- python: Python ----------
from compas.geometry import Line, Plane, Vector, Point
from compas_timber.elements import Beam
from compas_timber._fabrication import JackRafterCut, JackRafterCutParams
from compas.scene import Scene, SceneObject
from compas_rhino.conversions import brep_to_rhino, plane_to_rhino

centerline = Line(Point(x=270.0, y=270.0, z=590.0), Point(x=1220.0, y=680.0, z=590.0))
cross_section = (60, 120)
beam = Beam.from_centerline(centerline, cross_section[0], cross_section[1])

# cut the start of the beam
normal = Vector(x=-0.996194698092, y=-0.0, z=-0.0871557427477)
plane = Plane(Point(x=460.346635340, y=445.167151490, z=473.942755901), normal)
instance = JackRafterCut.from_plane_and_beam(plane, beam, ref_side_index = 0)

beam_geo = brep_to_rhino(beam.compute_geometry())
plane_geo = plane_to_rhino(plane)
effective_plane = plane_to_rhino(instance.plane_from_params_and_beam(beam))

params = JackRafterCutParams(instance)
print(params.as_dict())
print(centerline.length)
# ---------- end python ----------
python_2 = GhPythonScript()  # -> out, beam, beam_geo, plane_geo, effective_plane, centerline
# ---------- python_2: Python ----------
from compas.geometry import Line, Plane, Vector, Point
from compas_timber.elements import Beam
from compas_timber._fabrication import JackRafterCut, JackRafterCutParams
from compas.scene import Scene, SceneObject
from compas_rhino.conversions import brep_to_rhino, plane_to_rhino
from compas_rhino import unload_modules

unload_modules('compas_timber')

centerline = Line(Point(x=270.0, y=270.0, z=590.0), Point(x=1220.0, y=680.0, z=590.0))
cross_section = (60, 120)
beam = Beam.from_centerline(centerline, cross_section[0], cross_section[1])

# cut the end of the beam
normal = Vector(x=-0.996194698092, y=-0.0, z=-0.0871557427477) * -1.0
plane = Plane(Point(x=460.346635340, y=445.167151490, z=473.942755901), normal)
instance = JackRafterCut.from_plane_and_beam(plane, beam)

beam_geo = brep_to_rhino(beam.compute_geometry())
plane_geo = plane_to_rhino(plane)
effective_plane = plane_to_rhino(instance.plane_from_params_and_beam(beam))

params = JackRafterCutParams(instance)
print(params.as_dict())
print(centerline.length)
# ---------- end python_2 ----------
pln = Plane(python.plane_geo)
pln_2 = Plane(python.effective_plane)
pln_3 = Plane(python_2.plane_geo)
pln_4 = Plane(python_2.effective_plane)
planesrf = PlaneSurface(Plane=python.effective_plane, XSize=Domain(-10, 10), YSize=Domain(-10, 10))
planesrf_2 = PlaneSurface(Plane=python_2.effective_plane, XSize=Domain(-10, 10), YSize=Domain(-10, 10))
brep = Brep(python.beam_geo)
pl_origin = PlaneOrigin(Base=pln, Origin=pln_2)
brep_2 = Brep(python_2.beam_geo)
pl_origin_2 = PlaneOrigin(Base=pln_3, Origin=pln_4)

# ----
number_slider = Slider(1000, range=0..1000)
flip = FlipCurve(Curve=ln)  # -> Curve, Flag

flip_2 = FlipCurve(Curve=crv_2)  # -> Curve, Flag
filter = StreamFilter(Gate=toggle_2, Stream0=crv_2, Stream1=flip_2.Curve)

filter_2 = StreamFilter(Gate=toggle, Stream0=ln, Stream1=flip.Curve)

# ---- group: UNITTEST LINES
crv_3 = Curve([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])

# ----
crv_4 = Curve(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)
ext = ExtendCurve(Curve=filter_2, Type=0, Start=number_slider, End=number_slider)
crv_5 = Curve(<curve referenced from the Rhino model>)
merge = Merge(Data1=crv_3, Data2=crv_4)  # -> flatten(Result)
item = ListItem(List=crv_3, Index=Slider(3, range=0..3), Wrap=True)
line = Line(ext)
crv_6 = Curve(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)
line_2 = Line(filter)
flip_3 = FlipCurve(Curve=crv_6)  # -> Curve, Flag
crvprox = CurveProximity(CurveA=line_2, CurveB=crv_6)  # -> PointA, PointB, Distance
filter_3 = StreamFilter(Gate=toggle, Stream0=crv_6, Stream1=flip_3.Curve)
xprod = CrossProduct(VectorA=line_2, VectorB=crv_6, Unitize=False)  # -> Vector, Length
vdis = VectorDisplay(Anchor=crvprox.PointA, Vector=expr("x*100", xprod.Vector))
Z_2 = UnitZ(Factor=1)
X_2 = UnitX(Factor=1)
addition_2 = Addition(A=X_2, B=Z_2)
number_slider_2 = Slider(80, range=0..100)
number_slider_3 = Slider(120, range=0..120)
number_slider_4 = Slider(80, range=0..100)
number_slider_5 = Slider(100, range=0..100)
Y_2 = UnitY(Factor=1)
beam = CTBeam(Centerline=filter_3, ZVector=Z_2, Width=number_slider_5, Height=number_slider_5)  # -> Beam, Blank; inputs Centerline: list, ZVector: list of Vector3d, Width: list, Height: list, Category: list, updateRefObj: Boolean
#   port Centerline: Referenced curve or line, Guid of curve or line in the active Rhino document.
#   port ZVector: Vector defining the orientation of the cross-section (corresponds to the height dimension). If None, a default will be taken.
#   port Width: Width of the cross-section (usually the smaller dimension).
#   port Height: Height of the cross-section (usually the larger dimension).
#   port Category: Category of a beam.
#   port updateRefObj: (optional) If True, the attributes in the referenced object will be updated/overwritten with the new values given here.
#   port Beam: Beam object(s).
#   port Blank: Shape of the beam's blank.
# ---------- beam: Python ----------
"""Creates a Beam from a LineCurve."""

import rhinoscriptsyntax as rs
from compas.scene import Scene
from compas_rhino.conversions import line_to_compas
from compas_rhino.conversions import vector_to_compas
from ghpythonlib.componentbase import executingcomponent as component
from Grasshopper.Kernel.GH_RuntimeMessageLevel import Error
from Grasshopper.Kernel.GH_RuntimeMessageLevel import Warning
from Rhino.RhinoDoc import ActiveDoc

from compas_timber.elements import Beam as CTBeam
from compas_timber.ghpython.rhino_object_name_attributes import update_rhobj_attributes_name


class Beam_fromCurve(component):
    def RunScript(self, centerline, z_vector, width, height, category, updateRefObj):
        # minimum inputs required
        if not centerline:
            self.AddRuntimeMessage(Warning, "Input parameter 'Centerline' failed to collect data")
        if not width:
            length = self._get_centerline_length(centerline)
            width = [length / 20]
        if not height:
            length = self._get_centerline_length(centerline)
            height = [length / 10]

        # reformat unset parameters for consistency
        if not z_vector:
            z_vector = [None]
        if not category:
            category = [None]

        beams = []
        blanks = []
        scene = Scene()

        if centerline and height and width:
            # check list lengths for consistency
            N = len(centerline)
            if len(z_vector) not in (0, 1, N):
                self.AddRuntimeMessage(
                    Error, " In 'ZVector' I need either none, one or the same number of inputs as the Crv parameter."
                )
            if len(width) not in (1, N):
                self.AddRuntimeMessage(
                    Error, " In 'W' I need either one or the same number of inputs as the Crv parameter."
                )
            if len(height) not in (1, N):
                self.AddRuntimeMessage(
                    Error, " In 'H' I need either one or the same number of inputs as the Crv parameter."
                )
            if len(category) not in (0, 1, N):
                self.AddRuntimeMessage(
                    Error, " In 'Category' I need either none, one or the same number of inputs as the Crv parameter."
                )

            # duplicate data if None or single value
            if len(z_vector) != N:
                z_vector = [z_vector[0] for _ in range(N)]
            if len(width) != N:
                width = [width[0] for _ in range(N)]
            if len(height) != N:
                height = [height[0] for _ in range(N)]
            if len(category) != N:
                category = [category[0] for _ in range(N)]

            for line, z, w, h, c in zip(centerline, z_vector, width, height, category):
                guid, geometry = self._get_guid_and_geometry(line)
                rhino_line = rs.coerceline(geometry)
                line = line_to_compas(rhino_line)

                z = vector_to_compas(z) if z else None
                beam = CTBeam.from_centerline(centerline=line, width=w, height=h, z_vector=z)
                beam.attributes["rhino_guid"] = str(guid) if guid else None
                beam.attributes["category"] = c
                print(guid)
                if updateRefObj and guid:
                    update_rhobj_attributes_name(guid, "width", str(w))
                    update_rhobj_attributes_name(guid, "height", str(h))
                    update_rhobj_attributes_name(guid, "zvector", str(list(beam.frame.zaxis)))
                    update_rhobj_attributes_name(guid, "category", c)

                beams.append(beam)
                scene.add(beam.blank)

        blanks = scene.draw()

        return beams, blanks

    def _get_guid_and_geometry(self, line):
        # internalized curves and GH geometry will not have persistent GUIDs, referenced Rhino objects will
        # type hint on the input has to be 'ghdoc' for this to work
        guid = None
        geometry = line
        rhino_obj = ActiveDoc.Objects.FindId(line)
        if rhino_obj:
            guid = line
            geometry = rhino_obj.Geometry
        return guid, geometry

    def _get_centerline_length(self, centerline):
        centerline_length = []
        for i in centerline:
            centerline_length.append(rs.CurveLength(i))
        if centerline_length:
            length_average = sum(centerline_length) / len(centerline_length)
        else:
            length_average = 1
        return length_average
# ---------- end beam ----------
beam_2 = CTBeam(Centerline=line_2, ZVector=Y_2, Width=number_slider_3, Height=number_slider_3)  # -> Beam, Blank; inputs Centerline: list, ZVector: list of Vector3d, Width: list, Height: list, Category: list, updateRefObj: Boolean; same code as beam
edges = BrepEdges(Brep=beam_2.Blank)  # -> Naked, Interior, NonManifold
edges_2 = BrepEdges(Brep=beam.Blank)  # -> Naked, Interior, NonManifold
number_slider_6 = Slider(0.5, range=0..1)
previewlw = CustomPreviewLineweights(Geometry=edges.Interior, Shader=ColourSwatch(SwatchColor=RGB(0, 106, 255)), Absolute=False)
number_slider_7 = Slider(40, range=0..100)
previewlw_2 = CustomPreviewLineweights(Geometry=edges_2.Interior, Shader=ColourSwatch(SwatchColor=RGB(255, 0, 0)), Absolute=False)
brep_3 = Brep([<brep referenced from the Rhino model> x2])
brep_4 = Brep(<brep referenced from the Rhino model>)
x_topo_joint = CTXTopologicalJointRules(cut_plane_bias=number_slider_6)  # -> XHalfLapJoint
#   port cut_plane_bias: cut_plane_bias
# ---------- x_topo_joint: Python ----------
import inspect

from ghpythonlib.componentbase import executingcomponent as component
from Grasshopper.Kernel.GH_RuntimeMessageLevel import Warning

from compas_timber.connections import Joint
from compas_timber.connections import JointTopology
from compas_timber.connections import XHalfLapJoint
from compas_timber.design import TopologyRule
from compas_timber.ghpython.ghcomponent_helpers import get_leaf_subclasses
from compas_timber.ghpython.ghcomponent_helpers import manage_dynamic_params
from compas_timber.ghpython.ghcomponent_helpers import rename_gh_output


class X_TopologyJointRule(component):
    def __init__(self):
        super(X_TopologyJointRule, self).__init__()
        self.classes = {}
        for cls in get_leaf_subclasses(Joint):
            if cls.SUPPORTED_TOPOLOGY == JointTopology.TOPO_X:
                self.classes[cls.__name__] = cls
        if ghenv.Component.Params.Output[0].NickName == "Rule":
            self.joint_type = XHalfLapJoint
            self.clicked = False
        else:
            self.joint_type = self.classes.get(ghenv.Component.Params.Output[0].NickName, None)
            self.clicked = True

    def RunScript(self, *args):
        if not self.clicked:
            ghenv.Component.Message = "Default: XHalfLapJoint"
            self.AddRuntimeMessage(Warning, "XHalfLapJoint is default, change in context menu (right click)")
            return TopologyRule(JointTopology.TOPO_X, XHalfLapJoint)
        else:
            ghenv.Component.Message = self.joint_type.__name__
            kwargs = {}
            for i, val in enumerate(args):
                if val is not None:
                    kwargs[self.arg_names()[i]] = val
            if self.joint_type.SUPPORTED_TOPOLOGY != JointTopology.TOPO_X:
                self.AddRuntimeMessage(Warning, "Joint type does not match topology. Joint may not be generated.")
            return TopologyRule(JointTopology.TOPO_X, self.joint_type, **kwargs)

    def arg_names(self):
        names = inspect.getargspec(self.joint_type.__init__)[0][3:]
        return [name for name in names if (name != "key") and (name != "frame")]

    def AppendAdditionalMenuItems(self, menu):
        for name in self.classes.keys():
            item = menu.Items.Add(name, None, self.on_item_click)
            if self.joint_type and name == self.joint_type.__name__:
                item.Checked = True

    def on_item_click(self, sender, event_info):
        self.clicked = True
        self.joint_type = self.classes[str(sender)]
        rename_gh_output(self.joint_type.__name__, 0, ghenv)
        manage_dynamic_params(self.arg_names(), ghenv, rename_count=0, permanent_param_count=0)
        ghenv.Component.ExpireSolution(True)
# ---------- end x_topo_joint ----------
pln_5 = Plane(brep_3)
pln_6 = Plane(brep_4)
dispatch = Dispatch(List=pln_5, DispatchPattern=[True, False])  # -> ListA, ListB
deplane = DeconstructPlane(Plane=pln_6)  # -> Origin, XAxis, YAxis, unitize(ZAxis)
python_3 = GhPythonScript(main_beam=beam.Beam, cross_beam=beam_2.Beam, depth=number_slider_6)  # -> out, main_ref_side, cross_ref_side, rg_cross, rg_main, cutting_plane_main, rg_volume, rg_volume_2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; disabled
# ---------- python_3: Python ----------
from compas_timber._fabrication import Lap
from compas_timber._fabrication import JackRafterCut
from compas_timber.connections.utilities import beam_ref_side_incidence, beam_ref_side_incidence_with_vector
from compas_rhino.conversions import frame_to_rhino, brep_to_rhino, plane_to_rhino, box_to_rhino
from compas_rhino import unload_modules

unload_modules('compas_timber')
cross_vect = cross_beam.centerline.direction.cross(main_beam.centerline.direction)
#cross
cross_ref_side_dict = beam_ref_side_incidence_with_vector(cross_beam, cross_vect, ignore_ends=True)
cross_ref_side_index = max(cross_ref_side_dict, key=cross_ref_side_dict.get)
# main 
main_ref_side_dict = beam_ref_side_incidence_with_vector(main_beam, cross_vect, ignore_ends=True)
main_ref_side_index = min(main_ref_side_dict, key=main_ref_side_dict.get)
main_plane = main_beam.ref_sides[(main_ref_side_index+1)%4]
cross_plane = cross_beam.ref_sides[(cross_ref_side_index+1)%4]
#main_ref_side_indices = main_ref_side_index, (main_ref_side_index+1)%4, (main_ref_side_index+2)%4
#main_planes = [main_beam.ref_sides[index] for index in main_ref_side_indices]

cross_lap_width = main_beam.height if main_ref_side_index % 2 == 0 else main_beam.width
main_lap_width = cross_beam.height if cross_ref_side_index % 2 == 0 else cross_beam.width
lap_depth = (cross_lap_width + main_lap_width) / 2


### instanciate lap processing from plane and beam
lap = Lap.from_plane_and_beam(main_plane, cross_beam, cross_lap_width, lap_depth*depth, cross_ref_side_index)
lap_frame = lap.planes_from_params_and_beam(cross_beam)
volume = lap.volume_from_params_and_beam(cross_beam)
cross_geo = cross_beam.compute_geometry()
cross_geo = lap.apply(cross_geo, cross_beam)

### instanciate lap processing from plane and beam
lap2 = Lap.from_plane_and_beam(cross_plane, main_beam, main_lap_width, lap_depth*depth, main_ref_side_index)
lap_frame2 = lap2.planes_from_params_and_beam(main_beam)
volume2 = lap2.volume_from_params_and_beam(main_beam)
main_geo = main_beam.compute_geometry()
main_geo = lap2.apply(main_geo, main_beam)

### get cutting plane for JackRafterCut processing
##cross_plane = cross_beam.ref_sides[cross_ref_side_index]
##cross_plane.xaxis = -cross_plane.xaxis
##cross_plane.translate(cross_plane.normal*depth)
### instanciate jack cut processing
##jack_cut = JackRafterCut.from_plane_and_beam(cross_plane, main_beam, main_ref_side_index)
##cutting_plane_main = jack_cut.plane_from_params_and_beam(main_beam)
##main_geo = main_beam.compute_geometry()
##main_geo = jack_cut.apply(main_geo, main_beam)
#lap_frame = [plane_to_rhino(frame) for frame in lap_frame]
lap_frame = [frame_to_rhino(frame) for frame in lap_frame]
# viz frames
cross_ref_side = frame_to_rhino(cross_beam.ref_sides[(cross_ref_side_index)%4])
#main_ref_side = frame_to_rhino(main_plane)
#cross_frames = [frame_to_rhino(frame) for frame in cross_planes]
#main_frames = [frame_to_rhino(frame) for frame in main_planes]
#main_ref_sides = [frame_to_rhino(main_beam.ref_sides[i]) for i in main_ref_side_indices]
cutting_plane_main = frame_to_rhino(main_plane)
# viz volumes
rg_cross = brep_to_rhino(cross_geo)
rg_main = brep_to_rhino(main_geo)
rg_volume = brep_to_rhino(volume)
rg_volume_2 = brep_to_rhino(volume2)
# ---------- end python_3 ----------
panel = Panel(python_3.out)
pflip = FlipPlane(Plane=dispatch.ListB, ReverseX=False, ReverseY=False, SwapAxes=True)
model = CTModel(
    Elements=flatten([beam_2.Beam, beam.Beam]),
    JointRules=flatten(x_topo_joint),
    MaxDistance=Slider(10, range=0..100),
    CreateGeometry=Toggle(True))  # -> Model, Geometry, DebugInfo; inputs Elements: list, JointRules: list, Features: list, CreateGeometry: Boolean
#   port Elements: Collection of Beams
# ---------- model: Python ----------
from compas.scene import Scene
from compas.tolerance import TOL
from ghpythonlib.componentbase import executingcomponent as component
from Grasshopper.Kernel.GH_RuntimeMessageLevel import Warning

from compas_timber.connections import BeamJoinningError
from compas_timber.connections import ConnectionSolver
from compas_timber.connections import JointTopology
from compas_timber.connections import LMiterJoint
from compas_timber.connections import TButtJoint
from compas_timber.connections import XHalfLapJoint
from compas_timber.design import CategoryRule
from compas_timber.design import DebugInfomation
from compas_timber.design import DirectRule
from compas_timber.design import JointDefinition
from compas_timber.design import TopologyRule
from compas_timber.model import TimberModel

JOINT_DEFAULTS = {
    JointTopology.TOPO_X: XHalfLapJoint,
    JointTopology.TOPO_T: TButtJoint,
    JointTopology.TOPO_L: LMiterJoint,
}


# workaround for https://github.com/gramaziokohler/compas_timber/issues/280
TOL.absolute = 1e-6


class ModelComponent(component):
    def get_joints_from_rules(self, beams, rules, topologies):
        if not isinstance(rules, list):
            rules = [rules]
        rules = [r for r in rules if r is not None]

        joints = []
        # rules have to be resolved into joint definitions
        topo_rules = {}
        cat_rules = []
        direct_rules = []

        # TODO: refactor this into some kind of a rule reloving class/function
        for r in rules:  # separate category and topo and direct joint rules
            if isinstance(r, TopologyRule):
                if topo_rules.get(r.topology_type, None):  # if rule for this Topo exists
                    if (r.joint_type != JOINT_DEFAULTS[r.topology_type]) or (
                        len(r.kwargs) != 0
                    ):  # if this rule is NOT default
                        topo_rules[r.topology_type] = r
                else:
                    topo_rules[r.topology_type] = r
            elif isinstance(r, CategoryRule):
                cat_rules.append(r)
            if isinstance(r, DirectRule):
                direct_rules.append(r)

        for topo in topologies:
            beam_a = topo["beam_a"]
            beam_b = topo["beam_b"]
            detected_topo = topo["detected_topo"]
            pair = beam_a, beam_b
            pair_joined = False

            if detected_topo == JointTopology.TOPO_UNKNOWN:
                continue

            for rule in direct_rules:  # apply direct rules first
                if rule.comply(pair):
                    joints.append(JointDefinition(rule.joint_type, rule.beams, **rule.kwargs))
                    pair_joined = True
                    break

            if not pair_joined:  # if no direct rule applies, apply category rules next
                for rule in cat_rules:
                    if not rule.comply(pair):
                        continue
                    if rule.joint_type.SUPPORTED_TOPOLOGY != detected_topo:
                        msg = "Conflict detected! Beams: {}, {} meet with topology: {} but rule assigns: {}"
                        self.AddRuntimeMessage(
                            Warning,
                            msg.format(
                                beam_a.guid,
                                beam_b.guid,
                                JointTopology.get_name(detected_topo),
                                rule.joint_type.__name__,
                            ),
                        )
                        continue
                    if rule.topos and detected_topo not in rule.topos:
                        msg = "Conflict detected! Beams: {}, {} meet with topology: {} but rule allows: {}"
                        self.AddRuntimeMessage(
                            Warning,
                            msg.format(
                                beam_a.guid,
                                beam_b.guid,
                                JointTopology.get_name(detected_topo),
                                [JointTopology.get_name(topo) for topo in rule.topos],
                            ),
                        )
                        continue
                    # sort by category to allow beam role by order (main beam first, cross beam second)
                    beam_a, beam_b = rule.reorder([beam_a, beam_b])
                    joints.append(JointDefinition(rule.joint_type, [beam_a, beam_b], **rule.kwargs))
                    break  # first matching rule

                else:  # no category rule applies, apply topology rules
                    if detected_topo not in topo_rules:
                        continue
                    else:
                        joints.append(
                            JointDefinition(
                                topo_rules[detected_topo].joint_type,
                                [beam_a, beam_b],
                                **topo_rules[detected_topo].kwargs
                            )
                        )
        return joints

    def RunScript(self, Elements, JointRules, Features, MaxDistance, CreateGeometry):
        if not Elements:
            self.AddRuntimeMessage(Warning, "Input parameter Beams failed to collect data")
        if not JointRules:
            self.AddRuntimeMessage(Warning, "Input parameter JointRules failed to collect data")
        if not (Elements):  # shows beams even if no joints are found
            return
        if MaxDistance is None:
            MaxDistance = TOL.ABSOLUTE  # compared to calculted distance, so shouldn't be just 0.0

        Model = TimberModel()
        debug_info = DebugInfomation()
        for element in Elements:
            # prepare elements for downstream processing
            if element is None:
                continue
            element.remove_features()
            if hasattr(element, "remove_blank_extension"):
                element.remove_blank_extension()
            element.debug_info = []
            Model.add_element(element)

        topologies = []
        solver = ConnectionSolver()
        found_pairs = solver.find_intersecting_pairs(list(Model.beams), rtree=True, max_distance=MaxDistance)
        for pair in found_pairs:
            beam_a, beam_b = pair
            detected_topo, beam_a, beam_b = solver.find_topology(beam_a, beam_b, max_distance=MaxDistance)
            if not detected_topo == JointTopology.TOPO_UNKNOWN:
                topologies.append({"detected_topo": detected_topo, "beam_a": beam_a, "beam_b": beam_b})
        Model.set_topologies(topologies)

        joints = self.get_joints_from_rules(Model.beams, JointRules, topologies)

        if joints:
            handled_beams = []
            joints = [j for j in joints if j is not None]
            # apply reversed. later joints in orginal list override ealier ones
            for joint in joints[::-1]:
                beams_to_pair = joint.beams
                beam_pair_ids = set([id(beam) for beam in beams_to_pair])
                if beam_pair_ids in handled_beams:
                    continue
                try:
                    joint.joint_type.create(Model, *beams_to_pair, **joint.kwargs)
                except BeamJoinningError as bje:
                    debug_info.add_joint_error(bje)
                else:
                    handled_beams.append(beam_pair_ids)

        # applies extensions and features resulting from joints
        Model.process_joinery()

        if Features:
            features = [f for f in Features if f is not None]
            for f_def in features:
                for element in f_def.elements:
                    element.add_features(f_def.feature)

        Geometry = None
        scene = Scene()
        for element in Model.elements():
            if CreateGeometry:
                scene.add(element.geometry)
                if element.debug_info:
                    debug_info.add_feature_error(element.debug_info)
            else:
                scene.add(element.blank)

        if debug_info.has_errors:
            self.AddRuntimeMessage(Warning, "Error found during joint creation. See DebugInfo output for details.")

        Geometry = scene.draw()
        return Model, Geometry, debug_info
# ---------- end model ----------
weave = Weave(Pattern=[0, 1], Stream0=dispatch.ListA, Stream1=dispatch.ListB, NullGaps=False)
pln_7 = Plane(python_3.cross_frames)
pln_8 = Plane(python_3.main_frames)
deplane_2 = DeconstructPlane(Plane=weave)  # -> Origin, XAxis, YAxis, unitize(ZAxis)
pln_9 = Plane(python_3.lap_frame)
brep_5 = Brep(python_3.rg_main)
brep_6 = Brep(python_3.rg_cross)
pln_10 = Plane(python_3.main_ref_side)
brep_7 = Brep(python_3.rg_volume)
pln_11 = Plane(python_3.cutting_plane_main)
pln_12 = Plane(python_3.cross_ref_side)
edges_3 = BrepEdges(Brep=brep_6)  # -> Naked, Interior, NonManifold
item_2 = ListItem(List=pln_10, Index=0, Wrap=True)  # disabled
avr = Average(Input=deplane_2.ZAxis)
volume = Volume(Geometry=brep_7)  # -> Volume, Centroid
item_3 = ListItem(List=pln_9, Index=Slider(0, range=0..10), Wrap=True)  # disabled
dispatch_2 = Dispatch(List=model.Geometry, DispatchPattern=[True, False])  # -> ListA, ListB
vdis_2 = VectorDisplay(Anchor=crvprox.PointA, Vector=expr("x*100", avr))
dprod = DotProduct(VectorA=deplane.ZAxis, VectorB=avr, Unitize=invert(False))
previewlw_3 = CustomPreviewLineweights(Geometry=edges_3.Interior, Shader=ColourSwatch(SwatchColor=RGB(0, 106, 255)), Absolute=False)  # disabled
brep_8 = Brep(python_3.rg_volume_2)
brep_9 = Brep(<brep referenced from the Rhino model>)
brep_10 = Brep([<brep referenced from the Rhino model> x2])
brep_11 = Brep(dispatch_2.ListB)
item_4 = ListItem(List=reverse(model.Geometry), Index=0, Wrap=True)
box = CenterBox(Base=PlaneXY(0, 0, 0), X=1, Y=1, Z=1)
dispatch_3 = Dispatch(List=brep_10, DispatchPattern=[True, False])  # -> ListA, ListB
writebtlx = CTWriteBTLx(Model=model.Model, Path="C:\Users\kapso\OneDrive\Desktop\BTLx\XHalfLapJoint.btlx", Write=Button())  # -> BTLx; inputs Write: Boolean
#   port Model: Model object.
# ---------- writebtlx: Python ----------
import Rhino
from ghpythonlib.componentbase import executingcomponent as component
from Grasshopper.Kernel.GH_RuntimeMessageLevel import Warning

from compas_timber.fabrication import BTLx


class WriteBTLx(component):
    def RunScript(self, model, path, write):
        if not model:
            self.AddRuntimeMessage(Warning, "Input parameter Model failed to collect data")
            return

        btlx = BTLx(model)
        btlx.history["FileName"] = Rhino.RhinoDoc.ActiveDoc.Name

        if write:
            if not path:
                self.AddRuntimeMessage(Warning, "Input parameter Path failed to collect data")
                return
            if path[-5:] != ".btlx":
                path += ".btlx"
            with open(path, "w") as f:
                f.write(btlx.btlx_string())
        return btlx.btlx_string()
# ---------- end writebtlx ----------
panel_2 = Panel(dprod)
pln_13 = Plane(brep_10)
preview = CustomPreview(Geometry=dispatch_2.ListA, Material=ColourSwatch(SwatchColor=RGBA(255, 0, 0, 40)))
preview_2 = CustomPreview(Geometry=dispatch_2.ListB, Material=ColourSwatch(SwatchColor=RGBA(0, 13, 255, 40)))
dispatch_4 = Dispatch(List=pln_13, DispatchPattern=[True, False])  # -> ListA, ListB
twn2srfs = TweenTwoSurfaces(SurfaceA=dispatch_3.ListA, SurfaceB=dispatch_3.ListB, Factor=0.5, Refit=0, PointSample=0)
crv_7 = Curve([<curve referenced from the Rhino model> x12])
panel_3 = Panel(writebtlx)
join = JoinCurves(Curves=crv_7, Preserve=False)
twn2plns = TweenTwoPlanes(PlaneA=dispatch_4.ListA, PlaneB=dispatch_4.ListB, Factor=0.5, Quaternion=True)
boundary = BoundarySurfaces(Edges=graft(join))  # -> flatten(Surfaces)
panel_4 = Panel("1")
item_5 = ListItem(List=reverse(boundary), Index=0, Wrap=True)
pln_14 = Plane(Plane(origin=(32100.60449, -3287.668213, 133.5839566), x=(1, 0, 0), y=(0, 0, -1)))
angle = Angle(VectorA=item_5, VectorB=boundary, Plane=pln_14)  # -> Angle, Reflex
deg = Degrees(Radians=angle.Angle)
panel_5 = Panel(deg)
