# Grasshopper definition test_lap.ghx (Grasshopper 1.0.7)

X = UnitX(Factor=expr("-x", Slider(1000, range=0..4000)))
Y = UnitY(Factor=expr("-x", Slider(0, range=0..4000)))
Z = UnitZ(Factor=Slider(400, range=0..2000))

# ---- group: FLIP
toggle = BooleanToggle(False)

# ----
crv = Curve(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)
end = EndPoints(Curve=crv)  # -> Start, End
addition = Addition(A=X, B=Z, C=Y)
move = Move(Geometry=end.End, Motion=expr("-x", addition))  # -> Geometry, Transform
ln = Line(StartPoint=end.Start, EndPoint=move.Geometry)

# ---- group: FLIP
toggle_2 = BooleanToggle(False)

# ---- group: CrossBeam
crv_2 = Curve(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)

# ----
flip = FlipCurve(Curve=ln)  # -> Curve, Flag

flip_2 = FlipCurve(Curve=crv_2)  # -> Curve, Flag
filter = StreamFilter(Gate=toggle_2, Stream0=crv_2, Stream1=flip_2.Curve)

filter_2 = StreamFilter(Gate=toggle, Stream0=ln, Stream1=flip.Curve)
crv_3 = Curve([<curve referenced from the Rhino model> x5])
crv_4 = Curve(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)
line = Line(filter)
line_2 = Line(crv_3)
crvprox = CurveProximity(CurveA=line, CurveB=line_2)  # -> PointA, PointB, Distance
xprod = CrossProduct(VectorA=line, VectorB=line_2, Unitize=False)  # -> Vector, Length
vdis = VectorDisplay(Anchor=crvprox.PointA, Vector=expr("x*100", xprod.Vector))
number_slider = Slider(10, range=0..100)
beam = CTBeam(Centerline=line_2, Width=Slider(80, range=0..100), Height=Slider(100, range=0..100))  # -> Beam, Blank; inputs Centerline: list, ZVector: list of Vector3d, Width: list, Height: list, Category: list, updateRefObj: Boolean
#   port Centerline: Referenced curve or line, Guid of curve or line in the active Rhino document.
#   port ZVector: Vector defining the orientation of the cross-section (corresponds to the height dimension). If None, a default will be taken.
#   port Width: Width of the cross-section (usually the smaller dimension).
#   port Height: Height of the cross-section (usually the larger dimension).
#   port Category: Category of a beam.
#   port updateRefObj: (optional) If True, the attributes in the referenced object will be updated/overwritten with the new values given here.
#   port Beam: Beam object(s).
#   port Blank: Shape of the beam's blank.
# ---------- beam: Python ----------
"""Creates a Beam from a LineCurve."""

import rhinoscriptsyntax as rs
from compas.scene import Scene
from compas_rhino.conversions import line_to_compas
from compas_rhino.conversions import vector_to_compas
from ghpythonlib.componentbase import executingcomponent as component
from Grasshopper.Kernel.GH_RuntimeMessageLevel import Error
from Grasshopper.Kernel.GH_RuntimeMessageLevel import Warning
from Rhino.RhinoDoc import ActiveDoc

from compas_timber.elements import Beam as CTBeam
from compas_timber.ghpython.rhino_object_name_attributes import update_rhobj_attributes_name


class Beam_fromCurve(component):
    def RunScript(self, centerline, z_vector, width, height, category, updateRefObj):
        # minimum inputs required
        if not centerline:
            self.AddRuntimeMessage(Warning, "Input parameter 'Centerline' failed to collect data")
        if not width:
            length = self._get_centerline_length(centerline)
            width = [length / 20]
        if not height:
            length = self._get_centerline_length(centerline)
            height = [length / 10]

        # reformat unset parameters for consistency
        if not z_vector:
            z_vector = [None]
        if not category:
            category = [None]

        beams = []
        blanks = []
        scene = Scene()

        if centerline and height and width:
            # check list lengths for consistency
            N = len(centerline)
            if len(z_vector) not in (0, 1, N):
                self.AddRuntimeMessage(
                    Error, " In 'ZVector' I need either none, one or the same number of inputs as the Crv parameter."
                )
            if len(width) not in (1, N):
                self.AddRuntimeMessage(
                    Error, " In 'W' I need either one or the same number of inputs as the Crv parameter."
                )
            if len(height) not in (1, N):
                self.AddRuntimeMessage(
                    Error, " In 'H' I need either one or the same number of inputs as the Crv parameter."
                )
            if len(category) not in (0, 1, N):
                self.AddRuntimeMessage(
                    Error, " In 'Category' I need either none, one or the same number of inputs as the Crv parameter."
                )

            # duplicate data if None or single value
            if len(z_vector) != N:
                z_vector = [z_vector[0] for _ in range(N)]
            if len(width) != N:
                width = [width[0] for _ in range(N)]
            if len(height) != N:
                height = [height[0] for _ in range(N)]
            if len(category) != N:
                category = [category[0] for _ in range(N)]

            for line, z, w, h, c in zip(centerline, z_vector, width, height, category):
                guid, geometry = self._get_guid_and_geometry(line)
                rhino_line = rs.coerceline(geometry)
                line = line_to_compas(rhino_line)

                z = vector_to_compas(z) if z else None
                beam = CTBeam.from_centerline(centerline=line, width=w, height=h, z_vector=z)
                beam.attributes["rhino_guid"] = str(guid) if guid else None
                beam.attributes["category"] = c
                print(guid)
                if updateRefObj and guid:
                    update_rhobj_attributes_name(guid, "width", str(w))
                    update_rhobj_attributes_name(guid, "height", str(h))
                    update_rhobj_attributes_name(guid, "zvector", str(list(beam.frame.zaxis)))
                    update_rhobj_attributes_name(guid, "category", c)

                beams.append(beam)
                scene.add(beam.blank)

        blanks = scene.draw()

        return beams, blanks

    def _get_guid_and_geometry(self, line):
        # internalized curves and GH geometry will not have persistent GUIDs, referenced Rhino objects will
        # type hint on the input has to be 'ghdoc' for this to work
        guid = None
        geometry = line
        rhino_obj = ActiveDoc.Objects.FindId(line)
        if rhino_obj:
            guid = line
            geometry = rhino_obj.Geometry
        return guid, geometry

    def _get_centerline_length(self, centerline):
        centerline_length = []
        for i in centerline:
            centerline_length.append(rs.CurveLength(i))
        if centerline_length:
            length_average = sum(centerline_length) / len(centerline_length)
        else:
            length_average = 1
        return length_average
# ---------- end beam ----------
beam_2 = CTBeam(Centerline=line, Width=Slider(100, range=0..100), Height=Slider(120, range=0..120))  # -> Beam, Blank; inputs Centerline: list, ZVector: list of Vector3d, Width: list, Height: list, Category: list, updateRefObj: Boolean; same code as beam
panel = Panel("(Plane(point=Point(x=31368.7159714, y=-3208.03599534, z=79.6373011489), normal=Vector(x=-1.0, y=0.0, z=0.0)), Line(Point(x=30396.1444398, y=-3207.66821289, z=13.5839565671), Point(x=30397.1444398, y=-3207.66821289, z=13.5839565671)))")
panel_2 = Panel("(Plane(point=Point(x=31368.7159714, y=-3307.30043045, z=67.5306119852), normal=Vector(x=0.0, y=-0.992644351089, z=-0.121066891638)), Line(Point(x=30396.1444398, y=-3207.66821289, z=23.5839565671), Point(x=30397.1444398, y=-3207.66821289, z=23.5839565671)))")
t_topo_joint = CTTTopologicalJointRules(mill_depth=number_slider)  # -> TButtJoint
# ---------- t_topo_joint: Python ----------
import inspect

from ghpythonlib.componentbase import executingcomponent as component
from Grasshopper.Kernel.GH_RuntimeMessageLevel import Warning

from compas_timber.connections import Joint
from compas_timber.connections import JointTopology
from compas_timber.connections import TButtJoint
from compas_timber.design import TopologyRule
from compas_timber.ghpython.ghcomponent_helpers import get_leaf_subclasses
from compas_timber.ghpython.ghcomponent_helpers import manage_dynamic_params
from compas_timber.ghpython.ghcomponent_helpers import rename_gh_output


class T_TopologyJointRule(component):
    def __init__(self):
        super(T_TopologyJointRule, self).__init__()
        self.classes = {}
        for cls in get_leaf_subclasses(Joint):
            if cls.SUPPORTED_TOPOLOGY == JointTopology.TOPO_T:
                self.classes[cls.__name__] = cls
        if ghenv.Component.Params.Output[0].NickName == "Rule":
            self.joint_type = TButtJoint
            self.clicked = False
        else:
            self.joint_type = self.classes.get(ghenv.Component.Params.Output[0].NickName, None)
            self.clicked = True

    def RunScript(self, *args):
        if not self.clicked:
            ghenv.Component.Message = "Default: TButtJoint"
            self.AddRuntimeMessage(Warning, "TButtJoint is default, change in context menu (right click)")
            return TopologyRule(JointTopology.TOPO_T, TButtJoint)
        else:
            ghenv.Component.Message = self.joint_type.__name__
            kwargs = {}
            for i, val in enumerate(args):
                if val is not None:
                    kwargs[self.arg_names()[i]] = val
            if self.joint_type.SUPPORTED_TOPOLOGY != JointTopology.TOPO_T:
                self.AddRuntimeMessage(Warning, "Joint type does not match topology. Joint may not be generated.")
            return TopologyRule(JointTopology.TOPO_T, self.joint_type, **kwargs)

    def arg_names(self):
        names = inspect.getargspec(self.joint_type.__init__)[0][3:]
        return [name for name in names if (name != "key") and (name != "frame")]

    def AppendAdditionalMenuItems(self, menu):
        for name in self.classes.keys():
            item = menu.Items.Add(name, None, self.on_item_click)
            if self.joint_type and name == self.joint_type.__name__:
                item.Checked = True

    def on_item_click(self, sender, event_info):
        self.clicked = True
        self.joint_type = self.classes[str(sender)]
        rename_gh_output(self.joint_type.__name__, 0, ghenv)
        manage_dynamic_params(self.arg_names(), ghenv, rename_count=0, permanent_param_count=0)
        ghenv.Component.ExpireSolution(True)
# ---------- end t_topo_joint ----------
l_topo_joint = CTLTopologicalJointRules()  # -> LMiterJoint
# ---------- l_topo_joint: Python ----------
import inspect

from ghpythonlib.componentbase import executingcomponent as component
from Grasshopper.Kernel.GH_RuntimeMessageLevel import Warning

from compas_timber.connections import Joint
from compas_timber.connections import JointTopology
from compas_timber.connections import LMiterJoint
from compas_timber.design import TopologyRule
from compas_timber.ghpython.ghcomponent_helpers import get_leaf_subclasses
from compas_timber.ghpython.ghcomponent_helpers import manage_dynamic_params
from compas_timber.ghpython.ghcomponent_helpers import rename_gh_output


class L_TopologyJointRule(component):
    def __init__(self):
        super(L_TopologyJointRule, self).__init__()
        self.classes = {}
        for cls in get_leaf_subclasses(Joint):
            if cls.SUPPORTED_TOPOLOGY == JointTopology.TOPO_L:
                self.classes[cls.__name__] = cls
        if ghenv.Component.Params.Output[0].NickName == "Rule":
            self.joint_type = LMiterJoint
            self.clicked = False
        else:
            self.joint_type = self.classes.get(ghenv.Component.Params.Output[0].NickName, None)
            self.clicked = True

    def RunScript(self, *args):
        if not self.clicked:
            ghenv.Component.Message = "Default: LMiterJoint"
            self.AddRuntimeMessage(Warning, "LMiterJoint is default, change in context menu (right click)")
            return TopologyRule(JointTopology.TOPO_L, LMiterJoint)
        else:
            ghenv.Component.Message = self.joint_type.__name__
            kwargs = {}
            for i, val in enumerate(args):
                if val is not None:
                    kwargs[self.arg_names()[i]] = val
            if self.joint_type.SUPPORTED_TOPOLOGY != JointTopology.TOPO_L:
                self.AddRuntimeMessage(Warning, "Joint type does not match topology. Joint may not be generated.")
            return TopologyRule(JointTopology.TOPO_L, self.joint_type, **kwargs)

    def arg_names(self):
        names = inspect.getargspec(self.joint_type.__init__)[0][3:]
        return [name for name in names if (name != "key") and (name != "frame")]

    def AppendAdditionalMenuItems(self, menu):
        for name in self.classes.keys():
            item = menu.Items.Add(name, None, self.on_item_click)
            if self.joint_type and name == self.joint_type.__name__:
                item.Checked = True

    def on_item_click(self, sender, event_info):
        self.clicked = True
        self.joint_type = self.classes[str(sender)]
        rename_gh_output(self.joint_type.__name__, 0, ghenv)
        manage_dynamic_params(self.arg_names(), ghenv, rename_count=0, permanent_param_count=0)
        ghenv.Component.ExpireSolution(True)
# ---------- end l_topo_joint ----------
python = GhPythonScript(main_beam=beam.Beam, cross_beam=beam_2.Beam, depth=number_slider)  # -> out, main_ref_sides, cross_ref_side, rg_cross, rg_main, cutting_plane_main, rg_volume
# ---------- python: Python ----------
from compas_timber._fabrication import Lap
from compas_timber._fabrication import JackRafterCut
from compas_timber.connections.utilities import beam_ref_side_incidence
from compas_rhino.conversions import frame_to_rhino, brep_to_rhino, plane_to_rhino
from compas_rhino import unload_modules

unload_modules('compas_timber')

#cross
cross_ref_side_dict = beam_ref_side_incidence(main_beam, cross_beam, ignore_ends=True)
cross_ref_side_index = min(cross_ref_side_dict, key=cross_ref_side_dict.get)
print(cross_ref_side_index)
# main 
main_ref_side_dict = beam_ref_side_incidence(cross_beam, main_beam, ignore_ends=True)
main_ref_side_index = min(main_ref_side_dict, key=main_ref_side_dict.get)
main_ref_side_indices = [main_ref_side_index, (main_ref_side_index+2)%4]
main_planes = [main_beam.ref_sides[i] for i in main_ref_side_indices]
print(main_planes)

# instanciate lap processing from plane and beam
lap = Lap.from_two_planes_and_beam(main_planes, cross_beam, depth, cross_ref_side_index)
volume = lap.volume_from_params_and_beam(cross_beam)
cross_geo = cross_beam.compute_geometry()
cross_geo = lap.apply(cross_geo, cross_beam)


# get cutting plane for JackRafterCut processing
cross_plane = cross_beam.ref_sides[cross_ref_side_index]
cross_plane.xaxis = -cross_plane.xaxis
cross_plane.translate(cross_plane.normal*depth)
# instanciate jack cut processing
jack_cut = JackRafterCut.from_plane_and_beam(cross_plane, main_beam, main_ref_side_index)
cutting_plane_main = jack_cut.plane_from_params_and_beam(main_beam)
main_geo = main_beam.compute_geometry()
main_geo = jack_cut.apply(main_geo, main_beam)


# viz frames
cross_ref_side = frame_to_rhino(cross_beam.ref_sides[cross_ref_side_index])
main_ref_side = frame_to_rhino(main_beam.ref_sides[main_ref_side_index])
main_ref_sides = [frame_to_rhino(main_beam.ref_sides[i]) for i in main_ref_side_indices]
cutting_plane_main = plane_to_rhino(cutting_plane_main)
# viz volumes
rg_cross = brep_to_rhino(cross_geo)
rg_main = brep_to_rhino(main_geo)
#rg_volume = brep_to_rhino(volume)
# ---------- end python ----------
panel_3 = Panel(python.out)
xprod_2 = CrossProduct(Unitize=False)  # -> Vector, Length
model = CTModel(
    Elements=flatten([beam_2.Beam, beam.Beam]),
    JointRules=flatten([t_topo_joint, l_topo_joint]),
    CreateGeometry=Toggle(True))  # -> Model, Geometry, DebugInfo; inputs Elements: list, JointRules: list, Features: list, CreateGeometry: Boolean
#   port Elements: Collection of Beams
# ---------- model: Python ----------
from compas.scene import Scene
from compas.tolerance import TOL
from ghpythonlib.componentbase import executingcomponent as component
from Grasshopper.Kernel.GH_RuntimeMessageLevel import Warning

from compas_timber.connections import BeamJoinningError
from compas_timber.connections import ConnectionSolver
from compas_timber.connections import JointTopology
from compas_timber.connections import LMiterJoint
from compas_timber.connections import TButtJoint
from compas_timber.connections import XHalfLapJoint
from compas_timber.design import CategoryRule
from compas_timber.design import DebugInfomation
from compas_timber.design import DirectRule
from compas_timber.design import JointDefinition
from compas_timber.design import TopologyRule
from compas_timber.model import TimberModel

JOINT_DEFAULTS = {
    JointTopology.TOPO_X: XHalfLapJoint,
    JointTopology.TOPO_T: TButtJoint,
    JointTopology.TOPO_L: LMiterJoint,
}


# workaround for https://github.com/gramaziokohler/compas_timber/issues/280
TOL.absolute = 1e-6


class ModelComponent(component):
    def get_joints_from_rules(self, beams, rules, topologies):
        if not isinstance(rules, list):
            rules = [rules]
        rules = [r for r in rules if r is not None]

        joints = []
        # rules have to be resolved into joint definitions
        topo_rules = {}
        cat_rules = []
        direct_rules = []

        # TODO: refactor this into some kind of a rule reloving class/function
        for r in rules:  # separate category and topo and direct joint rules
            if isinstance(r, TopologyRule):
                if topo_rules.get(r.topology_type, None):  # if rule for this Topo exists
                    if (r.joint_type != JOINT_DEFAULTS[r.topology_type]) or (
                        len(r.kwargs) != 0
                    ):  # if this rule is NOT default
                        topo_rules[r.topology_type] = r
                else:
                    topo_rules[r.topology_type] = r
            elif isinstance(r, CategoryRule):
                cat_rules.append(r)
            if isinstance(r, DirectRule):
                direct_rules.append(r)

        for topo in topologies:
            beam_a = topo["beam_a"]
            beam_b = topo["beam_b"]
            detected_topo = topo["detected_topo"]
            pair = beam_a, beam_b
            pair_joined = False

            if detected_topo == JointTopology.TOPO_UNKNOWN:
                continue

            for rule in direct_rules:  # apply direct rules first
                if rule.comply(pair):
                    joints.append(JointDefinition(rule.joint_type, rule.beams, **rule.kwargs))
                    pair_joined = True
                    break

            if not pair_joined:  # if no direct rule applies, apply category rules next
                for rule in cat_rules:
                    if not rule.comply(pair):
                        continue
                    if rule.joint_type.SUPPORTED_TOPOLOGY != detected_topo:
                        msg = "Conflict detected! Beams: {}, {} meet with topology: {} but rule assigns: {}"
                        self.AddRuntimeMessage(
                            Warning,
                            msg.format(
                                beam_a.guid,
                                beam_b.guid,
                                JointTopology.get_name(detected_topo),
                                rule.joint_type.__name__,
                            ),
                        )
                        continue
                    if rule.topos and detected_topo not in rule.topos:
                        msg = "Conflict detected! Beams: {}, {} meet with topology: {} but rule allows: {}"
                        self.AddRuntimeMessage(
                            Warning,
                            msg.format(
                                beam_a.guid,
                                beam_b.guid,
                                JointTopology.get_name(detected_topo),
                                [JointTopology.get_name(topo) for topo in rule.topos],
                            ),
                        )
                        continue
                    # sort by category to allow beam role by order (main beam first, cross beam second)
                    beam_a, beam_b = rule.reorder([beam_a, beam_b])
                    joints.append(JointDefinition(rule.joint_type, [beam_a, beam_b], **rule.kwargs))
                    break  # first matching rule

                else:  # no category rule applies, apply topology rules
                    if detected_topo not in topo_rules:
                        continue
                    else:
                        joints.append(
                            JointDefinition(
                                topo_rules[detected_topo].joint_type,
                                [beam_a, beam_b],
                                **topo_rules[detected_topo].kwargs
                            )
                        )
        return joints

    def RunScript(self, Elements, JointRules, Features, MaxDistance, CreateGeometry):
        if not Elements:
            self.AddRuntimeMessage(Warning, "Input parameter Beams failed to collect data")
        if not JointRules:
            self.AddRuntimeMessage(Warning, "Input parameter JointRules failed to collect data")
        if not (Elements):  # shows beams even if no joints are found
            return
        if MaxDistance is None:
            MaxDistance = TOL.ABSOLUTE  # compared to calculted distance, so shouldn't be just 0.0

        Model = TimberModel()
        debug_info = DebugInfomation()
        for element in Elements:
            # prepare elements for downstream processing
            if element is None:
                continue
            element.remove_features()
            if hasattr(element, "remove_blank_extension"):
                element.remove_blank_extension()
            element.debug_info = []
            Model.add_element(element)

        topologies = []
        solver = ConnectionSolver()
        found_pairs = solver.find_intersecting_pairs(list(Model.beams), rtree=True, max_distance=MaxDistance)
        for pair in found_pairs:
            beam_a, beam_b = pair
            detected_topo, beam_a, beam_b = solver.find_topology(beam_a, beam_b, max_distance=MaxDistance)
            if not detected_topo == JointTopology.TOPO_UNKNOWN:
                topologies.append({"detected_topo": detected_topo, "beam_a": beam_a, "beam_b": beam_b})
        Model.set_topologies(topologies)

        joints = self.get_joints_from_rules(Model.beams, JointRules, topologies)

        if joints:
            handled_beams = []
            joints = [j for j in joints if j is not None]
            # apply reversed. later joints in orginal list override ealier ones
            for joint in joints[::-1]:
                beams_to_pair = joint.beams
                beam_pair_ids = set([id(beam) for beam in beams_to_pair])
                if beam_pair_ids in handled_beams:
                    continue
                try:
                    joint.joint_type.create(Model, *beams_to_pair, **joint.kwargs)
                except BeamJoinningError as bje:
                    debug_info.add_joint_error(bje)
                else:
                    handled_beams.append(beam_pair_ids)

        # applies extensions and features resulting from joints
        Model.process_joinery()

        if Features:
            features = [f for f in Features if f is not None]
            for f_def in features:
                for element in f_def.elements:
                    element.add_features(f_def.feature)

        Geometry = None
        scene = Scene()
        for element in Model.elements():
            if CreateGeometry:
                scene.add(element.geometry)
                if element.debug_info:
                    debug_info.add_feature_error(element.debug_info)
            else:
                scene.add(element.blank)

        if debug_info.has_errors:
            self.AddRuntimeMessage(Warning, "Error found during joint creation. See DebugInfo output for details.")

        Geometry = scene.draw()
        return Model, Geometry, debug_info
# ---------- end model ----------
brep = Brep(python.rg_main)  # disabled
brep_2 = Brep(python.rg_cross)  # disabled
pln = Plane(python.main_ref_sides)  # disabled
item = ListItem(List=pln, Index=0, Wrap=True)
pln_2 = Plane(python.cutting_plane_main)  # disabled
brep_3 = Brep(python.rg_volume)  # disabled
pln_3 = Plane(python.cross_ref_side)  # disabled
deplane = DeconstructPlane(Plane=PlaneXY(0, 0, 0))  # -> Origin, XAxis, YAxis, ZAxis
deplane_2 = DeconstructPlane(Plane=item)  # -> Origin, XAxis, YAxis, ZAxis
deplane_3 = DeconstructPlane(Plane=pln_3)  # -> Origin, XAxis, YAxis, ZAxis
sdiff = SolidDifference(BrepsA=beam.Blank, BrepsB=python.rg_cross)
item_2 = ListItem(List=model.Geometry, Index=0, Wrap=True)
xprod_3 = CrossProduct(VectorA=deplane_2.YAxis, VectorB=deplane_3.ZAxis, Unitize=False)  # -> Vector, Length
angle = Angle(VectorA=xprod_3.Vector, VectorB=deplane_2.XAxis)  # -> Angle, Reflex
xprod_4 = CrossProduct(VectorA=deplane_2.ZAxis, VectorB=deplane_3.ZAxis, Unitize=False)  # -> Vector, Length
vdis_2 = VectorDisplay(Anchor=pln_2, Vector=expr("x*100", [xprod_3.Vector, deplane_2.XAxis, deplane_2.YAxis]))
deg = Degrees(Radians=angle.Angle)
panel_5 = Panel(deg)
writebtlx = CTWriteBTLx(Model=model.Model, Path="C:\Users\kapso\OneDrive\Desktop\BTLx\TButtJoint.btlx", Write=Toggle(True))  # -> BTLx; inputs Write: Boolean
#   port Model: Model object.
# ---------- writebtlx: Python ----------
import Rhino
from ghpythonlib.componentbase import executingcomponent as component
from Grasshopper.Kernel.GH_RuntimeMessageLevel import Warning

from compas_timber.fabrication import BTLx


class WriteBTLx(component):
    def RunScript(self, model, path, write):
        if not model:
            self.AddRuntimeMessage(Warning, "Input parameter Model failed to collect data")
            return

        btlx = BTLx(model)
        btlx.history["FileName"] = Rhino.RhinoDoc.ActiveDoc.Name

        if write:
            if not path:
                self.AddRuntimeMessage(Warning, "Input parameter Path failed to collect data")
                return
            if path[-5:] != ".btlx":
                path += ".btlx"
            with open(path, "w") as f:
                f.write(btlx.btlx_string())
        return btlx.btlx_string()
# ---------- end writebtlx ----------
angle_2 = Angle(VectorA=xprod_4.Vector, VectorB=deplane_2.XAxis)  # -> Angle, Reflex
vdis_3 = VectorDisplay(Anchor=pln_2, Vector=expr("x*100", [xprod_4.Vector, deplane_2.XAxis]))
angle_3 = Angle(VectorA=deplane_2.ZAxis, VectorB=deplane_3.ZAxis)  # -> Angle, Reflex
pi = Pi(Factor=1)
deg_2 = Degrees(Radians=angle_2.Angle)
deg_3 = Degrees(Radians=angle_3.Angle)
multiplication = Multiplication(A="180", B=angle.Angle)
division = Division(A=multiplication, B=pi)
subtraction = Subtraction(A="180", B=deg_2)
subtraction_2 = Subtraction(A="180", B=deg_3)
panel_6 = Panel(subtraction)
deg_4 = Degrees(Radians=division)
panel_7 = Panel(subtraction_2)
panel_8 = Panel(deg_4)
