# Grasshopper definition test_tenon_mortise_joint.ghx (Grasshopper 1.0.7)

# ---- group: MainBeam
X = UnitX(Factor=Slider(0, range=0..4000))
Z = UnitZ(Factor=Slider(500, range=0..2000))
Y = UnitY(Factor=Slider(0, range=0..4000))

crv = Curve(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)
end = EndPoints(Curve=crv)  # -> Start, End
addition = Addition(A=X, B=Z, C=Y)
move = Move(Geometry=end.End, Motion=addition)  # -> Geometry, Transform
ln = Line(StartPoint=end.Start, EndPoint=move.Geometry)

# ----
crv_2 = Curve([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])

# ---- group: CrossBeam
crv_3 = Curve(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)

# ----
flipcurve = BooleanToggle(False)
crv_4 = Curve(crv_3)

flipcurve_2 = BooleanToggle(False)
crv_5 = Curve(ln)

flip = FlipCurve(Curve=crv_4)  # -> Curve, Flag
filter = StreamFilter(Gate=flipcurve, Stream0=crv_4, Stream1=flip.Curve)
flip_2 = FlipCurve(Curve=crv_5)  # -> Curve, Flag
offset = BooleanToggle(False)
filter_2 = StreamFilter(Gate=flipcurve_2, Stream0=crv_5, Stream1=flip_2.Curve)
cluster = Cluster_2(A=filter, line=filter_2, bool=offset, bool_2=flipcurve_2)  # -> s_0_2, s_0
beam = CTBeam(Centerline=filter, Width=Slider(60, range=0..100), Height=Slider(120, range=0..1000))  # -> Beam, Blank; inputs Centerline: list, ZVector: list of Vector3d, Width: list, Height: list, Category: list, updateRefObj: Boolean
#   port Centerline: Referenced curve or line, Guid of curve or line in the active Rhino document.
#   port ZVector: Vector defining the orientation of the cross-section (corresponds to the height dimension). If None, a default will be taken.
#   port Width: Width of the cross-section (usually the smaller dimension).
#   port Height: Height of the cross-section (usually the larger dimension).
#   port Category: Category of a beam.
#   port updateRefObj: (optional) If True, the attributes in the referenced object will be updated/overwritten with the new values given here.
#   port Beam: Beam object(s).
#   port Blank: Shape of the beam's blank.
# ---------- beam: Python ----------
"""Creates a Beam from a LineCurve."""

import rhinoscriptsyntax as rs
from compas.scene import Scene
from compas_rhino.conversions import line_to_compas
from compas_rhino.conversions import vector_to_compas
from ghpythonlib.componentbase import executingcomponent as component
from Grasshopper.Kernel.GH_RuntimeMessageLevel import Error
from Grasshopper.Kernel.GH_RuntimeMessageLevel import Warning
from Rhino.RhinoDoc import ActiveDoc

from compas_timber.elements import Beam as CTBeam
from compas_timber.ghpython.rhino_object_name_attributes import update_rhobj_attributes_name


class Beam_fromCurve(component):
    def RunScript(self, centerline, z_vector, width, height, category, updateRefObj):
        # minimum inputs required
        if not centerline:
            self.AddRuntimeMessage(Warning, "Input parameter 'Centerline' failed to collect data")
        if not width:
            length = self._get_centerline_length(centerline)
            width = [length / 20]
        if not height:
            length = self._get_centerline_length(centerline)
            height = [length / 10]

        # reformat unset parameters for consistency
        if not z_vector:
            z_vector = [None]
        if not category:
            category = [None]

        beams = []
        blanks = []
        scene = Scene()

        if centerline and height and width:
            # check list lengths for consistency
            N = len(centerline)
            if len(z_vector) not in (0, 1, N):
                self.AddRuntimeMessage(
                    Error, " In 'ZVector' I need either none, one or the same number of inputs as the Crv parameter."
                )
            if len(width) not in (1, N):
                self.AddRuntimeMessage(
                    Error, " In 'W' I need either one or the same number of inputs as the Crv parameter."
                )
            if len(height) not in (1, N):
                self.AddRuntimeMessage(
                    Error, " In 'H' I need either one or the same number of inputs as the Crv parameter."
                )
            if len(category) not in (0, 1, N):
                self.AddRuntimeMessage(
                    Error, " In 'Category' I need either none, one or the same number of inputs as the Crv parameter."
                )

            # duplicate data if None or single value
            if len(z_vector) != N:
                z_vector = [z_vector[0] for _ in range(N)]
            if len(width) != N:
                width = [width[0] for _ in range(N)]
            if len(height) != N:
                height = [height[0] for _ in range(N)]
            if len(category) != N:
                category = [category[0] for _ in range(N)]

            for line, z, w, h, c in zip(centerline, z_vector, width, height, category):
                guid, geometry = self._get_guid_and_geometry(line)
                rhino_line = rs.coerceline(geometry)
                line = line_to_compas(rhino_line)

                z = vector_to_compas(z) if z else None
                beam = CTBeam.from_centerline(centerline=line, width=w, height=h, z_vector=z)
                beam.attributes["rhino_guid"] = str(guid) if guid else None
                beam.attributes["category"] = c
                print(guid)
                if updateRefObj and guid:
                    update_rhobj_attributes_name(guid, "width", str(w))
                    update_rhobj_attributes_name(guid, "height", str(h))
                    update_rhobj_attributes_name(guid, "zvector", str(list(beam.frame.zaxis)))
                    update_rhobj_attributes_name(guid, "category", c)

                beams.append(beam)
                scene.add(beam.blank)

        blanks = scene.draw()

        return beams, blanks

    def _get_guid_and_geometry(self, line):
        # internalized curves and GH geometry will not have persistent GUIDs, referenced Rhino objects will
        # type hint on the input has to be 'ghdoc' for this to work
        guid = None
        geometry = line
        rhino_obj = ActiveDoc.Objects.FindId(line)
        if rhino_obj:
            guid = line
            geometry = rhino_obj.Geometry
        return guid, geometry

    def _get_centerline_length(self, centerline):
        centerline_length = []
        for i in centerline:
            centerline_length.append(rs.CurveLength(i))
        if centerline_length:
            length_average = sum(centerline_length) / len(centerline_length)
        else:
            length_average = 1
        return length_average
# ---------- end beam ----------
beam_2 = CTBeam(Centerline=cluster.s_0, ZVector=cluster.s_0_2, Width=Slider(80, range=0..100), Height=Slider(100, range=0..100))  # -> Beam, Blank; inputs Centerline: list, ZVector: list of Vector3d, Width: list, Height: list, Category: list, updateRefObj: Boolean; same code as beam

number_slider = Slider(10, range=0..100)  # disabled
number_slider_2 = Slider(20, range=0..100)  # disabled
list = ValueList({"Automatic": 0, "Square": 1, "Round": 2, "Rounded": 3, "Radius": 4}, selected="Radius")  # disabled
rotation = Slider(20, range=0..100)  # disabled
length = Slider(60, range=0..200)  # disabled
cone_angle = Slider(10, range=0..100)  # disabled
width = Slider(25, range=0..200)  # disabled

number_slider_3 = Slider(15, range=0..100)  # disabled
number_slider_4 = Slider(60, range=0..100)  # disabled
number_slider_5 = Slider(28, range=0..100)  # disabled

width_2 = Slider(44, range=0..200)
length_2 = Slider(55, range=0..200)

neg = Negative(Value=rotation)  # disabled
neg_2 = Negative(Value=Slider(0, range=0..200))

# ----
# DovetailTenon/Mortise
python = GhPythonScript(
    cross_beam=beam.Beam,
    main_beam=beam_2.Beam,
    start_depth=Slider(0, range=-10..10),
    width=width_2,
    length=length_2,
    start_y=Slider(0, range=-10..10),
    rotation=neg_2,
    shape_radius=Slider(20, range=0..20))  # -> out, cutting_plane_tenon, cutting_plane_mortise, ref_side_main, ref_side_cross, mortise_btlx_params, tenon_btlx_params, tenon_params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
# ---------- python: Python ----------
from compas_rhino.conversions import surface_to_rhino
from compas_timber._fabrication import Tenon
from compas_timber._fabrication import TenonParams
from compas_timber._fabrication import DovetailMortise
from compas_timber._fabrication import DovetailMortiseParams

from compas_timber.connections import Joint
from compas_timber.connections.utilities import beam_ref_side_incidence, beam_ref_side_incidence_with_vector, beam_ref_side_incidence_cross

from compas_timber.model import TimberModel
from compas_timber.fabrication import BTLx

from compas.geometry import Point, intersection_line_line, angle_vectors, angle_vectors_signed

from compas_rhino import unload_modules
from compas.scene import SceneObject

import math

from compas_rhino.conversions import frame_to_rhino, plane_to_rhino, vector_to_rhino, surface_to_rhino, polyline_to_rhino, brep_to_rhino, point_to_rhino, surface_to_rhino

import Rhino.Geometry as rg
unload_modules("compas_timber")

geo_tenon = main_beam.compute_geometry(False)
geo_mortise = cross_beam.compute_geometry(False)

#define ref_sides
cross_ref_side_dict = beam_ref_side_incidence(main_beam, cross_beam, ignore_ends=True)
cross_ref_side_index = min(cross_ref_side_dict, key=cross_ref_side_dict.get)
print(cross_ref_side_index, "cross")

vector = cross_beam.ref_sides[cross_ref_side_index].yaxis
main_ref_side_dict = beam_ref_side_incidence_with_vector(main_beam,vector, ignore_ends=True)
main_ref_side_index = min(main_ref_side_dict, key=main_ref_side_dict.get)
print(main_ref_side_index, "main")

ref_side_main = frame_to_rhino(main_beam.ref_sides[main_ref_side_index])
ref_side_cross = frame_to_rhino(cross_beam.ref_sides[cross_ref_side_index])

#cross_vect = vector_to_rhino(cross_vect)

#create dovetail_tenon
tenon = Tenon.from_plane_and_beam(
            cross_beam.ref_sides[cross_ref_side_index], 
            main_beam, 
            start_y=start_y, 
            rotation=rotation, 
            start_depth=start_depth, 
            width=width, 
            length=length,
            shape = 'round',
            shape_radius = shape_radius,
            ref_side_index=main_ref_side_index,
        )
        
#cutting_frame
cutting_plane_tenon= tenon.frame_from_params_and_beam(main_beam)
#tenon cutting planes
#tenon volume
tenon_volume = tenon.volume_from_params_and_beam(main_beam)


#dovetail_mortise = DovetailMortise.from_frame_and_beam(
#            frame=cutting_plane_tenon,
#            beam=cross_beam,
#            start_depth=0.0,
#            angle=rotation,
#            length=dovetail_tenon.length,
#            width=dovetail_tenon.width,
#            depth=dovetail_tenon.height,
#            cone_angle=dovetail_tenon.cone_angle,
#            flank_angle=dovetail_tenon.flank_angle,
#            shape=dovetail_tenon.shape,
#            shape_radius=dovetail_tenon.shape_radius,
#            ref_side_index=cross_ref_side_index,
#        )
##cutting frame
#cutting_plane_mortise = dovetail_mortise.frame_from_params_and_beam(cross_beam)
##mortise cutting planes
#dovetail_mortise_planes = dovetail_mortise.dovetail_cutting_frames_from_params_and_beam(cross_beam)
##mortise volue
##mortise_volume = dovetail_mortise.dovetail_volume_from_params_and_beam(cross_beam)
#
##get btlx params
#dovetail_mortise_params = DovetailMortiseParams(dovetail_mortise).as_dict()
#mortise_btlx_params = []
#for key, value in dovetail_mortise_params.items():
#    mortise_btlx_params.append("{0}: {1}".format(key, value))

#get btlx params
tenon_params = TenonParams(tenon).as_dict()
tenon_btlx_params = []
for key, value in tenon_params.items():
    tenon_btlx_params.append("{0}: {1}".format(key, value))


#vizualize in rhino

cutting_plane_tenon = frame_to_rhino(cutting_plane_tenon)
#cutting_plane_mortise = frame_to_rhino(cutting_plane_mortise)

geo_tenon = brep_to_rhino(tenon_volume)
geo_main = brep_to_rhino(tenon.apply(main_beam.compute_geometry(), main_beam))
#geo_mortise = brep_to_rhino(dovetail_mortise.apply(geo_mortise, cross_beam))
# ---------- end python ----------
panel = Panel(python.out)
pln = Plane(python.cutting_plane_mortise)
pln_2 = Plane(python.ref_side_main)
brep = Brep(python.geo_main)
pln_3 = Plane(python.ref_side_cross)
brep_2 = Brep(python.geo_mortise)
pln_4 = Plane(python.cutting_plane_tenon)

panel_2 = Panel("""8
9
10
11""")
lng = ListLength(List=panel_2)
dup = DuplicateData(Data=Slider(8.3, range=0..20), Number=lng, Order=True)
python_2 = GhPythonScript(tenon=python.geo_tenon, edge_indices=panel_2, radii=dup)  # -> out, brep; inputs tenon: Brep, edge_indices: list of Int32, radii: list
# ---------- python_2: Python ----------
import Rhino.Geometry as rg

blend = rg.BlendType.Fillet
print(blend)
rail = rg.RailType.DistanceFromEdge
print(rail)

# Call CreateFilletEdges
brep = rg.Brep.CreateFilletEdges(tenon, edge_indices, radii, radii, blend, rail, 0.01)
# ---------- end python_2 ----------
debrep = DeconstructBrep(Brep=python.geo_tenon)  # -> Faces, Edges, Vertices
brep_3 = Brep(python.geo_tenon)
item = ListItem(List=debrep.Edges, Index=0, Wrap=True)  # -> Item, Item1, Item2, Item3

# ----
# TDovetailJoint
t_topo_joint = CTTTopologicalJointRules(
    start_y=number_slider_2,
    start_depth=number_slider,
    rotation=neg,
    length=length,
    width=width,
    cone_angle=cone_angle,
    dovetail_shape=list,
    tool_angle=number_slider_3,
    tool_diameter=number_slider_4,
    tool_height=number_slider_5)  # -> TDovetailJoint; disabled
# ---------- t_topo_joint: Python ----------
import inspect

from ghpythonlib.componentbase import executingcomponent as component
from Grasshopper.Kernel.GH_RuntimeMessageLevel import Warning

from compas_timber.connections import Joint
from compas_timber.connections import JointTopology
from compas_timber.connections import TButtJoint
from compas_timber.design import TopologyRule
from compas_timber.ghpython.ghcomponent_helpers import get_leaf_subclasses
from compas_timber.ghpython.ghcomponent_helpers import manage_dynamic_params
from compas_timber.ghpython.ghcomponent_helpers import rename_gh_output


class T_TopologyJointRule(component):
    def __init__(self):
        super(T_TopologyJointRule, self).__init__()
        self.classes = {}
        for cls in get_leaf_subclasses(Joint):
            if cls.SUPPORTED_TOPOLOGY == JointTopology.TOPO_T:
                self.classes[cls.__name__] = cls
        if ghenv.Component.Params.Output[0].NickName == "Rule":
            self.joint_type = TButtJoint
            self.clicked = False
        else:
            self.joint_type = self.classes.get(ghenv.Component.Params.Output[0].NickName, None)
            self.clicked = True

    def RunScript(self, *args):
        if not self.clicked:
            ghenv.Component.Message = "Default: TButtJoint"
            self.AddRuntimeMessage(Warning, "TButtJoint is default, change in context menu (right click)")
            return TopologyRule(JointTopology.TOPO_T, TButtJoint)
        else:
            ghenv.Component.Message = self.joint_type.__name__
            kwargs = {}
            for i, val in enumerate(args):
                if val is not None:
                    kwargs[self.arg_names()[i]] = val
            if self.joint_type.SUPPORTED_TOPOLOGY != JointTopology.TOPO_T:
                self.AddRuntimeMessage(Warning, "Joint type does not match topology. Joint may not be generated.")
            return TopologyRule(JointTopology.TOPO_T, self.joint_type, **kwargs)

    def arg_names(self):
        names = inspect.getargspec(self.joint_type.__init__)[0][3:]
        return [name for name in names if (name != "key") and (name != "frame")]

    def AppendAdditionalMenuItems(self, menu):
        for name in self.classes.keys():
            item = menu.Items.Add(name, None, self.on_item_click)
            if self.joint_type and name == self.joint_type.__name__:
                item.Checked = True

    def on_item_click(self, sender, event_info):
        self.clicked = True
        self.joint_type = self.classes[str(sender)]
        rename_gh_output(self.joint_type.__name__, 0, ghenv)
        manage_dynamic_params(self.arg_names(), ghenv, rename_count=0, permanent_param_count=0)
        ghenv.Component.ExpireSolution(True)
# ---------- end t_topo_joint ----------
model = CTModel(
    Elements=flatten([beam.Beam, beam_2.Beam]),
    JointRules=flatten(t_topo_joint),
    MaxDistance=Slider(60, range=0..100),
    CreateGeometry=Toggle(True))  # -> Model, Geometry, DebugInfo; inputs Elements: list, JointRules: list, Features: list, CreateGeometry: Boolean
#   port Elements: Collection of Beams
# ---------- model: Python ----------
from compas.scene import Scene
from compas.tolerance import TOL
from ghpythonlib.componentbase import executingcomponent as component
from Grasshopper.Kernel.GH_RuntimeMessageLevel import Warning

from compas_timber.connections import BeamJoinningError
from compas_timber.connections import ConnectionSolver
from compas_timber.connections import JointTopology
from compas_timber.connections import LMiterJoint
from compas_timber.connections import TButtJoint
from compas_timber.connections import XHalfLapJoint
from compas_timber.design import CategoryRule
from compas_timber.design import DebugInfomation
from compas_timber.design import DirectRule
from compas_timber.design import JointDefinition
from compas_timber.design import TopologyRule
from compas_timber.model import TimberModel

JOINT_DEFAULTS = {
    JointTopology.TOPO_X: XHalfLapJoint,
    JointTopology.TOPO_T: TButtJoint,
    JointTopology.TOPO_L: LMiterJoint,
}


# workaround for https://github.com/gramaziokohler/compas_timber/issues/280
TOL.absolute = 1e-6


class ModelComponent(component):
    def get_joints_from_rules(self, beams, rules, topologies):
        if not isinstance(rules, list):
            rules = [rules]
        rules = [r for r in rules if r is not None]

        joints = []
        # rules have to be resolved into joint definitions
        topo_rules = {}
        cat_rules = []
        direct_rules = []

        # TODO: refactor this into some kind of a rule reloving class/function
        for r in rules:  # separate category and topo and direct joint rules
            if isinstance(r, TopologyRule):
                if topo_rules.get(r.topology_type, None):  # if rule for this Topo exists
                    if (r.joint_type != JOINT_DEFAULTS[r.topology_type]) or (
                        len(r.kwargs) != 0
                    ):  # if this rule is NOT default
                        topo_rules[r.topology_type] = r
                else:
                    topo_rules[r.topology_type] = r
            elif isinstance(r, CategoryRule):
                cat_rules.append(r)
            if isinstance(r, DirectRule):
                direct_rules.append(r)

        for topo in topologies:
            beam_a = topo["beam_a"]
            beam_b = topo["beam_b"]
            detected_topo = topo["detected_topo"]
            pair = beam_a, beam_b
            pair_joined = False

            if detected_topo == JointTopology.TOPO_UNKNOWN:
                continue

            for rule in direct_rules:  # apply direct rules first
                if rule.comply(pair):
                    joints.append(JointDefinition(rule.joint_type, rule.beams, **rule.kwargs))
                    pair_joined = True
                    break

            if not pair_joined:  # if no direct rule applies, apply category rules next
                for rule in cat_rules:
                    if not rule.comply(pair):
                        continue
                    if rule.joint_type.SUPPORTED_TOPOLOGY != detected_topo:
                        msg = "Conflict detected! Beams: {}, {} meet with topology: {} but rule assigns: {}"
                        self.AddRuntimeMessage(
                            Warning,
                            msg.format(
                                beam_a.guid,
                                beam_b.guid,
                                JointTopology.get_name(detected_topo),
                                rule.joint_type.__name__,
                            ),
                        )
                        continue
                    if rule.topos and detected_topo not in rule.topos:
                        msg = "Conflict detected! Beams: {}, {} meet with topology: {} but rule allows: {}"
                        self.AddRuntimeMessage(
                            Warning,
                            msg.format(
                                beam_a.guid,
                                beam_b.guid,
                                JointTopology.get_name(detected_topo),
                                [JointTopology.get_name(topo) for topo in rule.topos],
                            ),
                        )
                        continue
                    # sort by category to allow beam role by order (main beam first, cross beam second)
                    beam_a, beam_b = rule.reorder([beam_a, beam_b])
                    joints.append(JointDefinition(rule.joint_type, [beam_a, beam_b], **rule.kwargs))
                    break  # first matching rule

                else:  # no category rule applies, apply topology rules
                    if detected_topo not in topo_rules:
                        continue
                    else:
                        joints.append(
                            JointDefinition(
                                topo_rules[detected_topo].joint_type,
                                [beam_a, beam_b],
                                **topo_rules[detected_topo].kwargs
                            )
                        )
        return joints

    def RunScript(self, Elements, JointRules, Features, MaxDistance, CreateGeometry):
        if not Elements:
            self.AddRuntimeMessage(Warning, "Input parameter Beams failed to collect data")
        if not JointRules:
            self.AddRuntimeMessage(Warning, "Input parameter JointRules failed to collect data")
        if not (Elements):  # shows beams even if no joints are found
            return
        if MaxDistance is None:
            MaxDistance = TOL.ABSOLUTE  # compared to calculted distance, so shouldn't be just 0.0

        Model = TimberModel()
        debug_info = DebugInfomation()
        for element in Elements:
            # prepare elements for downstream processing
            if element is None:
                continue
            element.remove_features()
            if hasattr(element, "remove_blank_extension"):
                element.remove_blank_extension()
            element.debug_info = []
            Model.add_element(element)

        topologies = []
        solver = ConnectionSolver()
        found_pairs = solver.find_intersecting_pairs(list(Model.beams), rtree=True, max_distance=MaxDistance)
        for pair in found_pairs:
            beam_a, beam_b = pair
            detected_topo, beam_a, beam_b = solver.find_topology(beam_a, beam_b, max_distance=MaxDistance)
            if not detected_topo == JointTopology.TOPO_UNKNOWN:
                topologies.append({"detected_topo": detected_topo, "beam_a": beam_a, "beam_b": beam_b})
        Model.set_topologies(topologies)

        joints = self.get_joints_from_rules(Model.beams, JointRules, topologies)

        if joints:
            handled_beams = []
            joints = [j for j in joints if j is not None]
            # apply reversed. later joints in orginal list override ealier ones
            for joint in joints[::-1]:
                beams_to_pair = joint.beams
                beam_pair_ids = set([id(beam) for beam in beams_to_pair])
                if beam_pair_ids in handled_beams:
                    continue
                try:
                    joint.joint_type.create(Model, *beams_to_pair, **joint.kwargs)
                except BeamJoinningError as bje:
                    debug_info.add_joint_error(bje)
                else:
                    handled_beams.append(beam_pair_ids)

        # applies extensions and features resulting from joints
        Model.process_joinery()

        if Features:
            features = [f for f in Features if f is not None]
            for f_def in features:
                for element in f_def.elements:
                    element.add_features(f_def.feature)

        Geometry = None
        scene = Scene()
        for element in Model.elements():
            if CreateGeometry:
                scene.add(element.geometry)
                if element.debug_info:
                    debug_info.add_feature_error(element.debug_info)
            else:
                scene.add(element.blank)

        if debug_info.has_errors:
            self.AddRuntimeMessage(Warning, "Error found during joint creation. See DebugInfo output for details.")

        Geometry = scene.draw()
        return Model, Geometry, debug_info
# ---------- end model ----------
toggle = BooleanToggle(False)
writebtlx = CTWriteBTLx(Model=model.Model, Path="C:\Users\kapso\OneDrive\Desktop\BTLx\TenonJoint.btlx", Write=Button())  # -> BTLx; inputs Write: Boolean
#   port Model: Model object.
# ---------- writebtlx: Python ----------
import Rhino
from ghpythonlib.componentbase import executingcomponent as component
from Grasshopper.Kernel.GH_RuntimeMessageLevel import Warning

from compas_timber.fabrication import BTLx


class WriteBTLx(component):
    def RunScript(self, model, path, write):
        if not model:
            self.AddRuntimeMessage(Warning, "Input parameter Model failed to collect data")
            return

        btlx = BTLx(model)
        btlx.history["FileName"] = Rhino.RhinoDoc.ActiveDoc.Name

        if write:
            if not path:
                self.AddRuntimeMessage(Warning, "Input parameter Path failed to collect data")
                return
            if path[-5:] != ".btlx":
                path += ".btlx"
            with open(path, "w") as f:
                f.write(btlx.btlx_string())
        return btlx.btlx_string()
# ---------- end writebtlx ----------

tenon_btlx_params = Panel(python.tenon_btlx_params)
btlx_params = Panel(python.mortise_btlx_params)
panel_3 = Panel(writebtlx)  # disabled
python_3 = GhPythonScript(tenon=python.tenon)  # -> out, a
# ---------- python_3: Python ----------
start_x = tenon.start_x
start_y = tenon.start_y
start_depth = tenon.start_depth
# ---------- end python_3 ----------
btlxfeature = CTBTLxFeature(Beam=beam.Beam, Reference_Face=Slider(3, range=0..10), orientation="end")  # -> Tenon, Reference_Face; inputs Reference_Face: Int32
#   port Beam: Beam to apply BTLx feature to.
# ---------- btlxfeature: Python ----------
import inspect

from compas.geometry import Line
from compas.scene import Scene
from ghpythonlib.componentbase import executingcomponent as component
from Grasshopper.Kernel.GH_RuntimeMessageLevel import Warning

from compas_timber._fabrication import BTLxProcess
from compas_timber.design import FeatureDefinition
from compas_timber.ghpython.ghcomponent_helpers import get_leaf_subclasses
from compas_timber.ghpython.ghcomponent_helpers import manage_dynamic_params
from compas_timber.ghpython.ghcomponent_helpers import rename_gh_output


class BTLxFeature(component):
    def __init__(self):
        super(BTLxFeature, self).__init__()
        self.classes = {}
        for cls in get_leaf_subclasses(BTLxProcess):
            self.classes[cls.__name__] = cls

        if ghenv.Component.Params.Output[0].NickName == "Process":
            self.processing_type = None
        else:
            self.processing_type = self.classes.get(ghenv.Component.Params.Output[0].NickName, None)

    def RunScript(self, beam, ref_side, *args):
        if not self.processing_type:
            ghenv.Component.Message = "Select Process type from context menu (right click)"
            self.AddRuntimeMessage(Warning, "Select Process type from context menu (right click)")
            return None
        else:
            ghenv.Component.Message = self.processing_type.__name__
            kwargs = {}
            kwargs["ref_side_index"] = ref_side
            for arg, val in zip(self.arg_names(), args):
                if val is not None:
                    kwargs[arg] = val

            process = self.processing_type(**kwargs)
            face = beam.ref_sides[ref_side]

            line_scene = Scene()
            line_scene.add(Line.from_point_direction_length(face.point, face.xaxis, beam.length))
            line_scene.add(
                Line.from_point_direction_length(
                    face.point, face.yaxis, beam.width if ref_side % 2 == 0 else beam.height
                )
            )

            return FeatureDefinition(process, [beam]), line_scene.draw()

    def arg_names(self):
        return inspect.getargspec(self.processing_type.__init__)[0][1:]

    def AppendAdditionalMenuItems(self, menu):
        for name in self.classes.keys():
            item = menu.Items.Add(name, None, self.on_item_click)
            if self.processing_type and name == self.processing_type.__name__:
                item.Checked = True

    def on_item_click(self, sender, event_info):
        self.processing_type = self.classes[str(sender)]
        rename_gh_output(self.processing_type.__name__, 0, ghenv)
        manage_dynamic_params(self.arg_names(), ghenv, rename_count=0, permanent_param_count=2)
        ghenv.Component.ExpireSolution(True)
# ---------- end btlxfeature ----------
python_4 = GhPythonScript(x=btlxfeature.Tenon)  # -> out, a
# ---------- python_4: Python ----------
feature = x.feature
element = x.elements[0]


feature.apply(element.geometry, element)
# ---------- end python_4 ----------

# ==== cluster Cluster_2
line = ClusterInput()
bool = ClusterInput()
bool_2 = ClusterInput()
Z = UnitZ(Factor=1)
line_2 = Line(line)
bool_3 = Boolean(bool)
cluster = Cluster(vec=Z, crv=line_2, bool=bool_2, num=Slider(2, range=0..20))  # -> C, num_4
A = ClusterInput()
filter = StreamFilter(Gate=bool_3, Stream0=line_2, Stream1=cluster.C)
xprod = CrossProduct(VectorA=A, VectorB=cluster.C, Unitize=False)  # -> Vector, Length
filter_2 = StreamFilter(Gate=bool_3, Stream1=xprod.Vector)
s_0 = ClusterOutput(filter)
s_0_2 = ClusterOutput(filter_2)

# ==== cluster Cluster
bool = ClusterInput()
vec = ClusterInput()
crv = ClusterInput()
bool_2 = Boolean(bool)
vec_2 = Vector(vec)
crv_2 = Curve(crv)
flip = FlipCurve(Curve=crv_2)  # -> Curve, Flag
filter = StreamFilter(Gate=bool_2, Stream0=crv_2, Stream1=flip.Curve)
end = EndPoints(Curve=crv_2)  # -> Start, End
end_2 = EndPoints(Curve=filter)  # -> Start, End
pt = Point(end_2.Start)
pi = Pi(Factor=1)  # -> expr("x/2", Output)
angle = Angle(VectorA=filter, VectorB=vec_2)  # -> Angle, Reflex
number_slider = Slider(100, range=0..100)
subtraction = Subtraction(A=pi, B=angle.Angle)
square_root = SquareRoot(Value=2)
deg = Degrees(Radians=subtraction)
panel = Panel(deg)
abs = Absolute(Value=subtraction)
expression = Expression(x=abs, y=number_slider, Expression="abs((y/2)/cos(x)+(tan(x)*(y/2)))-(y/2)")
Z = UnitZ(Factor=expression)
move = Move(Geometry=pt, Motion=Z)  # -> Geometry, Transform
ln = Line(StartPoint=move.Geometry, EndPoint=end_2.End)
angle_2 = Angle(VectorA=filter, VectorB=ln)  # -> Angle, Reflex
sine = Sine(Value=angle_2.Angle)
panel_2 = Panel(sine)
deg_2 = Degrees(Radians=angle_2.Angle)
multiplication = Multiplication(A=square_root, B=number_slider)
num = ClusterInput()
multiplication_2 = Multiplication(A=multiplication, B=sine)
num_2 = Number(num)
addition = Addition(A=expression, B=multiplication_2)
addition_2 = Addition(A=addition, B=num_2)
addition_3 = Addition(A=expression, B=multiplication_2)
Z_2 = UnitZ(Factor=addition_2)
larger = LargerThan(FirstNumber=subtraction, SecondNumber="0")  # -> LargerThan, OrEqualTo
subtraction_2 = Subtraction(A=expression, B=multiplication_2)
neg = Negative(Value=Z_2)
bool_3 = Boolean(larger.LargerThan)
filter_2 = StreamFilter(Gate=bool_3, Stream0=Z_2, Stream1=neg)
move_2 = Move(Geometry=pt, Motion=filter_2)  # -> Geometry, Transform
ln_2 = Line(StartPoint=move_2.Geometry, EndPoint=end_2.End)
num_3 = Number(expression)
crv_3 = Curve(ln_2)
flip_2 = FlipCurve(Curve=crv_3, Guide=crv_2)  # -> Curve, Flag
num_4 = ClusterOutput(num_3)
C = ClusterOutput(flip_2.Curve)
