# Grasshopper definition beam.gh (Grasshopper 1.0.7)

number_slider = Slider(0.12, range=0..1)
number_slider_2 = Slider(0.19, range=0..1)
pt = Point(Point(0, 0, 0))
vec = Vector(Vector(-1, 1, 0))  # disabled
pt_2 = Point(Point(5, 0, 0))
vdis = VectorDisplay(Anchor=pt, Vector=vec)
pln = Plane(Plane(origin=(-2, 0, 0), x=(0.8320502943, -0.5547001962, 0), y=(0.3922322703, 0.5883484054, 0.7071067812)))
ln = Line(StartPoint=pt, EndPoint=pt_2)
crv = Curve([<curve referenced from the Rhino model> x3])
vec_2 = Vector(Vector(1, 0, 3))
panel = Panel("""{0,1}
{1,2}
{0,2}""")
beam_from_points_vec = GhPythonScript(ps=pt, pe=pt_2, vec=vec, W=number_slider, H=number_slider_2)  # -> out, beam, shape; inputs ps: Point3d, pe: Point3d, vec: Vector3d
# ---------- beam_from_points_vec: Python ----------
__author__ = "aapolina"
__version__ = "2021.12.10"

import Rhino.Geometry as rg
from compas_ghpython.utilities import unload_modules


import compas_timber
reload(compas_timber)
unload_modules('compas_timber')
from compas_timber.parts.beam import Beam
from compas_timber.utils.rhino_compas import rVec2cVec, rPt2cPt, cBox2rBox

beam = Beam.from_endpoints(rPt2cPt(ps), rPt2cPt(pe), rVec2cVec(vec),W,H)
shape = cBox2rBox(beam.shape)
# ---------- end beam_from_points_vec ----------
beam_from_line_vec = GhPythonScript(line=ln, vec=vec, W=number_slider, H=number_slider_2)  # -> out, beam, shape; inputs line: Line, vec: Vector3d
# ---------- beam_from_line_vec: Python ----------
__author__ = "aapolina"
__version__ = "2021.12.10"

from compas_ghpython.utilities import unload_modules
import Rhino.Geometry as rg

import compas_timber
reload(compas_timber)
unload_modules('compas_timber')
from compas_timber.parts.beam import Beam
from compas_timber.utils.rhino_compas import rVec2cVec, cBox2rBox, rLine2cLine

v = rVec2cVec(vec) 

beam = Beam.from_centreline(rLine2cLine(line),rVec2cVec(vec),W,H)
shape = cBox2rBox(beam.shape)
# ---------- end beam_from_line_vec ----------
beam_from_frame = GhPythonScript(pln=pln, W=number_slider, H=number_slider_2, L=Slider(2.68, range=0..10))  # -> out, beam, shape; inputs pln: Plane
# ---------- beam_from_frame: Python ----------
__author__ = "aapolina"
__version__ = "2021.12.10"

import Rhino.Geometry as rg
import compas_timber
from compas_timber.parts.beam import Beam
from compas_timber.utils.rhino_compas import rPln2cFrame, cBox2rBox
from compas_ghpython import unload_modules
unload_modules('compas_timber')
reload(compas_timber)

beam = Beam(rPln2cFrame(pln),L,W,H)

beam = Beam.from_frame(rPln2cFrame(pln),W,H,L)


shape = cBox2rBox(beam.shape)
# ---------- end beam_from_frame ----------
list = ValueList({"T-butt", "Lap"}, selected="T-butt")
beam_from_line_vec_2 = GhPythonScript(line=crv, vec=vec_2, W="0.1", H="0.2")  # -> out, beam, shape; inputs line: Line, vec: Vector3d; same code as beam_from_line_vec
list_2 = ValueList({"T-butt", "Lap"}, selected="T-butt")
manual_connect = GhPythonScript(beams=beam_from_line_vec_2.beam, connectivity=panel, joint_type=list)  # -> out, beams, assembly_model, geometry; inputs beams: list, connectivity: list
# ---------- manual_connect: Python ----------
__author__ = "aapolina"
__version__ = "2021.11.30"

import compas_ghpython 
import compas_timber
compas_ghpython.utilities.unload_modules("compas_timber")
#import compas_timber
#reload(compas_timber)

from compas_timber.assembly.assembly import TimberAssembly
from compas_timber.connections.t_butt import TButtJoint

model = TimberAssembly()

for beam in beams: model.add_beam(beam)
con_list = [[int(c.Real),int(c.Imaginary)] for c in connectivity]

for ci,cj in con_list:
    joint = None
    if joint_type == "T-butt": joint = TButtJoint(beams[cj],beams[ci]) #TODO
    if joint_type == "Lap":    joint = Lap() #TODO
    model.add_joint(joint)
    model.connect([beams[ci], beams[cj]], joint)



assembly_model = model
geometry = [b.geometry for b in model.beams]
# ---------- end manual_connect ----------
auto_connect = GhPythonScript(beams=beam_from_line_vec_2.beam, joint_type=list_2)  # -> out, beams, assembly_model; inputs beams: list; disabled
# ---------- auto_connect: Python ----------
__author__ = "aapolina"
__version__ = "2021.11.30"

import compas_ghpython 
import compas_timber
compas_ghpython.utilities.unload_modules("compas_timber")
#import compas_timber
#reload(compas_timber)

from compas_timber.assembly.assembly import TimberAssembly
from compas_timber.connections.t_butt import TButtJoint

model = Assembly()

for beam in beams: 
    model.add_beam(beam)

tol = 1e-3
for crossbeam in model.beams:
    
    for mainbeam in model.beams:
        if crossbeam==mainbeam: continue
        if mainbeam.end1.pt.distance_to_line(crossbeam.centreline) <tol:
            print "connecting!"
            tjoint = TButtJoint(crossbeam, mainbeam.end1, gap)
            model.connect(crossbeam, mainbeam, tjoint)
        if mainbeam.end2.pt.distance_to_line(crossbeam.centreline) <tol:
            print "connecting!"
            tjoint = TButtJoint(crossbeam, mainbeam.end2, gap)
            model.connect(crossbeam, mainbeam, tjoint)
# ---------- end auto_connect ----------
vec_3 = Vector(Vector(5, 2, 0))
vec_4 = Vector(Vector(1, 0, 2))
move = GhPythonScript(beam=beam_from_line_vec.beam, vec_start=vec_3)  # -> out, beam, shape; inputs vec_start: Vector3d, vec_end: Vector3d
# ---------- move: Python ----------
__author__ = "aapolina"
__version__ = "2021.12.17"



import rhinoscriptsyntax as rs
from compas_timber.utils.rhino_compas import rVec2cVec, cBox2rBox

beam = beam.copy()

if vec_start: 
    vec_start = rVec2cVec(vec_start)
    beam.move_endpoint(vec_start,'start')

if vec_end:
    vec_end = rVec2cVec(vec_end)
    beam.move_endpoint(vec_end,'end')

shape = cBox2rBox(beam.shape)
# ---------- end move ----------
python = GhPythonScript(beam=beam_from_frame.beam, frame_index=Slider(5, range=-1..5))  # -> out, pln
# ---------- python: Python ----------
__author__ = "aapolina"
__version__ = "2022.01.25"

import rhinoscriptsyntax as rs
from compas_timber.utils.rhino_compas import cFrame2rPln

if frame_index==-1: 
    cframe = beam.frame
else:
    cframe = beam.side_frame(frame_index)
    
    
pln = cFrame2rPln(cframe)
# ---------- end python ----------
orient = GhPythonScript(beam=beam_from_frame.beam, vec=vec_4)  # -> out, beam, shape; inputs vec: Vector3d
# ---------- orient: Python ----------
__author__ = "aapolina"
__version__ = "2021.12.17"

beam = beam.copy()

import rhinoscriptsyntax as rs
from compas_timber.utils.rhino_compas import rVec2cVec, cBox2rBox
vec = rVec2cVec(vec)

beam.align_z(vec)
shape = cBox2rBox(beam.shape)
# ---------- end orient ----------
python_2 = GhPythonScript(model=manual_connect.assembly_model)  # -> out, box_breps, cutting_planes
# ---------- python_2: Python ----------
__author__ = "aapolina"
__version__ = "2022.03.08"

import rhinoscriptsyntax as rs
from compas_timber.utils.rhino_compas import cPln2rPln, cBox2rBox
from ghpythonlib.treehelpers import list_to_tree

joints = model.joints
print(joints)

for joint in joints: joint.apply_feature()

box_breps = []
cutting_planes = []
for beam in model.beams:
    box_breps.append(cBox2rBox(beam.shape))
    cplns = [cPln2rPln(feat[0]) for feat in beam.features if feat[1]=='trim']
    cutting_planes.append(cplns)


cutting_planes = list_to_tree(cutting_planes)



"""
beams_to_cut = [j.main_beam for j in model.joints]
box_breps = [cBox2rBox(b.shape) for b in beams_to_cut]
cutting_planes = [cPln2rPln(j.cutting_plane) for j in joints]


connections = model.connections
print(connections)
"""
# ---------- end python_2 ----------
show = GhPythonScript()  # -> out, geometry; inputs whatever: list
# ---------- show: Python ----------
__author__ = "aapolina"
__version__ = "2021.11.26"

import compas_timber
reload(compas_timber)

from compas_timber.parts.beam import Beam
from compas_timber.utils.rhino_compas import brep_from8points, list2rPt

geometry = []

for smth in whatever:
    if isinstance(smth,Beam):
        B = brep_from8points([list2rPt(p) for p in smth.corners])
        geometry.append(B)
# ---------- end show ----------

number_slider_3 = Slider(0.68, range=0.01..1)
deplane = DeconstructPlane(Plane=python.pln)  # -> Origin, XAxis, YAxis, ZAxis
amp = Amplitude(Vector=deplane.YAxis, Amplitude=number_slider_3)
amp_2 = Amplitude(Vector=deplane.XAxis, Amplitude=number_slider_3)
amp_3 = Amplitude(Vector=deplane.ZAxis, Amplitude=number_slider_3)
vdisex = VectorDisplayEx(Point=deplane.Origin, Vector=amp_2, Colour=ColourSwatch(SwatchColor=RGB(255, 143, 143)), Width=2)
vdisex_2 = VectorDisplayEx(Point=deplane.Origin, Vector=amp, Colour=ColourSwatch(SwatchColor=RGB(185, 255, 110)), Width=2)
vdisex_3 = VectorDisplayEx(Point=deplane.Origin, Vector=amp_3, Colour=ColourSwatch(SwatchColor=RGB(110, 243, 255)), Width=2)

pflip = FlipPlane(Plane=python_2.cutting_planes, ReverseX=False, ReverseY=False, SwapAxes=True)
python_3 = GhPythonScript(brep=simplify(graft(python_2.box_breps)), pln=simplify(pflip))  # -> out, x; inputs brep: tree of Brep, pln: tree of Plane
# ---------- python_3: Python ----------
__author__ = "aapolina"
__version__ = "2022.03.08"

import rhinoscriptsyntax as rs

import Rhino.Geometry as rg
brep = [list(b)[0] for b in brep.Branches]
pln = [list(p) for p in pln.Branches]


assert len(brep)==len(pln)

x = []
for b,p in zip(brep,pln):
    if p:
        bi = b
        for pi in p:
            bx = rg.Brep.Trim(bi,pi,1e-6)
            assert len(bx)==1
            bi=bx[0]
        x.append(bi)
    else:
        x.append(b)
# ---------- end python_3 ----------
