# Grasshopper definition double_cut.gh (Grasshopper 1.0.7)

Z = UnitZ(Factor=expr("-x", Slider(400, range=0..2000)))
X = UnitX(Factor=Slider(500, range=0..4000))
Y = UnitY(Factor=Slider(0, range=0..4000))

crv = Curve(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)

crv_2 = Curve(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)
end = EndPoints(Curve=crv_2)  # -> Start, End
addition = Addition(A=X, B=Z, C=Y)
move = Move(Geometry=end.End, Motion=expr("-x", addition))  # -> Geometry, Transform
ln = Line(StartPoint=end.Start, EndPoint=move.Geometry)

crv_3 = Curve([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])

# ---- group: CrossBeam
crv_4 = Curve(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)

# ----
Z_2 = UnitZ(Factor=Slider(0, range=0..2000))
item = ListItem(List=crv_3, Index=Slider(3, range=0..3), Wrap=True)

flipcurve = BooleanToggle(True)
crv_5 = Curve(crv_4)

move_2 = Move(Geometry=item, Motion=expr("-X", Z_2))  # -> Geometry, Transform

flipcurve_2 = BooleanToggle(True)
crv_6 = Curve(move_2.Geometry)

flip = FlipCurve(Curve=crv_5)  # -> Curve, Flag
filter = StreamFilter(Gate=flipcurve, Stream0=crv_5, Stream1=flip.Curve)
flip_2 = FlipCurve(Curve=crv_6)  # -> Curve, Flag
number_slider = Slider(5, range=0..10)
filter_2 = StreamFilter(Gate=flipcurve_2, Stream0=crv_6, Stream1=flip_2.Curve)
Z_3 = UnitZ(Factor=1)
Y_2 = UnitY(Factor=Slider(1.5, range=0..10))
X_2 = UnitX(Factor=1)
addition_2 = Addition(A=Y_2, B=X_2)
number_slider_2 = Slider(100, range=0..100)
cluster = Cluster(vec=Z_3, crv=filter_2, bool=flipcurve_2, int=number_slider_2, num=Slider(0, range=-20..21))  # -> C, num_4
python = GhPythonScript(lines=filter_2)  # -> out, a; inputs lines: list of Line
# ---------- python: Python ----------
from compas_rhino.conversions import line_to_compas

lines = [line_to_compas(line) for line in lines]
print(lines)
# ---------- end python ----------
beam = CTBeam(Centerline=filter_2, ZVector=addition_2, Width=Slider(80, range=0..100), Height=Slider(100, range=0..120))  # -> Beam, Blank; inputs Centerline: list, ZVector: list of Vector3d, Width: list, Height: list, Category: list, updateRefObj: Boolean
#   port Centerline: Referenced curve or line, Guid of curve or line in the active Rhino document.
#   port ZVector: Vector defining the orientation of the cross-section (corresponds to the height dimension). If None, a default will be taken.
#   port Width: Width of the cross-section (usually the smaller dimension).
#   port Height: Height of the cross-section (usually the larger dimension).
#   port Category: Category of a beam.
#   port updateRefObj: (optional) If True, the attributes in the referenced object will be updated/overwritten with the new values given here.
#   port Beam: Beam object(s).
#   port Blank: Shape of the beam's blank.
# ---------- beam: Python ----------
"""Creates a Beam from a LineCurve."""

import rhinoscriptsyntax as rs
from compas.scene import Scene
from compas_rhino.conversions import line_to_compas
from compas_rhino.conversions import vector_to_compas
from ghpythonlib.componentbase import executingcomponent as component
from Grasshopper.Kernel.GH_RuntimeMessageLevel import Error
from Grasshopper.Kernel.GH_RuntimeMessageLevel import Warning
from Rhino.RhinoDoc import ActiveDoc

from compas_timber.elements import Beam as CTBeam
from compas_timber.ghpython.rhino_object_name_attributes import update_rhobj_attributes_name


class Beam_fromCurve(component):
    def RunScript(self, centerline, z_vector, width, height, category, updateRefObj):
        # minimum inputs required
        if not centerline:
            self.AddRuntimeMessage(Warning, "Input parameter 'Centerline' failed to collect data")
        if not width:
            self.AddRuntimeMessage(Warning, "Input parameter 'Width' failed to collect data")
        if not height:
            self.AddRuntimeMessage(Warning, "Input parameter 'Height' failed to collect data")

        # reformat unset parameters for consistency
        if not z_vector:
            z_vector = [None]
        if not category:
            category = [None]

        beams = []
        blanks = []
        scene = Scene()

        if centerline and height and width:
            # check list lengths for consistency
            N = len(centerline)
            if len(z_vector) not in (0, 1, N):
                self.AddRuntimeMessage(
                    Error, " In 'ZVector' I need either none, one or the same number of inputs as the Crv parameter."
                )
            if len(width) not in (1, N):
                self.AddRuntimeMessage(
                    Error, " In 'W' I need either one or the same number of inputs as the Crv parameter."
                )
            if len(height) not in (1, N):
                self.AddRuntimeMessage(
                    Error, " In 'H' I need either one or the same number of inputs as the Crv parameter."
                )
            if len(category) not in (0, 1, N):
                self.AddRuntimeMessage(
                    Error, " In 'Category' I need either none, one or the same number of inputs as the Crv parameter."
                )

            # duplicate data if None or single value
            if len(z_vector) != N:
                z_vector = [z_vector[0] for _ in range(N)]
            if len(width) != N:
                width = [width[0] for _ in range(N)]
            if len(height) != N:
                height = [height[0] for _ in range(N)]
            if len(category) != N:
                category = [category[0] for _ in range(N)]

            for line, z, w, h, c in zip(centerline, z_vector, width, height, category):
                guid, geometry = self._get_guid_and_geometry(line)
                rhino_line = rs.coerceline(geometry)
                line = line_to_compas(rhino_line)

                z = vector_to_compas(z) if z else None
                beam = CTBeam.from_centerline(centerline=line, width=w, height=h, z_vector=z)
                beam.attributes["rhino_guid"] = str(guid) if guid else None
                beam.attributes["category"] = c
                print(guid)
                if updateRefObj and guid:
                    update_rhobj_attributes_name(guid, "width", str(w))
                    update_rhobj_attributes_name(guid, "height", str(h))
                    update_rhobj_attributes_name(guid, "zvector", str(list(beam.frame.zaxis)))
                    update_rhobj_attributes_name(guid, "category", c)

                beams.append(beam)
                scene.add(beam.blank)

        blanks = scene.draw()

        return beams, blanks

    def _get_guid_and_geometry(self, line):
        # internalized curves and GH geometry will not have persistent GUIDs, referenced Rhino objects will
        # type hint on the input has to be 'ghdoc' for this to work
        guid = None
        geometry = line
        rhino_obj = ActiveDoc.Objects.FindId(line)
        if rhino_obj:
            guid = line
            geometry = rhino_obj.Geometry
        return guid, geometry
# ---------- end beam ----------
beam_2 = CTBeam(Centerline=filter, Width=number_slider_2, Height=Slider(120, range=0..1000))  # -> Beam, Blank; inputs Centerline: list, ZVector: list of Vector3d, Width: list, Height: list, Category: list, updateRefObj: Boolean; same code as beam
edges = BrepEdges(Brep=beam.Blank)  # -> Naked, Interior, NonManifold
edges_2 = BrepEdges(Brep=beam_2.Blank)  # -> Naked, Interior, NonManifold
toggle = BooleanToggle(True)
decomposebeam = CTDecomposeBeam(Beam=beam.Beam, ShowFrame=toggle, ShowFaces=toggle)  # -> Frame, Centerline, Box, Width, Height; inputs Beam: list, ShowFrame: Boolean, ShowFaces: Boolean
# ---------- decomposebeam: Python ----------
# flake8: noqa
from compas.geometry import Line
from compas_rhino.conversions import frame_to_rhino_plane
from compas_rhino.conversions import line_to_rhino
from compas_rhino.conversions import point_to_rhino
from compas_rhino.conversions import box_to_rhino
from ghpythonlib.componentbase import executingcomponent as component
from System.Drawing import Color


class BeamDecompose(component):
    RED = Color.FromArgb(255, 255, 100, 100)
    GREEN = Color.FromArgb(200, 50, 220, 100)
    BLUE = Color.FromArgb(200, 50, 150, 255)
    WHITE = Color.FromArgb(255, 255, 255, 255)
    YELLOW = Color.FromArgb(255, 255, 255, 0)
    SCREEN_SIZE = 10
    RELATIVE_SIZE = 0

    def RunScript(self, beam, show_frame, show_faces):
        self.show_faces = show_faces if show_faces is not None else False
        self.show_frame = show_frame if show_frame is not None else False
        self.frames = []
        self.rhino_frames = []
        self.scales = []
        self.faces = []
        self.width = []
        self.height = []
        self.centerline = []
        self.shapes = []

        for b in beam:
            self.frames.append(b.frame)
            self.rhino_frames.append(frame_to_rhino_plane(b.frame))
            self.scales.append(b.width + b.height)
            self.centerline.append(line_to_rhino(b.centerline))
            self.shapes.append(box_to_rhino(b.shape))
            self.width.append(b.width)
            self.height.append(b.height)
            self.faces.append(b.faces)

        return self.rhino_frames, self.centerline, self.shapes, self.width, self.height

    def DrawViewportWires(self, arg):
        if self.Locked:
            return

        for f, s, faces in zip(self.frames, self.scales, self.faces):
            if self.show_frame:
                self._draw_frame(arg.Display, f, s)
            if self.show_faces:
                self._draw_faces(arg.Display, faces, s)

    def _draw_frame(self, display, frame, scale):
        x = Line.from_point_and_vector(frame.point, frame.xaxis * scale)
        y = Line.from_point_and_vector(frame.point, frame.yaxis * scale)
        z = Line.from_point_and_vector(frame.point, frame.zaxis * scale)
        display.DrawArrow(line_to_rhino(x), self.RED, self.SCREEN_SIZE, self.RELATIVE_SIZE)
        display.DrawArrow(line_to_rhino(y), self.GREEN, self.SCREEN_SIZE, self.RELATIVE_SIZE)
        display.DrawArrow(line_to_rhino(z), self.BLUE, self.SCREEN_SIZE, self.RELATIVE_SIZE)

        x_loc = x.end + x.vector * scale * 1.1
        y_loc = y.end + y.vector * scale * 1.1
        z_loc = z.end + z.vector * scale * 1.1
        display.Draw2dText("X", self.RED, point_to_rhino(x_loc), True, 16, "Verdana")
        display.Draw2dText("Y", self.GREEN, point_to_rhino(y_loc), True, 16, "Verdana")
        display.Draw2dText("Z", self.BLUE, point_to_rhino(z_loc), True, 16, "Verdana")

    def _draw_faces(self, display, faces, scale):
        for index, face in enumerate(faces):
            normal = Line.from_point_and_vector(face.point, face.normal * scale)
            text = str(index)
            display.Draw2dText(text, self.WHITE, point_to_rhino(face.point), True, 16, "Verdana")
            display.DrawArrow(line_to_rhino(normal), self.YELLOW, self.SCREEN_SIZE, self.RELATIVE_SIZE)
# ---------- end decomposebeam ----------
decomposebeam_2 = CTDecomposeBeam(Beam=beam_2.Beam, ShowFrame=Toggle(True))  # -> Frame, Centerline, Box, Width, Height; inputs Beam: list, ShowFrame: Boolean, ShowFaces: Boolean; same code as decomposebeam
t_topo_joint = CTTTopologicalJointRules()  # -> TBirdsmouth
# ---------- t_topo_joint: Python ----------
import inspect

from ghpythonlib.componentbase import executingcomponent as component
from Grasshopper.Kernel.GH_RuntimeMessageLevel import Warning

from compas_timber.connections import Joint
from compas_timber.connections import JointTopology
from compas_timber.connections import TButtJoint
from compas_timber.design import TopologyRule
from compas_timber.ghpython.ghcomponent_helpers import get_leaf_subclasses
from compas_timber.ghpython.ghcomponent_helpers import manage_dynamic_params
from compas_timber.ghpython.ghcomponent_helpers import rename_gh_output


class T_TopologyJointRule(component):
    def __init__(self):
        super(T_TopologyJointRule, self).__init__()
        self.classes = {}
        for cls in get_leaf_subclasses(Joint):
            if cls.SUPPORTED_TOPOLOGY == JointTopology.TOPO_T:
                self.classes[cls.__name__] = cls
        if ghenv.Component.Params.Output[0].NickName == "Rule":
            self.joint_type = TButtJoint
            self.clicked = False
        else:
            self.joint_type = self.classes.get(ghenv.Component.Params.Output[0].NickName, None)
            self.clicked = True

    def RunScript(self, *args):
        if not self.clicked:
            ghenv.Component.Message = "Default: TButtJoint"
            self.AddRuntimeMessage(Warning, "TButtJoint is default, change in context menu (right click)")
            return TopologyRule(JointTopology.TOPO_T, TButtJoint)
        else:
            ghenv.Component.Message = self.joint_type.__name__
            kwargs = {}
            for i, val in enumerate(args):
                if val is not None:
                    kwargs[self.arg_names()[i]] = val
            if self.joint_type.SUPPORTED_TOPOLOGY != JointTopology.TOPO_T:
                self.AddRuntimeMessage(Warning, "Joint type does not match topology. Joint may not be generated.")
            return TopologyRule(JointTopology.TOPO_T, self.joint_type, **kwargs)

    def arg_names(self):
        names = inspect.getargspec(self.joint_type.__init__)[0][3:]
        return [name for name in names if (name != "key") and (name != "frame")]

    def AppendAdditionalMenuItems(self, menu):
        for name in self.classes.keys():
            item = menu.Items.Add(name, None, self.on_item_click)
            if self.joint_type and name == self.joint_type.__name__:
                item.Checked = True

    def on_item_click(self, sender, event_info):
        self.clicked = True
        self.joint_type = self.classes[str(sender)]
        rename_gh_output(self.joint_type.__name__, 0, ghenv)
        manage_dynamic_params(self.arg_names(), ghenv, rename_count=0, permanent_param_count=0)
        ghenv.Component.ExpireSolution(True)
# ---------- end t_topo_joint ----------
python_2 = GhPythonScript(cross_beam=beam_2.Beam, main_beam=beam.Beam, index=Slider(2, range=0..3))  # -> out, main_ref_side, rg_frames, cutting_planes, double_cut_geo, double_cut_btlx_params, extension_plane; inputs index: Int32
# ---------- python_2: Python ----------
from compas_rhino import unload_modules
from compas_timber._fabrication import DoubleCut, DoubleCutParams
from compas_timber.connections import Joint
from compas_timber.model import TimberModel
from compas_rhino.conversions import frame_to_rhino, plane_to_rhino, brep_to_rhino
from compas.geometry import intersection_plane_plane_plane, Plane, distance_point_line, intersection_plane_plane, Vector

from compas_timber.connections.utilities import beam_ref_side_incidence, beam_ref_side_incidence_with_vector


unload_modules('compas_timber')

def get_main_ref_side(main_beam, planes):
    angles_dict = {}
    for i, ref_side in enumerate(main_beam.ref_sides[0:4]):
        inter_pt = intersection_plane_plane_plane(Plane.from_frame(planes[0]), Plane.from_frame(planes[1]), Plane.from_frame(ref_side))
        if inter_pt is None:
            continue
        else:
            dist = distance_point_line(inter_pt, main_beam.centerline)
#            angles_dict[i] = ref_side.normal.angle(Vector.from_start_end(*intersection_plane_plane(Plane.from_frame(planes[0]), Plane.from_frame(planes[1]))))
            angles_dict[i] = dist
    return min(angles_dict.keys(), key=angles_dict.get)


cross_ref_side_dict = beam_ref_side_incidence(main_beam, cross_beam, ignore_ends=True)
cross_ref_side_indeces = sorted(cross_ref_side_dict, key=cross_ref_side_dict.get)[:2]
cross_ref_sides = [cross_beam.ref_sides[cross_ref_side_index] for cross_ref_side_index in cross_ref_side_indeces]

main_ref_side_index = get_main_ref_side(main_beam, cross_ref_sides)
main_ref_side = frame_to_rhino(main_beam.ref_sides[main_ref_side_index])

rg_frames = [frame_to_rhino(ref_side) for ref_side in cross_ref_sides]
double_cut = DoubleCut.from_planes_and_beam(cross_ref_sides, main_beam, main_ref_side_index)

cutting_planes = double_cut.planes_from_params_and_beam(main_beam)
cutting_planes = [plane_to_rhino(plane) for plane in cutting_planes]

extension_plane = frame_to_rhino(cross_beam.ref_sides[index])

#geo = main_beam.compute_geometry()
#double_cut_geo = brep_to_rhino(double_cut.apply(geo, main_beam))

#get btlx params
double_cut_params = DoubleCutParams(double_cut).as_dict()
double_cut_btlx_params = []
for key, value in double_cut_params.items():
    double_cut_btlx_params.append("{0}: {1}".format(key, value))
# ---------- end python_2 ----------
model = CTModel(
    Elements=flatten([beam_2.Beam, beam.Beam]),
    JointRules=flatten(t_topo_joint),
    MaxDistance=Slider(40, range=0..100),
    CreateGeometry=Toggle(True))  # -> Model, Geometry, DebugInfo; inputs Elements: list, JointRules: list, Features: list, CreateGeometry: Boolean
#   port Elements: Collection of Beams
# ---------- model: Python ----------
from compas.scene import Scene
from compas.tolerance import TOL
from ghpythonlib.componentbase import executingcomponent as component
from Grasshopper.Kernel.GH_RuntimeMessageLevel import Warning

from compas_timber.connections import BeamJoinningError
from compas_timber.connections import ConnectionSolver
from compas_timber.connections import JointTopology
from compas_timber.connections import LMiterJoint
from compas_timber.connections import TButtJoint
from compas_timber.connections import XHalfLapJoint
from compas_timber.design import CategoryRule
from compas_timber.design import DebugInfomation
from compas_timber.design import DirectRule
from compas_timber.design import JointDefinition
from compas_timber.design import TopologyRule
from compas_timber.model import TimberModel

JOINT_DEFAULTS = {
    JointTopology.TOPO_X: XHalfLapJoint,
    JointTopology.TOPO_T: TButtJoint,
    JointTopology.TOPO_L: LMiterJoint,
}


# workaround for https://github.com/gramaziokohler/compas_timber/issues/280
TOL.absolute = 1e-6


class ModelComponent(component):
    def get_joints_from_rules(self, beams, rules, topologies):
        if not isinstance(rules, list):
            rules = [rules]
        rules = [r for r in rules if r is not None]

        joints = []
        # rules have to be resolved into joint definitions
        topo_rules = {}
        cat_rules = []
        direct_rules = []

        # TODO: refactor this into some kind of a rule reloving class/function
        for r in rules:  # separate category and topo and direct joint rules
            if isinstance(r, TopologyRule):
                if topo_rules.get(r.topology_type, None):  # if rule for this Topo exists
                    if (r.joint_type != JOINT_DEFAULTS[r.topology_type]) or (
                        len(r.kwargs) != 0
                    ):  # if this rule is NOT default
                        topo_rules[r.topology_type] = r
                else:
                    topo_rules[r.topology_type] = r
            elif isinstance(r, CategoryRule):
                cat_rules.append(r)
            if isinstance(r, DirectRule):
                direct_rules.append(r)

        for topo in topologies:
            beam_a = topo["beam_a"]
            beam_b = topo["beam_b"]
            detected_topo = topo["detected_topo"]
            pair = beam_a, beam_b
            pair_joined = False

            if detected_topo == JointTopology.TOPO_UNKNOWN:
                continue

            for rule in direct_rules:  # apply direct rules first
                if rule.comply(pair):
                    joints.append(JointDefinition(rule.joint_type, rule.beams, **rule.kwargs))
                    pair_joined = True
                    break

            if not pair_joined:  # if no direct rule applies, apply category rules next
                for rule in cat_rules:
                    if not rule.comply(pair):
                        continue
                    if rule.joint_type.SUPPORTED_TOPOLOGY != detected_topo:
                        msg = "Conflict detected! Beams: {}, {} meet with topology: {} but rule assigns: {}"
                        self.AddRuntimeMessage(
                            Warning,
                            msg.format(
                                beam_a.guid,
                                beam_b.guid,
                                JointTopology.get_name(detected_topo),
                                rule.joint_type.__name__,
                            ),
                        )
                        continue
                    if rule.topos and detected_topo not in rule.topos:
                        msg = "Conflict detected! Beams: {}, {} meet with topology: {} but rule allows: {}"
                        self.AddRuntimeMessage(
                            Warning,
                            msg.format(
                                beam_a.guid,
                                beam_b.guid,
                                JointTopology.get_name(detected_topo),
                                [JointTopology.get_name(topo) for topo in rule.topos],
                            ),
                        )
                        continue
                    # sort by category to allow beam role by order (main beam first, cross beam second)
                    beam_a, beam_b = rule.reorder([beam_a, beam_b])
                    joints.append(JointDefinition(rule.joint_type, [beam_a, beam_b], **rule.kwargs))
                    break  # first matching rule

                else:  # no category rule applies, apply topology rules
                    if detected_topo not in topo_rules:
                        continue
                    else:
                        joints.append(
                            JointDefinition(
                                topo_rules[detected_topo].joint_type,
                                [beam_a, beam_b],
                                **topo_rules[detected_topo].kwargs
                            )
                        )
        return joints

    def RunScript(self, Elements, JointRules, Features, MaxDistance, CreateGeometry):
        if not Elements:
            self.AddRuntimeMessage(Warning, "Input parameter Beams failed to collect data")
        if not JointRules:
            self.AddRuntimeMessage(Warning, "Input parameter JointRules failed to collect data")
        if not (Elements):  # shows beams even if no joints are found
            return
        if MaxDistance is None:
            MaxDistance = TOL.ABSOLUTE  # compared to calculted distance, so shouldn't be just 0.0

        Model = TimberModel()
        debug_info = DebugInfomation()
        for element in Elements:
            # prepare elements for downstream processing
            if element is None:
                continue
            element.remove_features()
            if hasattr(element, "remove_blank_extension"):
                element.remove_blank_extension()
            element.debug_info = []
            Model.add_element(element)

        topologies = []
        solver = ConnectionSolver()
        found_pairs = solver.find_intersecting_pairs(list(Model.beams), rtree=True, max_distance=MaxDistance)
        for pair in found_pairs:
            beam_a, beam_b = pair
            detected_topo, beam_a, beam_b = solver.find_topology(beam_a, beam_b, max_distance=MaxDistance)
            if not detected_topo == JointTopology.TOPO_UNKNOWN:
                topologies.append({"detected_topo": detected_topo, "beam_a": beam_a, "beam_b": beam_b})
        Model.set_topologies(topologies)

        joints = self.get_joints_from_rules(Model.beams, JointRules, topologies)

        if joints:
            handled_beams = []
            joints = [j for j in joints if j is not None]
            # apply reversed. later joints in orginal list override ealier ones
            for joint in joints[::-1]:
                beams_to_pair = joint.beams
                beam_pair_ids = set([id(beam) for beam in beams_to_pair])
                if beam_pair_ids in handled_beams:
                    continue
                try:
                    joint.joint_type.create(Model, *beams_to_pair, **joint.kwargs)
                except BeamJoinningError as bje:
                    debug_info.add_joint_error(bje)
                else:
                    handled_beams.append(beam_pair_ids)

        # applies extensions and features resulting from joints
        Model.process_joinery()

        if Features:
            features = [f for f in Features if f is not None]
            for f_def in features:
                for element in f_def.elements:
                    element.add_features(f_def.feature)

        Geometry = None
        scene = Scene()
        for element in Model.elements():
            if CreateGeometry:
                scene.add(element.geometry)
                if element.debug_info:
                    debug_info.add_feature_error(element.debug_info)
            else:
                scene.add(element.blank)

        if debug_info.has_errors:
            self.AddRuntimeMessage(Warning, "Error found during joint creation. See DebugInfo output for details.")

        Geometry = scene.draw()
        return Model, Geometry, debug_info
# ---------- end model ----------
pln = Plane(python_2.extension_plane)
writebtlx = CTWriteBTLx(Model=model.Model, Path="D:\Papachap\Desktop\BTLx\TDoubleCut.btlx", Write=Toggle(False))  # -> BTLx; inputs Write: Boolean
#   port Model: Model object.
# ---------- writebtlx: Python ----------
import Rhino
from ghpythonlib.componentbase import executingcomponent as component
from Grasshopper.Kernel.GH_RuntimeMessageLevel import Warning

from compas_timber.fabrication import BTLx


class WriteBTLx(component):
    def RunScript(self, model, path, write):
        if not model:
            self.AddRuntimeMessage(Warning, "Input parameter Model failed to collect data")
            return

        btlx = BTLx(model)
        btlx.history["FileName"] = Rhino.RhinoDoc.ActiveDoc.Name

        if write:
            if not path:
                self.AddRuntimeMessage(Warning, "Input parameter Path failed to collect data")
                return
            if path[-5:] != ".btlx":
                path += ".btlx"
            with open(path, "w") as f:
                f.write(btlx.btlx_string())
        return btlx.btlx_string()
# ---------- end writebtlx ----------
panel = Panel(writebtlx)

# ==== cluster Cluster
number_slider = Slider(100, range=0..100)
bool = ClusterInput()
vec = ClusterInput()
crv = ClusterInput()
int = ClusterInput()
bool_2 = Boolean(bool)
int_2 = Integer(int)
vec_2 = Vector(vec)
crv_2 = Curve(crv)
flip = FlipCurve(Curve=crv_2)  # -> Curve, Flag
filter = StreamFilter(Gate=bool_2, Stream0=crv_2, Stream1=flip.Curve)
end = EndPoints(Curve=crv_2)  # -> Start, End
end_2 = EndPoints(Curve=filter)  # -> Start, End
pt = Point(end_2.Start)
pi = Pi(Factor=1)  # -> expr("x/2", Output)
angle = Angle(VectorA=filter, VectorB=vec_2)  # -> Angle, Reflex
subtraction = Subtraction(A=pi, B=angle.Angle)
square_root = SquareRoot(Value=2)
deg = Degrees(Radians=subtraction)
panel = Panel(deg)
abs = Absolute(Value=subtraction)
expression = Expression(x=abs, y=int_2, Expression="abs((y/2)/cos(x)+(tan(x)*(y/2)))-(y/2)")
Z = UnitZ(Factor=expression)
move = Move(Geometry=pt, Motion=Z)  # -> Geometry, Transform
ln = Line(StartPoint=move.Geometry, EndPoint=end_2.End)
angle_2 = Angle(VectorA=filter, VectorB=ln)  # -> Angle, Reflex
sine = Sine(Value=angle_2.Angle)
panel_2 = Panel(sine)
deg_2 = Degrees(Radians=angle_2.Angle)
multiplication = Multiplication(A=square_root, B=int_2)
num = ClusterInput()
multiplication_2 = Multiplication(A=multiplication, B=sine)
num_2 = Number(num)
addition = Addition(A=expression, B=multiplication_2)
addition_2 = Addition(A=addition, B=num_2)
addition_3 = Addition(A=expression, B=multiplication_2)
Z_2 = UnitZ(Factor=addition_2)
larger = LargerThan(FirstNumber=subtraction, SecondNumber="0")  # -> LargerThan, OrEqualTo
subtraction_2 = Subtraction(A=expression, B=multiplication_2)
neg = Negative(Value=Z_2)
filter_2 = StreamFilter(Gate=larger.LargerThan, Stream0=Z_2, Stream1=neg)
move_2 = Move(Geometry=pt, Motion=filter_2)  # -> Geometry, Transform
ln_2 = Line(StartPoint=move_2.Geometry, EndPoint=end_2.End)
num_3 = Number(expression)
crv_3 = Curve(ln_2)
flip_2 = FlipCurve(Curve=crv_3, Guide=crv_2)  # -> Curve, Flag
num_4 = ClusterOutput(num_3)
C = ClusterOutput(flip_2.Curve)
