# Grasshopper definition test_dovetail.ghx (Grasshopper 1.0.7)
# plug-ins: Human

X = UnitX(Factor=Slider(0, range=0..4000))
Z = UnitZ(Factor=Slider(500, range=0..2000))
Y = UnitY(Factor=Slider(0, range=0..4000))

crv = Curve(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)
end = EndPoints(Curve=crv)  # -> Start, End
addition = Addition(A=X, B=Z, C=Y)
move = Move(Geometry=end.End, Motion=expr("-x", addition))  # -> Geometry, Transform
ln = Line(StartPoint=end.Start, EndPoint=move.Geometry)

flipcurve = BooleanToggle(True)
crv_2 = Curve(ln)

Z_2 = UnitZ(Factor=1)

# ---- group: CrossBeam
crv_3 = Curve(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)

# ----
flip = FlipCurve(Curve=crv_2)  # -> Curve, Flag
filter = StreamFilter(Gate=flipcurve, Stream0=crv_2, Stream1=flip.Curve)
xprod = CrossProduct(VectorA=crv_3, VectorB=filter, Unitize=False)  # -> Vector, Length
vdis = VectorDisplay(Anchor=end.Start, Vector=expr("x*75", xprod.Vector))
number_slider = Slider(100, range=0..100)
number_slider_2 = Slider(100, range=0..100)
cluster = Cluster_2(vec=Z_2, crv=filter, bool=flipcurve)  # -> crv_4, num_2
python = GhPythonScript(main_centerline=filter, cross_centerline=crv_3, beam_width=number_slider_2)  # -> out, eccentricity_line, shift_vector, length; inputs main_centerline: Line, cross_centerline: Line, normal_cross: Vector3d; disabled
# ---------- python: Python ----------
import Rhino.Geometry as rg
import math
import copy

def rotate_vector(vector, angle, axis, point):
        angle_rad = math.radians(angle)
        vec_trans = rg.Transform.Rotation(angle_rad, axis.Direction, point)
        rotated_vector = rg.Vector3d(vector)
        rotated_vector.Transform(vec_trans)
        return rotated_vector

def sort_list(lst, key=None, reverse=False):
    return sorted(lst, key=key, reverse=reverse)


def new_shifted_lines(main_centerline, cross_centerline, normal_cross):

    param = rg.Intersect.Intersection.LineLine(main_centerline, cross_centerline)[2]
    int_point = cross_centerline.PointAt(param)

    ### Get normal vectors in all directions
    all_vectors = []
    for i in range(4):
        normal = rotate_vector(normal_cross, i*90, cross_centerline, int_point)
        all_vectors.append(normal)

    ### Get angles between main centerline and all vectors
    vec_angles = []
    for vec in all_vectors:
        plane = rg.Plane(int_point, all_vectors[0], all_vectors[1])
        vec_angle = rg.Vector3d.VectorAngle(main_centerline.Direction, vec, plane)
        vec_angles.append(vec_angle)

    ### Sort vectors based on angles
    fisrt_vec_angle_pairs = list(zip(all_vectors, vec_angles))
    first_sorted_vec_angle_pairs = sort_list(fisrt_vec_angle_pairs, key=lambda x: x[1])

    sorted_angles = [abs((math.pi/2)-sg) for sg in vec_angles]
    second_vec_angle_pairs = list(zip(all_vectors, sorted_angles))
    second_sorted_vec_angle_pairs = sort_list(second_vec_angle_pairs, key=lambda x: x[1], reverse=True )


    ### if the angle between the main centerline and the normal vector of the cross centerline is greater than 45 degrees, shift the main centerline to the right
    if min(vec_angles) > math.pi/4:
        x =  (math.pi*2) - max(vec_angles)
        length = abs((((beam_width)/2)/math.cos(x)+(math.tan(x)*((beam_width)/2)))-((beam_width)/2))
        print ("offset_length: ", length)
        second_sorted_vectors = [pair[0] for pair in second_sorted_vec_angle_pairs]
        selected_products = []
        for i, vecs in enumerate(second_sorted_vectors):
            if i%2 == 1:
                selected_products.append(rg.Vector3d.Multiply(main_centerline.Direction, vecs))
        index = selected_products.index(min(selected_products))
        if index == 0:
            shift_vector = second_sorted_vectors[1]
        else:
            shift_vector = second_sorted_vectors[3]
        shift_vector.Unitize()
        shift_length = (length) * shift_vector
        s_pt_to_move = copy.deepcopy(main_centerline.From)
        new_start_point = s_pt_to_move + shift_length
        new_line = rg.Line(new_start_point, main_centerline.To)

    ### if the angle between the main centerline and the normal vector of the cross centerline is less than 45 degrees, shift the main centerline to the left
    else:
        min_vec_angle = abs(min(vec_angles))
        if min_vec_angle > 1:
            x = min(vec_angles) % (2 * math.pi)
        else:
            x = min(vec_angles)
        length = abs((((beam_width)/2)/math.cos(x)+(math.tan(x)*((beam_width)/2)))-((beam_width)/2))
        print ("offset_length: ", length)
        first_sorted_vectors = [pair[0] for pair in first_sorted_vec_angle_pairs]
        selected_products = []
        for i, vecs in enumerate(first_sorted_vectors):
            if i%2 == 1:
                selected_products.append(rg.Vector3d.Multiply(main_centerline.Direction, vecs))
        index = selected_products.index(min(selected_products))
        if index == 0:
            shift_vector = first_sorted_vectors[1]
        else:
            shift_vector = first_sorted_vectors[3]
        shift_vector.Unitize()
        shift_length = (length) * shift_vector
        s_pt_to_move = copy.deepcopy(main_centerline.From)
        new_start_point = s_pt_to_move + shift_length
        new_line = rg.Line(new_start_point, main_centerline.To)

    print(length)
    return new_line, shift_vector, length

eccentricity_line, shift_vector, length = new_shifted_lines(main_centerline, cross_centerline, normal_cross)


e = rg.Vector3d.VectorAngle(-new_line.Direction, main_centerline.Direction)
error_length = ((math.sqrt(2) * 60) * math.sin(e))
# ---------- end python ----------
beam = CTBeam(Centerline=crv_3, ZVector=Z_2, Width=number_slider, Height=number_slider)  # -> Beam, Blank; inputs Centerline: list, ZVector: list of Vector3d, Width: list, Height: list, Category: list, updateRefObj: Boolean
#   port Centerline: Referenced curve or line, Guid of curve or line in the active Rhino document.
#   port ZVector: Vector defining the orientation of the cross-section (corresponds to the height dimension). If None, a default will be taken.
#   port Width: Width of the cross-section (usually the smaller dimension).
#   port Height: Height of the cross-section (usually the larger dimension).
#   port Category: Category of a beam.
#   port updateRefObj: (optional) If True, the attributes in the referenced object will be updated/overwritten with the new values given here.
#   port Beam: Beam object(s).
#   port Blank: Shape of the beam's blank.
# ---------- beam: Python ----------
"""Creates a Beam from a LineCurve."""

import rhinoscriptsyntax as rs
from compas.scene import Scene
from compas_rhino.conversions import line_to_compas
from compas_rhino.conversions import vector_to_compas
from ghpythonlib.componentbase import executingcomponent as component
from Grasshopper.Kernel.GH_RuntimeMessageLevel import Error
from Grasshopper.Kernel.GH_RuntimeMessageLevel import Warning
from Rhino.RhinoDoc import ActiveDoc

from compas_timber.elements import Beam as CTBeam
from compas_timber.ghpython.rhino_object_name_attributes import update_rhobj_attributes_name


class Beam_fromCurve(component):
    def RunScript(self, centerline, z_vector, width, height, category, updateRefObj):
        # minimum inputs required
        if not centerline:
            self.AddRuntimeMessage(Warning, "Input parameter 'Centerline' failed to collect data")
        if not width:
            self.AddRuntimeMessage(Warning, "Input parameter 'Width' failed to collect data")
        if not height:
            self.AddRuntimeMessage(Warning, "Input parameter 'Height' failed to collect data")

        # reformat unset parameters for consistency
        if not z_vector:
            z_vector = [None]
        if not category:
            category = [None]

        beams = []
        blanks = []
        scene = Scene()

        if centerline and height and width:
            # check list lengths for consistency
            N = len(centerline)
            if len(z_vector) not in (0, 1, N):
                self.AddRuntimeMessage(
                    Error, " In 'ZVector' I need either none, one or the same number of inputs as the Crv parameter."
                )
            if len(width) not in (1, N):
                self.AddRuntimeMessage(
                    Error, " In 'W' I need either one or the same number of inputs as the Crv parameter."
                )
            if len(height) not in (1, N):
                self.AddRuntimeMessage(
                    Error, " In 'H' I need either one or the same number of inputs as the Crv parameter."
                )
            if len(category) not in (0, 1, N):
                self.AddRuntimeMessage(
                    Error, " In 'Category' I need either none, one or the same number of inputs as the Crv parameter."
                )

            # duplicate data if None or single value
            if len(z_vector) != N:
                z_vector = [z_vector[0] for _ in range(N)]
            if len(width) != N:
                width = [width[0] for _ in range(N)]
            if len(height) != N:
                height = [height[0] for _ in range(N)]
            if len(category) != N:
                category = [category[0] for _ in range(N)]

            for line, z, w, h, c in zip(centerline, z_vector, width, height, category):
                guid, geometry = self._get_guid_and_geometry(line)
                rhino_line = rs.coerceline(geometry)
                line = line_to_compas(rhino_line)

                z = vector_to_compas(z) if z else None
                beam = CTBeam.from_centerline(centerline=line, width=w, height=h, z_vector=z)
                beam.attributes["rhino_guid"] = str(guid) if guid else None
                beam.attributes["category"] = c
                print(guid)
                if updateRefObj and guid:
                    update_rhobj_attributes_name(guid, "width", str(w))
                    update_rhobj_attributes_name(guid, "height", str(h))
                    update_rhobj_attributes_name(guid, "zvector", str(list(beam.frame.zaxis)))
                    update_rhobj_attributes_name(guid, "category", c)

                beams.append(beam)
                scene.add(beam.blank)

        blanks = scene.draw()

        return beams, blanks

    def _get_guid_and_geometry(self, line):
        # internalized curves and GH geometry will not have persistent GUIDs, referenced Rhino objects will
        # type hint on the input has to be 'ghdoc' for this to work
        guid = None
        geometry = line
        rhino_obj = ActiveDoc.Objects.FindId(line)
        if rhino_obj:
            guid = line
            geometry = rhino_obj.Geometry
        return guid, geometry
# ---------- end beam ----------
beam_2 = CTBeam(Centerline=cluster.crv_4, ZVector=xprod.Vector, Width=number_slider_2, Height=number_slider_2)  # -> Beam, Blank; inputs Centerline: list, ZVector: list of Vector3d, Width: list, Height: list, Category: list, updateRefObj: Boolean; same code as beam
edges = BrepEdges(Brep=beam_2.Blank)  # -> Naked, Interior, NonManifold
edges_2 = BrepEdges(Brep=beam.Blank)  # -> Naked, Interior, NonManifold

# ---- group: Ref_Side
number_slider_3 = Slider(3, range=0..15)
number_slider_4 = Slider(2, range=0..5)

# ----
width = Slider(25, range=0..200)
number_slider_5 = Slider(0, range=0..200)
cone_angle = Slider(10, range=0..100)

length = Slider(60, range=0..200)
python_2 = GhPythonScript(
    cross_beam=beam.Beam,
    main_beam=beam_2.Beam,
    index=number_slider_3,
    ref_side_index=number_slider_4,
    start_depth=number_slider_5,
    width=width,
    length=length,
    cone_angle=cone_angle)  # -> out, rg_cutting_plane, rg_ref_side, mortise_btlx_params, tenon_btlx_params, rg_geometry, rg_planes, rg_tenon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; inputs index: Int32, ref_side_index: Int32
# ---------- python_2: Python ----------
from compas_rhino.conversions import surface_to_rhino
from compas_timber._fabrication import DovetailTenon
from compas_timber._fabrication import DovetailTenonParams
from compas_timber._fabrication import DovetailMortise
from compas_timber._fabrication import DovetailMortiseParams

from compas_timber.model import TimberModel
from compas_timber.fabrication import BTLx

from compas.geometry import Point, intersection_line_line, angle_vectors, angle_vectors_signed

from compas_rhino import unload_modules
from compas.scene import SceneObject

import math

from compas_rhino.conversions import frame_to_rhino, plane_to_rhino, vector_to_rhino, surface_to_rhino, polyline_to_rhino, brep_to_rhino, point_to_rhino, surface_to_rhino

import Rhino.Geometry as rg
unload_modules("compas_timber")

def _get_ref_side_most_ortho_to_cross_vector(beam_a, beam_b, ignore_ends=True):
        # compared to beam_side_incidence, this function considers the ref_sides and not faces and forms part of the transition to the new system
        """Returns a map of ref_side indices of beam_b and the angle of their normal with beam_a's centerline.

        This is used to find a cutting plane when joining the two beams.

        Parameters
        ----------
        beam_a : :class:`~compas_timber.parts.Beam`
            The beam that attaches with one of its ends to the side of beam_b.
        beam_b : :class:`~compas_timber.parts.Beam`
            The other beam.
        ignore_ends : bool, optional
            If True, only the first four ref_sides of `beam_b` are considered. Otherwise all ref_sides are considered.

        Examples
        --------
        >>> ref_side_angles = Joint.beam_side_incidence(beam_a, beam_b)
        >>> closest_ref_side_index = min(ref_side_angles, key=ref_side_angles.get)
        >>> cutting_plane = beam_b.ref_sides[closest_ref_side_index]

        Returns
        -------
        dict(int, float)
            A map of ref_side indices of beam_b and their respective angle with beam_a's centerline.

        """
        # find the orientation of beam_a's centerline so that it's pointing outward of the joint
        # find the closest end
        p1x, _ = intersection_line_line(beam_b.centerline, beam_a.centerline)
        if p1x is None:
            raise AssertionError("No intersection found")

        end, _ = beam_b.endpoint_closest_to_point(Point(*p1x))

        if end == "start":
            centerline_vec = beam_b.centerline.vector
        else:
            centerline_vec = beam_b.centerline.vector * -1

        if ignore_ends:
            beam_b_ref_sides = beam_b.ref_sides[:4]
        else:
            beam_b_ref_sides = beam_b.ref_sides
        
        cross_vect = centerline_vec.cross(beam_a.centerline.vector)
        ref_side_angles = {}
        for ref_side_index, ref_side in enumerate(beam_b_ref_sides):
            ref_side_angles[ref_side_index] = angle_vectors(ref_side.normal, cross_vect)

        return ref_side_angles

def _beam_ref_side_incidence(beam_a, beam_b, ignore_ends=True):
    # compared to beam_side_incidence, this function considers the ref_sides and not faces and forms part of the transition to the new system
    """Returns a map of ref_side indices of beam_b and the angle of their normal with beam_a's centerline.

    This is used to find a cutting plane when joining the two beams.

    Parameters
    ----------
    beam_a : :class:`~compas_timber.parts.Beam`
        The beam that attaches with one of its ends to the side of beam_b.
    beam_b : :class:`~compas_timber.parts.Beam`
        The other beam.
    ignore_ends : bool, optional
        If True, only the first four ref_sides of `beam_b` are considered. Otherwise all ref_sides are considered.

    Examples
    --------
    >>> ref_side_angles = Joint.beam_side_incidence(beam_a, beam_b)
    >>> closest_ref_side_index = min(ref_side_angles, key=ref_side_angles.get)
    >>> cutting_plane = beam_b.ref_sides[closest_ref_side_index]

    Returns
    -------
    dict(int, float)
        A map of ref_side indices of beam_b and their respective angle with beam_a's centerline.

    """
    # find the orientation of beam_a's centerline so that it's pointing outward of the joint
    # find the closest end
    p1x, _ = intersection_line_line(beam_a.centerline, beam_b.centerline)
    if p1x is None:
        raise AssertionError("No intersection found")

    end, _ = beam_a.endpoint_closest_to_point(Point(*p1x))

    if end == "start":
        centerline_vec = beam_a.centerline.vector
    else:
        centerline_vec = beam_a.centerline.vector * -1

    if ignore_ends:
        beam_b_ref_sides = beam_b.ref_sides[:4]
    else:
        beam_b_ref_sides = beam_b.ref_sides

    ref_side_angles = {}
    for ref_side_index, ref_side in enumerate(beam_b_ref_sides):
        ref_side_angles[ref_side_index] = angle_vectors(ref_side.normal, centerline_vec)

    return ref_side_angles

#define beam and cutting plane
beam = main_beam

geo = beam.compute_geometry(False)

cross_ref_side_dict = _beam_ref_side_incidence(main_beam, cross_beam, ignore_ends=True)
cross_ref_side_index = min(cross_ref_side_dict, key=cross_ref_side_dict.get)

main_ref_side_dict = _get_ref_side_most_ortho_to_cross_vector(cross_beam, main_beam, ignore_ends=True)
main_ref_side_index = min(main_ref_side_dict, key=main_ref_side_dict.get)

plane = cross_beam.ref_sides[cross_ref_side_index]

#create dovetail_tenon
DovetailTenon.define_dovetail_tool(15.0, 30.0, 28.0)
dovetail_tenon = DovetailTenon.from_plane_and_beam(plane, beam, start_depth=start_depth, width=width, length=length, cone_angle=cone_angle, ref_side_index=main_ref_side_index)
cutting_plane= dovetail_tenon.frame_from_params_and_beam(beam)

tenon_volume = dovetail_tenon.dovetail_volume_from_params_and_beam(beam)
geometry = dovetail_tenon.apply(geo, beam)

#print("Orientation: ", dovetail_tenon.orientation)
#print("StrutInclination: ", dovetail_tenon.inclination)
#print("Angle: ", dovetail_tenon.angle)
#print("Rotation: ", dovetail_tenon.rotation)

dovetail_mortise = DovetailMortise.from_plane_tenon_and_beam(cutting_plane, dovetail_tenon, cross_beam, cross_ref_side_index)
cutting_plane_mortise = dovetail_mortise.frame_from_params_and_beam(cross_beam)
#mortise_volume = dovetail_mortise.dovetail_volume_from_params_and_beam(cross_beam)
#get btlx params
dovetail_mortise_params = DovetailMortiseParams(dovetail_mortise).as_dict()
mortise_btlx_params = []
for key, value in dovetail_mortise_params.items():
    mortise_btlx_params.append("{0}: {1}".format(key, value))

#get btlx params
dovetail_tenon_params = DovetailTenonParams(dovetail_tenon).as_dict()
tenon_btlx_params = []
for key, value in dovetail_tenon_params.items():
    tenon_btlx_params.append("{0}: {1}".format(key, value))

#vizualize in rhino
rg_ref_side = frame_to_rhino(beam.ref_sides[ref_side_index])
rg_cutting_plane = frame_to_rhino(cutting_plane_mortise)
rg_geometry = brep_to_rhino(geometry)
rg_tenon = brep_to_rhino(tenon_volume)
# ---------- end python_2 ----------
panel = Panel(python_2.out)
pln = Plane(python_2.rg_ref_side)
brep = Brep(python_2.rg_geometry)
pln_2 = Plane(python_2.rg_planes)
pln_3 = Plane(python_2.rg_cutting_plane)
vec = Vector(python_2.rg_vect)
cluster_2 = Cluster(brep=brep)  # disabled
brep_2 = Brep(python_2.rg_tenon)
pln_4 = Plane(python_2.rg_trim)
vdis_2 = VectorDisplay(Anchor=pln_3, Vector=unitize(vec))
btlx_params = Panel(python_2.mortise_btlx_params)
tenon_btlx_params = Panel(python_2.tenon_btlx_params)
cone_angle_2 = Slider(10, range=0..100)
number_slider_6 = Slider(0, range=0..100)
number_slider_7 = Slider(25.6, range=0..100)
length_2 = Slider(60, range=0..200)
width_2 = Slider(25, range=0..200)

# ----
# TDovetailJoint
python_3 = GhPythonScript(
    cross_beam=beam.Beam,
    main_beam=beam_2.Beam,
    start_depth=number_slider_5,
    length=length_2,
    width=width_2,
    cone_angle=cone_angle_2)  # -> out, geometry, BTLx
# ---------- python_3: Python ----------
from compas_timber.connections import TDovetailJoint

from compas_timber.model import TimberModel
from compas_timber.fabrication import BTLx

from compas_rhino.conversions import brep_to_rhino

from compas_rhino import unload_modules

unload_modules("compas_timber")

# Instantiate TimberModel & Add Beams
timber_model = TimberModel()
beams = [cross_beam, main_beam]
for beam in beams:
    if beam.features:
        beam.remove_features(beam.features)
    timber_model.add_beam(beam)



# Create TStepJoint joint
dovetail_joint = TDovetailJoint.create(
    timber_model,
    main_beam,
    cross_beam,
    start_depth=start_depth,
    rotation=90.0,
    length=length,
    width=width,
    cone_angle=cone_angle,
    dovetail_shape=4,
    tool_angle=15.0,
    tool_diameter=60.034,
    tool_height=28.0
    )

# Generate Geometry
#geometry = [brep_to_rhino(beam.compute_geometry()) for beam in timber_model.beams]

# Write BTLx
btlx = BTLx(timber_model)
BTLx = btlx.btlx_string()
# ---------- end python_3 ----------
panel_2 = Panel(python_3.out)

panel_3 = Panel(python_3.BTLx)

# ---- group: GEOMETRY
swatch = ColourSwatch(SwatchColor=RGBA(0, 102, 255, 29))  # disabled
swatch_2 = ColourSwatch(SwatchColor=RGBA(240, 180, 137, 34))  # disabled
brep_3 = Brep(python_3.geometry)  # disabled
entwine = Entwine(Branch00=swatch, Branch01=swatch_2, FlattenInputs=True)  # disabled
edges_3 = BrepEdges(Brep=brep_3)  # -> Naked, Interior, NonManifold; disabled
previewlw = CustomPreviewLineweights(Geometry=edges_3.Interior, Shader=graft(entwine), Absolute=False)  # disabled
preview = CustomPreview(Geometry=brep_3, Material=flatten(entwine))  # disabled

# ==== cluster Cluster
brep = ClusterInput()
brep_2 = Brep(brep)
debrep = DeconstructBrep(Brep=brep_2)  # -> Faces, Edges, Vertices
midpt = CurveMiddle(Curve=debrep.Edges)
points = PointList(Points=midpt, Size=Slider(10, range=0..10))
pdecon = Deconstruct(Point=midpt)  # -> XComponent, YComponent, ZComponent
sort = SortList(Keys=pdecon.ZComponent, ValuesA=debrep.Edges)  # -> Keys, ValuesA
split = SplitList(List=sort.ValuesA, Index="4")  # -> ListA, ListB
sort_2 = SortList(Keys=split.ListA, ValuesA=split.ListA)  # -> Keys, ValuesA
panel = Panel("""0
-1""")
cull_i = CullIndex(List=sort_2.ValuesA, Indices=panel, Wrap=True)
index = ItemIndex(List=debrep.Edges, Item=cull_i)
filedge = FilletEdge(Shape=brep_2, Blend=0, Metric=0, Edges=index, Radii=Slider(7, range=0..10))

# ==== cluster Cluster_2
bool = ClusterInput()
vec = ClusterInput()
crv = ClusterInput()
bool_2 = Boolean(bool)
vec_2 = Vector(vec)
crv_2 = Curve(crv)
flip = FlipCurve(Curve=crv_2)  # -> Curve, Flag
filter = StreamFilter(Gate=bool_2, Stream0=crv_2, Stream1=flip.Curve)
end = EndPoints(Curve=filter)  # -> Start, End
pt = Point(end.Start)
pi = Pi(Factor=1)  # -> expr("x/2", Output)
angle = Angle(VectorA=filter, VectorB=vec_2)  # -> Angle, Reflex
number_slider = Slider(100, range=0..100)
subtraction = Subtraction(A=pi, B=angle.Angle)
square_root = SquareRoot(Value=2)
deg = Degrees(Radians=subtraction)
panel = Panel(deg)
abs = Absolute(Value=subtraction)
expression = Expression(x=abs, y=number_slider, Expression="abs((y/2)/cos(x)+(tan(x)*(y/2)))-(y/2)")
Z = UnitZ(Factor=expression)
move = Move(Geometry=pt, Motion=Z)  # -> Geometry, Transform
ln = Line(StartPoint=move.Geometry, EndPoint=end.End)
angle_2 = Angle(VectorA=filter, VectorB=ln)  # -> Angle, Reflex
sine = Sine(Value=angle_2.Angle)
panel_2 = Panel(sine)
deg_2 = Degrees(Radians=angle_2.Angle)
multiplication = Multiplication(A=square_root, B=number_slider)
multiplication_2 = Multiplication(A=multiplication, B=sine)
addition = Addition(A=expression, B=multiplication_2)
Z_2 = UnitZ(Factor=addition)
larger = LargerThan(FirstNumber=subtraction, SecondNumber="0")  # -> LargerThan, OrEqualTo
neg = Negative(Value=Z_2)
filter_2 = StreamFilter(Gate=larger.LargerThan, Stream0=Z_2, Stream1=neg)
move_2 = Move(Geometry=pt, Motion=filter_2)  # -> Geometry, Transform
ln_2 = Line(StartPoint=move_2.Geometry, EndPoint=end.End)
num = Number(expression)
crv_3 = Curve(ln_2)
num_2 = ClusterOutput(num)
crv_4 = ClusterOutput(crv_3)
