# Grasshopper definition test_step_joint.ghx (Grasshopper 1.0.7)
# plug-ins: Human

X = UnitX(Factor=Slider(0, range=0..2000))
Z = UnitZ(Factor=Slider(0, range=0..2000))
crv = Curve(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)

# ---- group: main_centerline
X_2 = UnitX(Factor=Slider(0, range=0..2000))
Z_2 = UnitZ(Factor=Slider(0, range=0..2000))
crv_2 = Curve(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)

# ----
flipcurve = BooleanToggle(True)
crv_3 = Curve(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)

# ---- group: cross_centerline
flipcurve_2 = BooleanToggle(False)
crv_4 = Curve(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)

# ----
end = EndPoints(Curve=crv_3)  # -> Start, End
addition = Addition(A=X, B=Z)
end_2 = EndPoints(Curve=crv_2)  # -> Start, End
addition_2 = Addition(A=X_2, B=Z_2)
move = Move(Geometry=end.End, Motion=expr("-x", addition))  # -> Geometry, Transform
move_2 = Move(Geometry=end_2.End, Motion=expr("-x", addition_2))  # -> Geometry, Transform
number_slider = Slider(100, range=0..100)
flip = FlipCurve(Curve=crv_4)  # -> Curve, Flag
number_slider_2 = Slider(100, range=0..100)
ln = Line(StartPoint=end.Start, EndPoint=move.Geometry)
flip_2 = FlipCurve(Curve=ln)  # -> Curve, Flag
filter = StreamFilter(Gate=flipcurve, Stream0=ln, Stream1=flip_2.Curve)
ln_2 = Line(StartPoint=end_2.Start, EndPoint=move_2.Geometry)
filter_2 = StreamFilter(Gate=flipcurve_2, Stream0=crv_4, Stream1=flip.Curve)
beam = CTBeam(Centerline=filter, Width=number_slider, Height=number_slider)  # -> Beam, Blank; inputs Centerline: list, ZVector: list of Vector3d, Width: list, Height: list, Category: list, updateRefObj: Boolean
#   port Centerline: Referenced curve or line, Guid of curve or line in the active Rhino document.
#   port ZVector: Vector defining the orientation of the cross-section (corresponds to the height dimension). If None, a default will be taken.
#   port Width: Width of the cross-section (usually the smaller dimension).
#   port Height: Height of the cross-section (usually the larger dimension).
#   port Category: Category of a beam.
#   port updateRefObj: (optional) If True, the attributes in the referenced object will be updated/overwritten with the new values given here.
#   port Beam: Beam object(s).
#   port Blank: Shape of the beam's blank.
# ---------- beam: Python ----------
"""Creates a Beam from a LineCurve."""

import rhinoscriptsyntax as rs
from compas.scene import Scene
from compas_rhino.conversions import line_to_compas
from compas_rhino.conversions import vector_to_compas
from ghpythonlib.componentbase import executingcomponent as component
from Grasshopper.Kernel.GH_RuntimeMessageLevel import Error
from Grasshopper.Kernel.GH_RuntimeMessageLevel import Warning
from Rhino.RhinoDoc import ActiveDoc

from compas_timber.elements import Beam as CTBeam
from compas_timber.ghpython.rhino_object_name_attributes import update_rhobj_attributes_name


class Beam_fromCurve(component):
    def RunScript(self, centerline, z_vector, width, height, category, updateRefObj):
        # minimum inputs required
        if not centerline:
            self.AddRuntimeMessage(Warning, "Input parameter 'Centerline' failed to collect data")
        if not width:
            self.AddRuntimeMessage(Warning, "Input parameter 'Width' failed to collect data")
        if not height:
            self.AddRuntimeMessage(Warning, "Input parameter 'Height' failed to collect data")

        # reformat unset parameters for consistency
        if not z_vector:
            z_vector = [None]
        if not category:
            category = [None]

        beams = []
        blanks = []
        scene = Scene()

        if centerline and height and width:
            # check list lengths for consistency
            N = len(centerline)
            if len(z_vector) not in (0, 1, N):
                self.AddRuntimeMessage(
                    Error, " In 'ZVector' I need either none, one or the same number of inputs as the Crv parameter."
                )
            if len(width) not in (1, N):
                self.AddRuntimeMessage(
                    Error, " In 'W' I need either one or the same number of inputs as the Crv parameter."
                )
            if len(height) not in (1, N):
                self.AddRuntimeMessage(
                    Error, " In 'H' I need either one or the same number of inputs as the Crv parameter."
                )
            if len(category) not in (0, 1, N):
                self.AddRuntimeMessage(
                    Error, " In 'Category' I need either none, one or the same number of inputs as the Crv parameter."
                )

            # duplicate data if None or single value
            if len(z_vector) != N:
                z_vector = [z_vector[0] for _ in range(N)]
            if len(width) != N:
                width = [width[0] for _ in range(N)]
            if len(height) != N:
                height = [height[0] for _ in range(N)]
            if len(category) != N:
                category = [category[0] for _ in range(N)]

            for line, z, w, h, c in zip(centerline, z_vector, width, height, category):
                guid, geometry = self._get_guid_and_geometry(line)
                rhino_line = rs.coerceline(geometry)
                line = line_to_compas(rhino_line)

                z = vector_to_compas(z) if z else None
                beam = CTBeam.from_centerline(centerline=line, width=w, height=h, z_vector=z)
                beam.attributes["rhino_guid"] = str(guid) if guid else None
                beam.attributes["category"] = c
                print(guid)
                if updateRefObj and guid:
                    update_rhobj_attributes_name(guid, "width", str(w))
                    update_rhobj_attributes_name(guid, "height", str(h))
                    update_rhobj_attributes_name(guid, "zvector", str(list(beam.frame.zaxis)))
                    update_rhobj_attributes_name(guid, "category", c)

                beams.append(beam)
                scene.add(beam.blank)

        blanks = scene.draw()

        return beams, blanks

    def _get_guid_and_geometry(self, line):
        # internalized curves and GH geometry will not have persistent GUIDs, referenced Rhino objects will
        # type hint on the input has to be 'ghdoc' for this to work
        guid = None
        geometry = line
        rhino_obj = ActiveDoc.Objects.FindId(line)
        if rhino_obj:
            guid = line
            geometry = rhino_obj.Geometry
        return guid, geometry
# ---------- end beam ----------
beam_2 = CTBeam(Centerline=crv, Width=Slider(80, range=0..100), Height=Slider(100, range=0..100))  # -> Beam, Blank; inputs Centerline: list, ZVector: list of Vector3d, Width: list, Height: list, Category: list, updateRefObj: Boolean; same code as beam
beam_3 = CTBeam(Centerline=filter_2, Width=number_slider_2, Height=number_slider_2)  # -> Beam, Blank; inputs Centerline: list, ZVector: list of Vector3d, Width: list, Height: list, Category: list, updateRefObj: Boolean; same code as beam
beam_4 = CTBeam(Centerline=ln_2, Width=Slider(80, range=0..100), Height=Slider(100, range=0..100))  # -> Beam, Blank; inputs Centerline: list, ZVector: list of Vector3d, Width: list, Height: list, Category: list, updateRefObj: Boolean; same code as beam
edges = BrepEdges(Brep=beam_2.Blank)  # -> Naked, Interior, NonManifold
toggle = BooleanToggle(True)
decomposebeam = CTDecomposeBeam(Beam=[beam_4.Beam, beam_3.Beam], ShowFrame=toggle, ShowFaces=toggle)  # -> Frame, Centerline, Box, Width, Height; inputs Beam: list, ShowFrame: Boolean, ShowFaces: Boolean
# ---------- decomposebeam: Python ----------
# flake8: noqa
from compas.geometry import Line
from compas_rhino.conversions import frame_to_rhino_plane
from compas_rhino.conversions import line_to_rhino
from compas_rhino.conversions import point_to_rhino
from compas_rhino.conversions import box_to_rhino
from ghpythonlib.componentbase import executingcomponent as component
from System.Drawing import Color


class BeamDecompose(component):
    RED = Color.FromArgb(255, 255, 100, 100)
    GREEN = Color.FromArgb(200, 50, 220, 100)
    BLUE = Color.FromArgb(200, 50, 150, 255)
    WHITE = Color.FromArgb(255, 255, 255, 255)
    YELLOW = Color.FromArgb(255, 255, 255, 0)
    SCREEN_SIZE = 10
    RELATIVE_SIZE = 0

    def RunScript(self, beam, show_frame, show_faces):
        self.show_faces = show_faces if show_faces is not None else False
        self.show_frame = show_frame if show_frame is not None else False
        self.frames = []
        self.rhino_frames = []
        self.scales = []
        self.faces = []
        self.width = []
        self.height = []
        self.centerline = []
        self.shapes = []

        for b in beam:
            self.frames.append(b.frame)
            self.rhino_frames.append(frame_to_rhino_plane(b.frame))
            self.scales.append(b.width + b.height)
            self.centerline.append(line_to_rhino(b.centerline))
            self.shapes.append(box_to_rhino(b.shape))
            self.width.append(b.width)
            self.height.append(b.height)
            self.faces.append(b.faces)

        return self.rhino_frames, self.centerline, self.shapes, self.width, self.height

    def DrawViewportWires(self, arg):
        if self.Locked:
            return

        for f, s, faces in zip(self.frames, self.scales, self.faces):
            if self.show_frame:
                self._draw_frame(arg.Display, f, s)
            if self.show_faces:
                self._draw_faces(arg.Display, faces, s)

    def _draw_frame(self, display, frame, scale):
        x = Line.from_point_and_vector(frame.point, frame.xaxis * scale)
        y = Line.from_point_and_vector(frame.point, frame.yaxis * scale)
        z = Line.from_point_and_vector(frame.point, frame.zaxis * scale)
        display.DrawArrow(line_to_rhino(x), self.RED, self.SCREEN_SIZE, self.RELATIVE_SIZE)
        display.DrawArrow(line_to_rhino(y), self.GREEN, self.SCREEN_SIZE, self.RELATIVE_SIZE)
        display.DrawArrow(line_to_rhino(z), self.BLUE, self.SCREEN_SIZE, self.RELATIVE_SIZE)

        x_loc = x.end + x.vector * scale * 1.1
        y_loc = y.end + y.vector * scale * 1.1
        z_loc = z.end + z.vector * scale * 1.1
        display.Draw2dText("X", self.RED, point_to_rhino(x_loc), True, 16, "Verdana")
        display.Draw2dText("Y", self.GREEN, point_to_rhino(y_loc), True, 16, "Verdana")
        display.Draw2dText("Z", self.BLUE, point_to_rhino(z_loc), True, 16, "Verdana")

    def _draw_faces(self, display, faces, scale):
        for index, face in enumerate(faces):
            normal = Line.from_point_and_vector(face.point, face.normal * scale)
            text = str(index)
            display.Draw2dText(text, self.WHITE, point_to_rhino(face.point), True, 16, "Verdana")
            display.DrawArrow(line_to_rhino(normal), self.YELLOW, self.SCREEN_SIZE, self.RELATIVE_SIZE)
# ---------- end decomposebeam ----------

# ---- group: Ref_Side
number_slider_3 = Slider(0, range=0..5)
number_slider_4 = Slider(2, range=0..15)

# ---- group: Mortise
number_slider_5 = Slider(40, range=0..100)

# ---- group: StepShape
number_slider_6 = Slider(0, range=0..200)
number_slider_7 = Slider(17, range=0..200)
tapered_heel = BooleanToggle(False)

# ---- group: Mortise
number_slider_8 = Slider(40, range=0..100)

# ---- group: Ref_Side
number_slider_9 = Slider(2, range=0..5)
number_slider_10 = Slider(0, range=0..15)

# ---- group: StepShape
number_slider_11 = Slider(30, range=0..200)
number_slider_12 = Slider(15, range=0..200)
tapered_heel_2 = BooleanToggle(False)

# ----
python = GhPythonScript(
    cross_beam=beam_2.Beam,
    main_beam=beam.Beam,
    index=number_slider_4,
    ref_side_index=number_slider_3,
    step=number_slider_6,
    heel=number_slider_7,
    tapered=tapered_heel,
    mortise_height=number_slider_5)  # -> out, surface, rg_cutting_plane, rg_planes, rg_ref_side, rg_mortise_polylines, btlx_params; inputs index: Int32, ref_side_index: Int32
# ---------- python: Python ----------
from compas_rhino.conversions import surface_to_rhino
from compas_timber._fabrication import StepJointNotch
from compas_timber._fabrication import StepJointNotchParams
from compas_timber._fabrication import StepJoint

from compas_timber.model import TimberModel
from compas_timber.fabrication import BTLx

from compas_rhino import unload_modules
from compas.scene import SceneObject

from compas_rhino.conversions import frame_to_rhino, plane_to_rhino, surface_to_rhino, polyline_to_rhino

import Rhino.Geometry as rg
unload_modules("compas_timber")

#define beam and cutting plane
beam = main_beam
plane = cross_beam.ref_sides[index]

#create step_joint
step_joint = StepJoint.from_plane_and_beam(plane, beam, step, heel, tapered, ref_side_index)
cutting_planes = step_joint.planes_from_params_and_beam(beam)
#
###create step_joint_notch
##step_joint_notch = StepJointNotch.from_surface_and_beam(plane, beam, notch_limited=False, step_depth=step, heel_depth=heel, strut_height=100.0, tapered_heel=tapered, ref_side_index=ref_side_index)
##cutting_planes = step_joint_notch.planes_from_params_and_beam(beam)
##
##print("Orientation: ", step_joint_notch.orientation)
##print("StartX: ", step_joint_notch.start_x)
##print("StrutInclination: ", step_joint_notch.strut_inclination)
##
##
###add mortise
##if mortise_height > 0:
##    step_joint_notch.add_mortise(beam.width/4, mortise_height, beam)
##    mortise_polylines = step_joint_notch.mortise_volume_from_params_and_beam(beam)
##
####apply geometric features
###step_joint_notch.apply(brep, beam)
##
###get btlx params
##step_joint_notch_params = StepJointNotchParams(step_joint_notch).as_dict()
##btlx_params = []
##for key, value in step_joint_notch_params.items():
##    btlx_params.append("{0}: {1}".format(key, value))
##
##
##vizualize in rhino
rg_ref_side = frame_to_rhino(beam.ref_sides[ref_side_index])
rg_cutting_plane = frame_to_rhino(plane)
rg_planes = (plane_to_rhino(plane) for plane in cutting_planes)
##
##rg_mortise_polylines = [polyline_to_rhino(polyline) for polyline in mortise_polylines]
# ---------- end python ----------
panel = Panel(python.out)
python_2 = GhPythonScript(
    cross_beam=beam_3.Beam,
    main_beam=beam_4.Beam,
    index=number_slider_10,
    ref_side_index=number_slider_9,
    step=number_slider_11,
    heel=number_slider_12,
    tapered=tapered_heel_2,
    mortise_height=number_slider_8)  # -> out, surface, rg_cutting_plane, rg_planes, rg_ref_side, rg_mortise_polylines, btlx_params; inputs index: Int32, ref_side_index: Int32
# ---------- python_2: Python ----------
from compas_rhino.conversions import surface_to_rhino
from compas_timber._fabrication import StepJointNotch
from compas_timber._fabrication import StepJointNotchParams

from compas_timber.model import TimberModel
from compas_timber.fabrication import BTLx

from compas_rhino import unload_modules
from compas.scene import SceneObject

from compas_rhino.conversions import frame_to_rhino, plane_to_rhino, surface_to_rhino, polyline_to_rhino

import Rhino.Geometry as rg
unload_modules("compas_timber")

#define beam and cutting plane
beam = cross_beam
plane = main_beam.ref_sides[index]

#create step_joint_notch
step_joint_notch = StepJointNotch.from_surface_and_beam(plane, beam, notch_limited=False, step_depth=step, heel_depth=heel, strut_height=100.0, tapered_heel=tapered, ref_side_index=ref_side_index)
cutting_planes = step_joint_notch.planes_from_params_and_beam(beam)

print("Orientation: ", step_joint_notch.orientation)
print("StartX: ", step_joint_notch.start_x)
print("StrutInclination: ", step_joint_notch.strut_inclination)


#add mortise
if mortise_height > 0:
    step_joint_notch.add_mortise(beam.width/4, mortise_height, beam)
    mortise_polylines = step_joint_notch.mortise_volume_from_params_and_beam(beam)

##apply geometric features
#step_joint_notch.apply(brep, beam)

#get btlx params
step_joint_notch_params = StepJointNotchParams(step_joint_notch).as_dict()
btlx_params = []
for key, value in step_joint_notch_params.items():
    btlx_params.append("{0}: {1}".format(key, value))


#vizualize in rhino
rg_ref_side = frame_to_rhino(beam.ref_sides[ref_side_index])
rg_cutting_plane = frame_to_rhino(plane)
rg_planes = (plane_to_rhino(plane) for plane in cutting_planes)

rg_mortise_polylines = [polyline_to_rhino(polyline) for polyline in mortise_polylines]
# ---------- end python_2 ----------
panel_2 = Panel(python_2.out)
cluster = Cluster(B=beam.Blank, pln=python.rg_planes, C=python.rg_mortise_polylines)
btlx_params = Panel(python.btlx_params)
cluster_2 = Cluster(B=beam_3.Blank, pln=python_2.rg_planes, pln_2=python_2.rg_ref_side, C=python_2.rg_mortise_polylines)
btlx_params_2 = Panel(python_2.btlx_params)
edges_2 = BrepEdges(Brep=cluster)  # -> Naked, Interior, NonManifold
edges_3 = BrepEdges(Brep=cluster_2)  # -> Naked, Interior, NonManifold

# ---- group: CUTTING PLANE
pln = Plane(python.rg_cutting_plane)

# ---- group: REF_SIDE
pln_2 = Plane(python.rg_ref_side)

# ---- group: notch_planes
pln_3 = Plane(python.rg_planes)

# ----
preview = CustomPreview(
    Geometry=cluster,
    Material={diffuse=RGB(221, 160, 221), emission=RGB(66, 48, 66), shine=0.5, specular=RGB(255, 255, 255), transparency=0})
previewlw = CustomPreviewLineweights(
    Geometry=edges_2.Interior,
    Shader={diffuse=RGB(255, 105, 180), emission=RGB(76, 32, 54), shine=0.5, specular=RGB(255, 255, 255), transparency=0},
    Absolute=False)

# ---- group: CUTTING PLANE
pln_4 = Plane(python_2.rg_cutting_plane)

# ---- group: REF_SIDE
pln_5 = Plane(python_2.rg_ref_side)

# ---- group: notch_planes
pln_6 = Plane(python_2.rg_planes)

# ----
preview_2 = CustomPreview(
    Geometry=cluster_2,
    Material={diffuse=RGB(221, 160, 221), emission=RGB(66, 48, 66), shine=0.5, specular=RGB(255, 255, 255), transparency=0})
previewlw_2 = CustomPreviewLineweights(
    Geometry=edges_3.Interior,
    Shader={diffuse=RGB(255, 105, 180), emission=RGB(76, 32, 54), shine=0.5, specular=RGB(255, 255, 255), transparency=0},
    Absolute=False)
item = ListItem(List=pln_3, Index=0, Wrap=True)

# ==== cluster Cluster
pln = ClusterInput()
pln_2 = ClusterInput()
pln_3 = Plane(pln)
pln_4 = Plane(pln_2)
dispatch = Dispatch(List=pln_3, DispatchPattern=[True, False])  # -> ListA, ListB
deplane = DeconstructPlane(Plane=dispatch.ListB)  # -> Origin, XAxis, YAxis, ZAxis
pl_origin = PlaneOrigin(Base=pln_4, Origin=deplane.Origin)
number_slider = Slider(200, range=0..200)
number_slider_2 = Slider(200, range=0..200)
neg = Negative(Value=number_slider)
dom = ConstructDomain(DomainStart=neg, DomainEnd=number_slider)
C = ClusterInput()
dom_2 = ConstructDomain(DomainStart=expr("-x", number_slider_2), DomainEnd=number_slider_2)
loft = Loft(Curves=C, Options={Adjust=False, Closed=False, LoftEnds=0, LoftSimp=0, LoftType=0, Rebuild=10, Refit=0.01})
planesrf = PlaneSurface(Plane=dispatch.ListA, XSize=dom, YSize=dom)
planesrf_2 = PlaneSurface(Plane=dispatch.ListB, XSize=dom, YSize=dom)
planesrf_3 = PlaneSurface(Plane=pl_origin, XSize=dom, YSize=dom)
B = ClusterInput()
planesrf_4 = PlaneSurface(Plane=pln_3, XSize=dom_2, YSize=dom_2)
cap = CapHoles(Brep=loft)
bbx = BrepBrep(BrepA=planesrf, BrepB=planesrf_2)  # -> Curves, Points
bbx_2 = BrepBrep(BrepA=planesrf, BrepB=planesrf_3)  # -> Curves, Points
bbx_3 = BrepBrep(BrepA=planesrf_2, BrepB=planesrf_3)  # -> Curves, Points
splitmul = SplitBrepMultiple(Brep=cap, Cutters=planesrf_4)
flip = FlipCurve(Curve=bbx_3.Curves, Guide=bbx.Curves)  # -> Curve, Flag
flip_2 = FlipCurve(Curve=bbx_2.Curves, Guide=bbx.Curves)  # -> Curve, Flag
rulesrf = RuledSurface(CurveA=bbx.Curves, CurveB=[flip.Curve, flip_2.Curve])
sort = SortList(Keys=splitmul, ValuesA=splitmul)  # -> Keys, ValuesA
item = ListItem(List=reverse(sort.ValuesA), Index=0, Wrap=True)
join = BrepJoin(Breps=flatten(rulesrf))  # -> Breps, Closed
split = SplitBrep(Brep=B, Cutter=join.Breps)
bbx_4 = BrepBrep(BrepA=planesrf_4, BrepB=item)  # -> Curves, Points
connect = ConnectCurves(Curves=bbx_4.Curves, Continuity=0, Close=True, Bulge=1)
sort_2 = SortList(Keys=split, ValuesA=split)  # -> Keys, ValuesA
boundary = BoundarySurfaces(Edges=connect)
item_2 = ListItem(List=reverse(sort_2.ValuesA), Index=0, Wrap=True)
join_2 = BrepJoin(Breps=flatten([item, boundary]))  # -> Breps, Closed
split_2 = SplitBrep(Brep=join.Breps, Cutter=item_2)
item_3 = ListItem(List=split_2, Index=0, Wrap=True)
join_3 = BrepJoin(Breps=flatten([item_2, item_3]))  # -> Breps, Closed
brep = Brep(join_3.Breps)
brep_2 = Brep(join_2.Breps)
sdiff = SolidDifference(BrepsA=brep, BrepsB=brep_2)
R = ClusterOutput(sdiff)
